# Dynamo graph 00BinhDUONG - Wall - Opening for Shaft-V1.dyn (Dynamo 2.12.1.8246)
# packages: Rhythm 2022.11.2, bimorphNodes 4.2.1

# note: Placing new opening
family_types = FamilyTypes("NIA-AR-GEN-Cutout_Void:Family1")  # graph input
select_wall_elements = DSModelElementsByCategorySelection("7223fd10-da26-435f-8ae4-a155d58b86c6-00a74ddd")  # 1 picked in the model; graph input

# group: Filter the surface of wall
solids = Element.Solids(element=select_wall_elements)
bySolid = PolySurface.BySolid(solid=solids)
surfaces = PolySurface.Surfaces(polySurface=bySolid)
area = Surface.Area()  # unwired: surface
maximumItemByKey = List.MaximumItemByKey(list=surfaces@@L2, keyFunction=area)
watch = Watch(maximumItemByKey)
flatten = List.Flatten(list=watch)

isNull = Object.IsNull(object=flatten)
filterByBoolMask = List.FilterByBoolMask(list=flatten, mask=isNull)
select_elements_from_link = SelectElementsInLink()  # nothing selected
solids_2 = Element.Solids(element=select_elements_from_link.Elements)
flatten_2 = List.Flatten(list=solids_2)
byUnion = Solid.ByUnion(solids=flatten_2)
intersect = Geometry.Intersect(geometry=filterByBoolMask.out, other=byUnion, lacing=CrossProduct)
flatten_3 = List.Flatten(list=intersect@L3)
code_block = CodeBlock { 0.5; }
pointAtParameter = Surface.PointAtParameter(surface=flatten_3@@L1, u=code_block, v=code_block, lacing=Longest)
isNull_2 = Object.IsNull(object=pointAtParameter)
filterByBoolMask_2 = List.FilterByBoolMask(list=pointAtParameter, mask=isNull_2)
watch_2 = Watch(filterByBoolMask_2.out)
byPoint = FamilyInstance.ByPoint(familyType=family_types, point=watch_2)
watch_3 = Watch(byPoint)
flatten_4 = List.Flatten(list=watch_3)
string = StringInput("Width")  # graph input
true_wall_in_horizontal_false = BoolSelector(true)  # "True = Wall in Horizontal | False = Wall in Vertical"; graph input

# group: Filter the intersect Surface
isEmpty = List.IsEmpty(list=intersect@@L2, lacing=Longest)
filterByBoolMask_3 = List.FilterByBoolMask(list=intersect, mask=isEmpty)
watch_4 = Watch(filterByBoolMask_3.out)
isEmpty_2 = List.IsEmpty(list=watch_4@@L2, lacing=Longest)
watch_5 = Watch(isEmpty_2)
filterByBoolMask_4 = List.FilterByBoolMask(list=filterByBoolMask_3.out, mask=watch_5)
watch_6 = Watch(filterByBoolMask_4.out)
allTrue = List.AllTrue(list=isEmpty)

code_block_2 = CodeBlock { 1; }
thicken = Surface.Thicken(surface=watch_6, thickness=code_block_2)
boundingBox = Geometry.BoundingBox(geometry=thicken)
toCuboid = BoundingBox.ToCuboid(boundingBox=boundingBox)
watch_7 = Watch(toCuboid)
width = Cuboid.Width(cuboid=watch_7@@L2)
length = Cuboid.Length(cuboid=watch_7@@L2)
if_ = RefactoredIf(test=true_wall_in_horizontal_false, true=width, false=length)
code_block_3 = CodeBlock(b_width=if_) { b_width; }
height = Cuboid.Height(cuboid=watch_7@@L2)
code_block_4 = CodeBlock(h_height=height) { h_height; }
extention_of_opening = CodeBlock { 100; }

# group: Size of openning
list_create = List.Create(item0=code_block_3, item1=code_block_4)
round = Math.Round(number=list_create)
floor = Math.Floor(number=round)
code_block_5 = CodeBlock { 50; }
div = floor / code_block_5
ceiling = Math.Ceiling(number=div)
mul = ceiling * code_block_5
add = mul + extention_of_opening
string_from_object = FromObject(object=add)
code_block_6 = CodeBlock(a=string_from_object) { a[0]; a[1]; }
bxh = CodeBlock(width=code_block_6.out0, height=code_block_6.out1) { width+" x "+height; }

flatten_5 = List.Flatten(list=bxh)
string_2 = StringInput("Height")  # graph input

# group: Create new Family types
code_block_7 = CodeBlock { " x "; }
split = String.Split(string=flatten_5, separator0=code_block_7)
firstItem = List.FirstItem(list=split@L2)
toNumber = String.ToNumber(string=firstItem)
setParameterByName = Element.SetParameterByName(element=flatten_4, parameterName=string, value=toNumber)
lastItem = List.LastItem(list=split@L2)
toNumber_2 = String.ToNumber(string=lastItem)
setParameterByName_2 = Element.SetParameterByName(element=flatten_4, parameterName=string_2, value=toNumber_2)

empty = List.Empty()
if_2 = RefactoredIf(test=true_wall_in_horizontal_false, true=empty, false=byPoint)
code_block_8 = CodeBlock { 90; }
setRotation = FamilyInstance.SetRotation(familyInstance=if_2, degree=code_block_8)

# group: Select all elements from Linked
links = Links("YIAPL-E1-PH1-GC-T1-MEGN-M3-ZZ-100-G-0200.rvt : 66 : location <Not Shared>")
categories = Categories("OST_DuctCurves")
categories_2 = Categories("OST_DuctAccessory")
list_create_2 = List.Create(item0=categories, item1=categories_2)
ofCategory = Revit.LinkElement.OfCategory(linkInstance=links.out0, category=list_create_2)
