# Dynamo graph 01BinhDUONG - Wall - Opening for Duct (Rectange)-V2.dyn (Dynamo 2.12.1.8246)
# packages: Bakery 2019.5.8

# note: Family of the opening: NIA-AR-GEN-....
family_types_opening = FamilyTypes("NIA-AR-GEN-Wall_Rectange_Opening:Void Instance Size")  # graph input
familyType = Watch(family_types_opening)
# note: Input require for CSV of interference check report
file_path_of_the_interference = Filename(".\Sample-rac_advanced_sample_project.html.csv")  # "File Path of the Interference Check"; graph input

# group: Taking Interface report to get ID
importCSV = Data.ImportCSV(filePath=file_path_of_the_interference)
watch = Watch(importCSV)

# group: Filter the Wall and Linked Element ID
code_block = CodeBlock { 0..6; }
firstItem = List.FirstItem(list=watch)
count = List.Count(list=firstItem)
code_block_2 = CodeBlock(x=count) { [x-2,x-1]; }
list_create = List.Create(item0=code_block, item1=code_block_2)
flatten = List.Flatten(list=list_create)
removeItemAtIndex = List.RemoveItemAtIndex(list=watch@L2, indices=flatten)
watch_2 = Watch(removeItemAtIndex)
code_block_3 = CodeBlock(x=watch_2) { x[1]; x[2]; }
list_create_2 = List.Create(item0=code_block_3.out0, item1=code_block_3.out1)

watch_3 = Watch(list_create_2)

# group: Take ID only
code_block_4 = CodeBlock { "id"; }
indexOf = String.IndexOf(string=watch_3@@L1, searchFor=code_block_4)
code_block_5 = CodeBlock(x=indexOf) { x+2; }
length = String.Length(string=watch_3@@L1)
code_block_6 = CodeBlock(len=length, indexID=code_block_5) { len-indexID; }
substring = String.Substring(string=watch_3, startIndex=code_block_5, length=code_block_6)
watch_4 = Watch(substring)

code_block_7 = CodeBlock(x=watch_4) { x[0]; x[1]; }
walls = Watch(code_block_7.out0)
element_by_id = ElementById(Id=walls)
solids = Element.Solids(element=element_by_id)

# group: Filter error Walls
isEmpty = List.IsEmpty(list=solids@L2)
filterByBoolMask = List.FilterByBoolMask(list=solids, mask=isEmpty)
watch_5 = Watch(filterByBoolMask.out)

bySolid = PolySurface.BySolid(solid=watch_5)

# group: Extract the suface of wall
surfaces = PolySurface.Surfaces(polySurface=bySolid)
code_block_8 = CodeBlock { 0.5; }
normalAtParameter = Surface.NormalAtParameter(surface=surfaces, u=code_block_8, v=code_block_8)
ZAxis = Vector.ZAxis()
isParallel = Vector.IsParallel(vector=normalAtParameter, otherVector=ZAxis)
filterByBoolMask_2 = List.FilterByBoolMask(list=surfaces, mask=isParallel)
watch_6 = Watch(filterByBoolMask_2.out)
area = Surface.Area()  # unwired: surface
maximumItemByKey = List.MaximumItemByKey(list=watch_6@@L2, keyFunction=area)
watch_7 = Watch(maximumItemByKey)
flatten_2 = List.Flatten(list=watch_7)

watch_3d = Watch3D(flatten_2)
ducts_pipes_linked_elements = Watch(code_block_7.out1)

# group: Filter error Walls
filterByBoolMask_3 = List.FilterByBoolMask(list=ducts_pipes_linked_elements, mask=isEmpty)
watch_8 = Watch(filterByBoolMask_3.out)

toNumber = String.ToNumber(string=watch_8@L1)
get_linked_elements_by_id = Python(IN[0]=toNumber)  # "Get Linked Elements By ID(Integer)"; IronPython2
# ---------- get_linked_elements_by_id.python (42 lines) ----------
import clr

clr.AddReference("RevitAPIUI")
from  Autodesk.Revit.UI import *

clr.AddReference("RevitAPI")
from  Autodesk.Revit.DB import *

clr.AddReference("RevitServices")
import RevitServices
from RevitServices.Persistence import DocumentManager
doc = DocumentManager.Instance.CurrentDBDocument
uidoc=DocumentManager.Instance.CurrentUIApplication.ActiveUIDocument

clr.AddReference("RevitNodes")
import Revit
clr.ImportExtensions(Revit.Elements)

ids = []
linkedElements = []
c = 0
try:
	c = len(IN[0])
except:
	c = 1
if c > 1:
	for id in IN[0]:
		ids.Add(ElementId(id))
else:
	ids.Add(ElementId(IN[0]))

sel = uidoc.Selection
obType = Selection.ObjectType.Element

rLinkRef = sel.PickObject(obType, "Please Select a Revit Link")

rLink = doc.GetElement(rLinkRef.ElementId)
rLinkDoc = rLink.GetLinkDocument()

for id in ids:
	linkedElements.Add(rLinkDoc.GetElement(id).ToDSType(True))
OUT = linkedElements
# ----------------------------------------
watch_9 = Watch(get_linked_elements_by_id)
geometry = Element.Geometry(element=watch_9)
flatten_3 = List.Flatten(list=geometry)

# group: Convert the geometry with coodination of difference internal origin points
distance_line_between_2_internal = DSModelElementSelection()  # "Distance line between 2 Internal Origin points"; 1 picked in the model; graph input
geometry_2 = Element.Geometry(element=distance_line_between_2_internal)
startPoint = Curve.StartPoint(curve=geometry_2)
byOrigin = CoordinateSystem.ByOrigin(origin=startPoint)
count_2 = List.Count(list=flatten_3)
cycle = List.Cycle(list=byOrigin, amount=count_2)
endPoint = Curve.EndPoint(curve=geometry_2)
byOrigin_2 = CoordinateSystem.ByOrigin(origin=endPoint)
cycle_2 = List.Cycle(list=byOrigin_2, amount=count_2)
transform = Geometry.Transform(geometry=flatten_3, fromCoordinateSystem=cycle, contextCoordinateSystem=cycle_2)

watch_10 = Watch(transform)
intersect = Geometry.Intersect(geometry=watch_3d, other=watch_10)
isEmpty_2 = List.IsEmpty(list=intersect@L2)
filterByBoolMask_4 = List.FilterByBoolMask(list=element_by_id, mask=isEmpty_2)
get_walls_get_by_id = Watch(filterByBoolMask_4.out)
filterByBoolMask_5 = List.FilterByBoolMask(list=intersect, mask=isEmpty_2)
byUnion = Surface.ByUnion(surfaces=filterByBoolMask_5.out@L2)

# group: Find the intersect point
flatten_4 = List.Flatten(list=byUnion@L3)
code_block_9 = CodeBlock { 0.5; }
pointAtParameter = Surface.PointAtParameter(surface=flatten_4@@L1, u=code_block_9, v=code_block_9, lacing=Longest)
flatten_5 = List.Flatten(list=pointAtParameter)
points_of_intersection = Watch(flatten_5)

byHostAndPoint = FamilyInstance.ByHostAndPoint(familyType=familyType, host=get_walls_get_by_id, point=points_of_intersection)
watch_11 = Watch(byHostAndPoint)
flatten_6 = List.Flatten(list=watch_11)
parameter_width = StringInput("Width")  # graph input
filterByBoolMask_6 = List.FilterByBoolMask(list=watch_9, mask=isEmpty_2)
linked_elements_get_by_id = Watch(filterByBoolMask_6.out)
string = StringInput("Width")
getParameterValueByName = Element.GetParameterValueByName(element=linked_elements_get_by_id, parameterName=string)
code_block_10 = CodeBlock(x=getParameterValueByName) { x+50*2; }
setParameterByName = Element.SetParameterByName(element=flatten_6, parameterName=parameter_width, value=code_block_10)
parameter_height = StringInput("Height")  # graph input
string_2 = StringInput("Height")
getParameterValueByName_2 = Element.GetParameterValueByName(element=linked_elements_get_by_id, parameterName=string_2)
code_block_11 = CodeBlock(x=getParameterValueByName_2) { x+50*2; }
setParameterByName_2 = Element.SetParameterByName(element=flatten_6, parameterName=parameter_height, value=code_block_11)
# note: Input require: Link of Duct/Pipe
select_model_element = DSModelElementSelection()  # 1 picked in the model; frozen
id = Element.Id(element=select_model_element)

# group: Get Link Document from Link Instance Id - come from another package name 'Bakery'
get_linked_rvt_documents = Custom[Get Linked RVT Documents]()  # frozen; package Bakery
code_block_12 = CodeBlock { 0; }
getItemAtIndex = List.GetItemAtIndex(list=get_linked_rvt_documents.Link_Doc, index=code_block_12)
watch_12 = Watch(getItemAtIndex)
firstItem_2 = List.FirstItem(list=watch_12)
code_block_13 = CodeBlock(oneLinkDoc=firstItem_2) { oneLinkDoc; }
code_block_14 = CodeBlock(oneLinkInstanceId=id) { oneLinkInstanceId; }
create = List.Create(item0=code_block_14)
bv_if_equal_return_index = Custom[bv If Equal Return Index](listA=create, listB=get_linked_rvt_documents.Link_Instance_Id)  # package Bakery; forked
indexOf_2 = List.IndexOf(list=get_linked_rvt_documents.Link_Instance_Id, element=code_block_14)

get_linked_elements_by_id_2 = Python(IN[0]=toNumber, IN[1]=code_block_13)  # "Get Linked Elements By ID(Integer)"; IronPython2; frozen
# ---------- get_linked_elements_by_id_2.python (42 lines) ----------
import clr

clr.AddReference("RevitAPIUI")
from  Autodesk.Revit.UI import *

clr.AddReference("RevitAPI")
from  Autodesk.Revit.DB import *

clr.AddReference("RevitServices")
import RevitServices
from RevitServices.Persistence import DocumentManager
doc = DocumentManager.Instance.CurrentDBDocument
uidoc=DocumentManager.Instance.CurrentUIApplication.ActiveUIDocument

clr.AddReference("RevitNodes")
import Revit
clr.ImportExtensions(Revit.Elements)

ids = []
linkedElements = []
c = 0
try:
	c = len(IN[0])
except:
	c = 1
if c > 1:
	for id in IN[0]:
		ids.Add(ElementId(id))
else:
	ids.Add(ElementId(IN[0]))

sel = uidoc.Selection
obType = Selection.ObjectType.Element

rLinkDoc = IN[1]

#rLink = doc.GetElement(rLinkID)
#rLinkDoc = rLink.GetLinkDocument()

for id in ids:
	linkedElements.Add(rLinkDoc.GetElement(id).ToDSType(True))
OUT = linkedElements
# ----------------------------------------
area_2 = Surface.Area(surface=watch_6@@L2)
