# Dynamo graph 2020.02.23-VIEW-OVERRIDE CROP BOUNDARY PATTERN  WITH NO EXTERNAL PACKAGES.DYN "BinhDuong - Override Crop Boundary Pattern with no external Packages" (Dynamo 2.1.0.7500)

categories = Categories("OST_Sheets")  # graph input
all_elements_of_category = ElementsOfCategory(Category=categories)

# group: Filter Sheets
sheetNumber = Sheet.SheetNumber(sheet=all_elements_of_category)
string = StringInput("A103")  # graph input
startsWith = String.StartsWith(str=sheetNumber, searchFor=string)
filterByBoolMask = List.FilterByBoolMask(list=all_elements_of_category, mask=startsWith)

views = Sheet.Views(sheet=filterByBoolMask.in)
flatten = List.Flatten(list=views)

# group: Exclude the Legends and Schedule - They don't have the crop region
code_block = CodeBlock { "View Name"; }
getParameterValueByName = Element.GetParameterValueByName(element=flatten, parameterName=code_block)
element_types = ElementTypes("TopRailType")  # graph input
all_elements_of_type = ElementsOfType(element_type=element_types)
getParameterValueByName_2 = Element.GetParameterValueByName(element=all_elements_of_type, parameterName=code_block)
colecting_legend_in_project = Python()  # unwired: IN[0]
# ---------- colecting_legend_in_project.python (20 lines) ----------
import clr

clr.AddReference('RevitServices')
import RevitServices
from RevitServices.Persistence import DocumentManager
from RevitServices.Transactions import TransactionManager

clr.AddReference('RevitAPI')
import Autodesk
from Autodesk.Revit.DB import *

a = FilteredElementCollector(DocumentManager.Instance.CurrentDBDocument).OfCategory(BuiltInCategory.OST_Views).ToElements()

b = []

for i in a:
	if i.ViewType.ToString() == 'Legend':
		b.append(i)

OUT = b
# ----------------------------------------
getParameterValueByName_3 = Element.GetParameterValueByName(element=colecting_legend_in_project, parameterName=code_block)
categories_2 = Categories("OST_Schedules")
all_elements_of_category_2 = ElementsOfCategory(Category=categories_2)
getParameterValueByName_4 = Element.GetParameterValueByName(element=all_elements_of_category_2, parameterName=code_block)
list_create = List.Create(item0=getParameterValueByName_2, item1=getParameterValueByName_3, item2=getParameterValueByName_4)
flatten_2 = List.Flatten(list=list_create)
python_script = Python(IN[0]=getParameterValueByName, IN[1]=flatten_2)
# ---------- python_script.python (20 lines) ----------
import clr
clr.AddReference('ProtoGeometry')
from Autodesk.DesignScript.Geometry import *
#The inputs to this node will be stored as a list in the IN variables.
dataEnteringNode = IN

#Assign your output to the OUT variable.
#The inputs to this node will be stored as a list in the IN variables.
Viewcheck= IN[0]
Viewcompare=IN[1]

test=[]

for x in Viewcheck:
	if x in Viewcompare:
		test.append(True)
	else:
		test.append(False)

OUT =test
# ----------------------------------------
filterByBoolMask_2 = List.FilterByBoolMask(list=flatten, mask=python_script)
python_script_2 = Python()  # unwired: IN[0]; starter script, not edited (OUT = 0)

flatten_3 = List.Flatten(list=filterByBoolMask_2.out)
id = Element.Id(element=flatten_3)
code_block_2 = CodeBlock { 1; }
sub = id - code_block_2
select_elements_by_element_id = Python(IN[0]=sub)
# ---------- select_elements_by_element_id.python (20 lines) ----------
import clr

clr.AddReference('RevitServices')
import RevitServices
from RevitServices.Persistence import DocumentManager
from RevitServices.Transactions import TransactionManager
doc = DocumentManager.Instance.CurrentDBDocument

clr.AddReference('RevitAPI')
import Autodesk
from Autodesk.Revit.DB import *

ids = UnwrapElement(IN[0])
output =[]
elements = []
for x in ids:
	elements.append(ElementId(x))
for x in elements:
	output.append(doc.GetElement(x))
OUT = output
# ----------------------------------------
flatten_4 = List.Flatten(list=select_elements_by_element_id)  # frozen
line_patterns = LinePatterns("Dash dot dot")  # graph input
override_the_view_crop_region = Python(IN[0]=flatten_3, IN[1]=flatten_4, IN[2]=line_patterns)  # frozen
# ---------- override_the_view_crop_region.python (43 lines) ----------
import clr
clr.AddReference('ProtoGeometry')
from Autodesk.DesignScript.Geometry import *

clr.AddReference("RevitNodes")
import Revit
clr.ImportExtensions(Revit.Elements)

clr.AddReference('RevitServices')
import RevitServices
from RevitServices.Persistence import DocumentManager
from RevitServices.Transactions import TransactionManager

clr.AddReference('RevitAPI')
import Autodesk
from Autodesk.Revit.DB import *

doc = DocumentManager.Instance.CurrentDBDocument

views = UnwrapElement(IN[0])
elements = UnwrapElement(IN[1])
linepat = UnwrapElement(IN[2])
color = Autodesk.Revit.DB.Color(255,0,0)

output = []
##############################
def overridelinepat(view,element,linepat):
	gSettings = OverrideGraphicSettings()
	gSettings.SetProjectionLinePatternId(linepat.Id)
	gSettings.SetProjectionLineWeight(4)
	gSettings.SetProjectionLineColor(color)
	view.SetElementOverrides(element.Id,gSettings)
	return element
	
##############################
TransactionManager.Instance.EnsureInTransaction(doc)
for v,e in zip(views,elements):
	newe = overridelinepat(v,e,linepat)
	output.append(newe)
TransactionManager.Instance.TransactionTaskDone()

#Assign your output to the OUT variable.
OUT = output
# ----------------------------------------
count = List.Count(list=flatten_4)
ofRepeatedItem = List.OfRepeatedItem(item=line_patterns, amount=count)
categories_3 = Categories("OST_Schedules")
all_elements_of_category_3 = ElementsOfCategory(Category=categories_3)
