# Dynamo graph 2020.04.25-SPOT-GET ELEVATION LEVEL OF FLOOR INSIDE ROOM.DYN "BinhDuong - Get the elevation of the floors inside the room" (Dynamo 2.0.2.6826)

all_elements_in_active_view = ElementsInView()
getCategory = Element.GetCategory(element=all_elements_in_active_view)
string_from_object = FromObject(obj=getCategory)
categories = Categories(index=425)
string_from_object_2 = FromObject(obj=categories)
code_block = CodeBlock(x=string_from_object, roomcategoty=string_from_object_2) { x==roomcategoty; }
filterByBoolMask = List.FilterByBoolMask(list=all_elements_in_active_view, mask=code_block)
code_block_2 = CodeBlock(rooms=filterByBoolMask.in) { rooms; }
code_block_3 = CodeBlock(rooms=code_block_2) { rooms; }
string = StringInput("Number")
categories_2 = Categories(index=208)
string_from_object_3 = FromObject(obj=categories_2)
code_block_4 = CodeBlock(x=string_from_object, floorcategoty=string_from_object_3) { x==floorcategoty; }
filterByBoolMask_2 = List.FilterByBoolMask(list=all_elements_in_active_view, mask=code_block_4)
code_block_5 = CodeBlock(floors=filterByBoolMask_2.in) { floors; }
geometry = Element.Geometry(element=code_block_2)
geometry_2 = Element.Geometry(element=code_block_5)
doesIntersect = Geometry.DoesIntersect(geometry=geometry@L1, other=geometry_2@L1, lacing=CrossProduct)
boolean = BoolSelector(true)
allIndicesOf = List.AllIndicesOf(list=doesIntersect@L2, item=boolean)
getItemAtIndex = List.GetItemAtIndex(list=code_block_5, index=allIndicesOf)
code_block_6 = CodeBlock(floors=getItemAtIndex) { floors; }
string_2 = StringInput("Height Offset From Level")
getParameterValueByName = Element.GetParameterValueByName(element=code_block_6@L2, parameterName=string_2)
count = List.Count(list=getParameterValueByName@L2)
code_block_7 = CodeBlock(x=count) { x>1; }
filterByBoolMask_3 = List.FilterByBoolMask(list=getParameterValueByName, mask=code_block_7)
maximumItem = List.MaximumItem(list=filterByBoolMask_3.in@L2)
watch = Watch(maximumItem)
flatten = List.Flatten(list=filterByBoolMask_3.out)
flatten_2 = List.Flatten(list=flatten)
boolean_2 = BoolSelector(false)
allIndicesOf_2 = List.AllIndicesOf(list=code_block_7@L2, item=boolean_2)
flatten_3 = List.Flatten(list=allIndicesOf_2)
insert = List.Insert(list=maximumItem, element=flatten_2@L1, index=flatten_3)
flatten_4 = List.Flatten(list=insert)
isEmpty = List.IsEmpty(list=flatten)
if_formula = CodeBlock(a=watch, b=flatten_4, x=isEmpty) { choice = [a,b]; choice[x? 0 : 1]; }
watch_2 = Watch(if_formula.out1)
convert_double_to_string = Python(IN[0]=watch_2)
# ---------- convert_double_to_string.python (12 lines) ----------
# Enable Python support and load DesignScript library
import clr
clr.AddReference('ProtoGeometry')
from Autodesk.DesignScript.Geometry import *

# The inputs to this node will be stored as a list in the IN variables.


# Place your code below this line

# Assign your output to the OUT variable.
OUT = [str(int(i)) for i in IN[0]]
# ----------------------------------------
watch_3 = Watch(convert_double_to_string)
setParameterByName = Element.SetParameterByName(element=code_block_3, parameterName=string, value=watch_3)
code_block_8 = CodeBlock { x:int[]; }  # unwired: x
string_from_object_4 = FromObject(obj=code_block_8)
