# Dynamo graph 2020.05.04-LEGEND-PLACING LEGEND BY SHEET NUMBERS.DYN "BinhDuong-LegendPlacerBySheetNumber-2" (Dynamo 2.0.2.6826)

legend_view_name = CodeBlock { "xxxx"; }
get_view_by_name_py = Python(IN[0]=legend_view_name)
# ---------- get_view_by_name_py.python (30 lines) ----------
import clr
# import Document Manager
clr.AddReference("RevitServices")
import RevitServices 
from RevitServices.Persistence import DocumentManager
from RevitServices.Transactions import TransactionManager
doc = DocumentManager.Instance.CurrentDBDocument
uidoc = DocumentManager.Instance.CurrentUIDocument
clr.AddReference("RevitNodes")
import Revit
clr.ImportExtensions(Revit.Elements)
clr.ImportExtensions(Revit.GeometryConversion)
clr.AddReference("RevitAPI")
from Autodesk.Revit.DB import *

dataEnteringNode = IN
vName = IN[0]
foundView = None

coll = FilteredElementCollector(doc)
views = coll.OfClass(View)

for v in views:
	view = UnwrapElement(v)
	if v.Name == vName:
		foundView = v
	
OUT = foundView
	
#For more information refer to RBG Wiki or email me (ctrl + click link): daniel.woodcock@robertbird.com
# ----------------------------------------
views = Views(index=835)  # graph output
categories = Categories(index=447)  # graph input
all_elements_of_category = ElementsOfCategory(Category=categories)
sheetNumber = Sheet.SheetNumber(sheet=all_elements_of_category)
string = StringInput("120")  # graph input
startsWith = String.StartsWith(str=sheetNumber, searchFor=string)
filterByBoolMask = List.FilterByBoolMask(list=all_elements_of_category, mask=startsWith)
watch = Watch(filterByBoolMask.in)

# group: Coordinates
number_slider = DoubleSlider(0, range=0..37377 step 0.001)  # graph input
number_slider_2 = DoubleSlider(0, range=0..14881 step 0.001)  # graph input
byCoordinates = Point.ByCoordinates(x=number_slider, y=number_slider_2)

place_legend_on_sheets_py = Python(IN[0]=views, IN[1]=watch, IN[2]=byCoordinates)
# ---------- place_legend_on_sheets_py.python (40 lines) ----------
import clr
# import Document Manager
clr.AddReference("RevitServices")
import RevitServices 
from RevitServices.Persistence import DocumentManager
from RevitServices.Transactions import TransactionManager
doc = DocumentManager.Instance.CurrentDBDocument
uidoc = DocumentManager.Instance.CurrentUIDocument
clr.AddReference("RevitNodes")
import Revit
clr.ImportExtensions(Revit.Elements)
clr.ImportExtensions(Revit.GeometryConversion)
clr.AddReference("RevitAPI")
from Autodesk.Revit.DB import *

dataEnteringNode = IN

legend = UnwrapElement(IN[0])
sheets = IN[1]
loc = XYZ(IN[2].X, IN[2].Y, IN[2].Z)
viewports = []
failed = []

for vs in sheets:
	sheet = UnwrapElement(vs)
	canAddToSht = Viewport.CanAddViewToSheet(doc, sheet.Id, legend.Id)
	if canAddToSht:
		try:		
			TransactionManager.Instance.EnsureInTransaction(doc)	
			viewport = Viewport.Create(doc, sheet.Id, legend.Id, loc)	
			TransactionManager.Instance.TransactionTaskDone()
			viewports.Add([viewport,sheet])
		except:
			failed.Add(["Failed",sheet])
	else:
		failed.Add(["Failed",sheet])
		
OUT = [viewports, failed]
	
#For more information refer to RBG Wiki or email me (ctrl + click link): daniel.woodcock@robertbird.com
# ----------------------------------------
succeded = CodeBlock(a=place_legend_on_sheets_py) { a[0]; }
watch_2 = Watch(succeded)
firstItem = List.FirstItem(list=watch_2@L2)
code_block = CodeBlock { "Type"; }

# group: collect viewport type
python_script = Python()  # graph input
# ---------- python_script.python (41 lines) ----------
# Copyright(c) 2015, Konrad K Sobon
# @arch_laboratory, http://archi-lab.net

import clr
# Import Element wrapper extension methods
clr.AddReference("RevitNodes")
import Revit
clr.ImportExtensions(Revit.Elements)

# Import DocumentManager and TransactionManager
clr.AddReference("RevitServices")
import RevitServices
from RevitServices.Persistence import DocumentManager
doc = DocumentManager.Instance.CurrentDBDocument

import sys
pyt_path = r'C:\Program Files (x86)\IronPython 2.7\Lib'
sys.path.append(pyt_path)

# Import RevitAPI
clr.AddReference("RevitAPI")
import Autodesk
from Autodesk.Revit.DB import *

#The inputs to this node will be stored as a list in the IN variable.
dataEnteringNode = IN

try:
	errorReport = None
	viewports = FilteredElementCollector(doc).OfCategory(BuiltInCategory.OST_Viewports).WhereElementIsNotElementType().ToElements()
	types = [doc.GetElement(i) for i in viewports[0].GetValidTypes()]
except:
	# if error accurs anywhere in the process catch it
	import traceback
	errorReport = traceback.format_exc()

#Assign your output to the OUT variable
if errorReport == None:
	OUT = types
else:
	OUT = errorReport
# ----------------------------------------
code_block_2 = CodeBlock(viewportType=python_script) { viewportType; }

name = Element.Name(element=code_block_2)
code_block_3 = CodeBlock { "No Title"; }
contains = String.Contains(str=name, searchFor=code_block_3)
filterByBoolMask_2 = List.FilterByBoolMask(list=code_block_2, mask=contains)
count = List.Count(list=firstItem)
cycle = List.Cycle(list=filterByBoolMask_2.in, amount=count)
setParameterByName = Element.SetParameterByName(element=firstItem, parameterName=code_block, value=cycle)
failed = CodeBlock(a=place_legend_on_sheets_py) { a[1]; }
watch_3 = Watch(failed)
firstItem_2 = List.FirstItem(list=firstItem)
parameters = Element.Parameters(element=firstItem_2)
