# Dynamo graph 2020.09.18-DIM-DIMENSION OF ROOMS CLEARANCE.DYN "BinhDuong - Dimension - The clearance of rooms" (Dynamo 2.3.0.5885)

select_model_elements = DSModelElementsSelection()  # 74 picked in the model; frozen

# group: Filter by Category
code_block = CodeBlock(Elements=select_model_elements) { Elements; }
getCategory = Element.GetCategory(element=code_block)
string_from_object = FromObject(obj=getCategory)
categories = Categories("OST_Rooms")
string_from_object_2 = FromObject(obj=categories)
eq = string_from_object == string_from_object_2
filterByBoolMask = List.FilterByBoolMask(list=code_block, mask=eq)

current = Document.Current()
activeView = Document.ActiveView(document=current)
categories_2 = Categories("OST_Rooms")
current_2 = Document.Current()
activeView_2 = Document.ActiveView(document=current_2)
views = Sheet.Views(sheet=activeView_2)
all_elements_of_category_in_view = ElementsOfCategoryInView(Category=categories_2, View=views)
index_of_rooms_in_sheet = IntegerSlider(1, range=0..1 step 1)  # graph input
code_block_2 = CodeBlock(rooms=all_elements_of_category_in_view, n=index_of_rooms_in_sheet) { rooms[n]; }
code_block_3 = CodeBlock(rooms=code_block_2) { rooms; }
code_block_4 = CodeBlock(views=views, n=index_of_rooms_in_sheet) { views[n]; }
code_block_5 = CodeBlock(views=code_block_4) { views; }

# group: DIM
getBoundaries = Python(IN[0]=code_block_3)
# ---------- getBoundaries.python (28 lines) ----------
import clr

clr.AddReference('RevitAPI')
import Autodesk
from Autodesk.Revit.DB import *

#The inputs to this node will be stored as a list in the IN variables.
def toList(input):
	if isinstance(input, list):
		return UnwrapElement(input)
	else:
		return [UnwrapElement(input)]

rooms = toList(IN[0])
output = []

options = SpatialElementBoundaryOptions()
options.SpatialElementBoundaryLocation = SpatialElementBoundaryLocation.Finish
for r in rooms:
	segments = []
	loops = r.GetBoundarySegments(options)
	for loop in loops:
		for segment in loop:
			segments.append(segment)
	output.append(segments)

#Assign your output to the OUT variable.
OUT = output
# ----------------------------------------
groupByDirection = Python(IN[0]=getBoundaries)
# ---------- groupByDirection.python (74 lines) ----------
import clr

clr.AddReference('RevitAPI')
import Autodesk
from Autodesk.Revit.DB import *
def toList(input):
	if isinstance(input, list):
		return UnwrapElement(input)
	else:
		return [UnwrapElement(input)]

def isParallel(v1,v2):
	return v1.CrossProduct(v2).IsAlmostEqualTo(XYZ(0,0,0))  
  
def isCollinear(l0,l1):
	a = l0.GetEndPoint(0)
	b = l0.GetEndPoint(1)
	c = l1.GetEndPoint(0)
	d = l1.GetEndPoint(1)
	return (b-a).CrossProduct(c-a).IsAlmostEqualTo((b-a).CrossProduct(d-a)) and (b-a).CrossProduct(c-a).IsAlmostEqualTo(XYZ(0,0,0))

#The inputs to this node will be stored as a list in the IN variables.
room_segments = toList(IN[0])

sets = []

#group parallel segments together
for rs in room_segments:
	directions = []
	segment_groups = []
	for segment in rs:
		l = segment.GetCurve()
		d = l.GetEndPoint(1)-l.GetEndPoint(0)
		idx = -1
		for i in range(len(directions)):
			if isParallel(d,directions[i]):
				idx = i
				break
		
		if idx!=-1:
			segment_groups[idx].append(segment)
		else:
			directions.append(d)
			new_group = []
			new_group.append(segment)
			segment_groups.append(new_group)
			
	sets.append(segment_groups)
	
	
output = []

#split groups into collinear sets
for rs in sets:
	room_output = []
	for set in rs:
		csets = []
		for s in set:
			for cs in csets:
				if len(cs)>0:
					l0 = s.GetCurve()
					l1=cs[0].GetCurve()
					if isCollinear(l0,l1):
						cs.append(s)
						break
			else:
				new_set = [s]
				csets.append(new_set)
		room_output.append(csets)
	
	output.append(room_output)				

#Assign your output to the OUT variable.
OUT = output
# ----------------------------------------
dimension_customed_by_binh = Python(IN[0]=groupByDirection, IN[1]=code_block_5)
# ---------- dimension_customed_by_binh.python (73 lines) ----------
import clr

clr.AddReference("RevitAPI")
from Autodesk.Revit.DB import *

import Autodesk

clr.AddReference("RevitServices")
import RevitServices
from RevitServices.Transactions import TransactionManager
from RevitServices.Persistence import DocumentManager

def normal_line(s):
	l = s.GetCurve()
	d = l.Direction
	n = XYZ(-d.Y,d.X,0)
	m = l.GetEndPoint(0) + (l.GetEndPoint(1)-l.GetEndPoint(0))/2
	nl = Line.CreateBound(m, m+n)
	return nl

	
def segment_reference(s):

	se = doc.GetElement(s.ElementId)
	#if model line (room separator)
	if isinstance(se, Autodesk.Revit.DB.ModelLine):
		return se.GeometryCurve.Reference
	#if wall
	if isinstance(se,Autodesk.Revit.DB.Wall):
		rExt = HostObjectUtils.GetSideFaces(se,ShellLayerType.Exterior)[0]
		rInt = HostObjectUtils.GetSideFaces(se,ShellLayerType.Interior)[0]
		fExt = doc.GetElement(rExt).GetGeometryObjectFromReference(rExt)
		fInt = doc.GetElement(rInt).GetGeometryObjectFromReference(rInt)
		
		if fExt.Intersect(s.GetCurve())==SetComparisonResult.Overlap or fExt.Intersect(s.GetCurve())==SetComparisonResult.Subset:
			return rExt
		if fInt.Intersect(s.GetCurve())==SetComparisonResult.Overlap or fInt.Intersect(s.GetCurve())==SetComparisonResult.Subset:
			return rInt
		
	return None
	
doc = DocumentManager.Instance.CurrentDBDocument
#The inputs to this node will be stored as a list in the IN variables.
room_sets = UnwrapElement(IN[0]) if isinstance(IN[0],list) else [UnwrapElement(IN[0])]
view = UnwrapElement(IN[1])

dims = []

TransactionManager.Instance.EnsureInTransaction(doc)
for rs in room_sets:
	for dir in rs:
		set_pairs = []
		for s0 in dir:
			for s1 in dir:
				if s0!=s1:
					c = s0[0].GetCurve()
					c.MakeUnbound()
					d = c.Distance(s1[0].GetCurve().GetEndPoint(0))
					set_pairs.append([d,s0[0],s1[0]])
		sorted_by_distance = sorted(set_pairs, key = lambda x:x[0], reverse=True)
		first = sorted_by_distance[0][1]
		second = sorted_by_distance[0][2]
		nl = normal_line(first)
		refArray = ReferenceArray()
		refArray.Append(segment_reference(first))
		refArray.Append(segment_reference(second))
		d = doc.Create.NewDimension(view, nl, refArray)
		dims.append(d)
		
TransactionManager.Instance.TransactionTaskDone()

#Assign your output to the OUT variable.
OUT = dims
# ----------------------------------------

watch = Watch(dimension_customed_by_binh)
boundingBox = Element.BoundingBox(element=code_block_3)
boolean = BoolSelector(false)
clean = List.Clean(list=boundingBox, preserveIndices=boolean)
maxPoint = BoundingBox.MaxPoint(boundingBox=clean@L2)
minPoint = BoundingBox.MinPoint(boundingBox=clean@L2)
x_3_of_room = IntegerSlider(1, range=1..2 step 1)  # graph input
y_3_of_room = IntegerSlider(1, range=1..2 step 1)  # graph input
code_block_6 = CodeBlock(point1=maxPoint, point2=minPoint, a=x_3_of_room, b=y_3_of_room)
# ---------- code_block_6.designscript (6 lines) ----------
num1 = Point.X(point1);
num2 = Point.X(point2);
t1 = (num1 - num2)*a/3 + Point.X(point2);
num3 = Point.Y(point1);
num4 = Point.Y(point2);
t2 = (num3 - num4)*b/3 + Point.Y(point2);
# ----------------------------------------
code_block_7 = CodeBlock { 2; }
ofRepeatedItem = List.OfRepeatedItem(item=code_block_6.t1@L1, amount=code_block_7)
flatten = List.Flatten(list=ofRepeatedItem)
code_block_8 = CodeBlock { 2; }
ofRepeatedItem_2 = List.OfRepeatedItem(item=code_block_6.t2@L1, amount=code_block_8)
flatten_2 = List.Flatten(list=ofRepeatedItem_2)
byCoordinates = Point.ByCoordinates(x=flatten, y=flatten_2)
element_setlocation_customed_by = Python(IN[0]=watch, IN[1]=byCoordinates)  # "Element.SetLocation Customed by Binh"
# ---------- element_setlocation_customed_by.python (57 lines) ----------
#Alban de Chasteigner 2020
#twitter : @geniusloci_bim
#geniusloci.bim@gmail.com
#https://github.com/albandechasteigner/GeniusLociForDynamo

import clr
# Import RevitAPI Classes
clr.AddReference('RevitAPI')
import Autodesk
from Autodesk.Revit.DB import *

clr.AddReference("RevitNodes")
import Revit
clr.ImportExtensions(Revit.GeometryConversion)

clr.AddReference("RevitServices")
import RevitServices
from RevitServices.Persistence import DocumentManager
from RevitServices.Transactions import TransactionManager
doc = DocumentManager.Instance.CurrentDBDocument

elements = UnwrapElement(IN[0]) if isinstance(IN[0],list) else [UnwrapElement(IN[0])]
locations = IN[1] if isinstance(IN[1],list) else [IN[1]]
output2 = []
TransactionManager.Instance.EnsureInTransaction(doc)
for element,location in zip(elements,locations):
	if hasattr(element, "Location"):
		loc = element.Location
		if loc:	
			# point-based elements (e.g. most loadable families)
			if isinstance(loc,LocationPoint):
				loca=loc.Point
			# line-based elements (e.g. walls)
			elif isinstance(loc,LocationCurve):
				loca=loc.Curve.Evaluate(0.5,True)
			elif isinstance(element,Instance):
				loca = element.GetTotalTransform().Origin
			elif hasattr(element, "Origin"):
				loca = element.Origin
			# view specific elements (e.g. filled regions)
			elif hasattr(element, "OwnerViewId") and element.OwnerViewId != ElementId.InvalidElementId :
				view=element.Document.GetElement(element.OwnerViewId)
				box = element.BoundingBox[view]
				loca = (box.Min+box.Max)/2
			# sketch-based elements (e.g. floors)
			else :
				box = element.get_BoundingBox(None)
				loca = (box.Min+box.Max)/2
	elif hasattr(element, "OwnerViewId"):
		view=element.Document.GetElement(element.OwnerViewId)
		box = element.BoundingBox[view]
		loca = (box.Min+box.Max)/2
	ElementTransformUtils.MoveElement(doc,element.Id,location.ToRevitType()-loca)
	output2.append(loca)
TransactionManager.Instance.TransactionTaskDone()

OUT=(elements, output2)
# ----------------------------------------
element_setlocation_original = Python()  # frozen; unwired: IN[0], IN[1]
# ---------- element_setlocation_original.python (56 lines) ----------
#Alban de Chasteigner 2020
#twitter : @geniusloci_bim
#geniusloci.bim@gmail.com
#https://github.com/albandechasteigner/GeniusLociForDynamo

import clr
# Import RevitAPI Classes
clr.AddReference('RevitAPI')
import Autodesk
from Autodesk.Revit.DB import *

clr.AddReference("RevitNodes")
import Revit
clr.ImportExtensions(Revit.GeometryConversion)

clr.AddReference("RevitServices")
import RevitServices
from RevitServices.Persistence import DocumentManager
from RevitServices.Transactions import TransactionManager
doc = DocumentManager.Instance.CurrentDBDocument

elements = UnwrapElement(IN[0]) if isinstance(IN[0],list) else [UnwrapElement(IN[0])]
locations = IN[1] if isinstance(IN[1],list) else [IN[1]]

TransactionManager.Instance.EnsureInTransaction(doc)
for element,location in zip(elements,locations):
	if hasattr(element, "Location"):
		loc = element.Location
		if loc:	
			# point-based elements (e.g. most loadable families)
			if isinstance(loc,LocationPoint):
				loca=loc.Point
			# line-based elements (e.g. walls)
			elif isinstance(loc,LocationCurve):
				loca=loc.Curve.Evaluate(0.5,True)
			elif isinstance(element,Instance):
				loca = element.GetTotalTransform().Origin
			elif hasattr(element, "Origin"):
				loca = element.Origin
			# view specific elements (e.g. filled regions)
			elif hasattr(element, "OwnerViewId") and element.OwnerViewId != ElementId.InvalidElementId :
				view=element.Document.GetElement(element.OwnerViewId)
				box = element.BoundingBox[view]
				loca = (box.Min+box.Max)/2
			# sketch-based elements (e.g. floors)
			else :
				box = element.get_BoundingBox(None)
				loca = (box.Min+box.Max)/2
	elif hasattr(element, "OwnerViewId"):
		view=element.Document.GetElement(element.OwnerViewId)
		box = element.BoundingBox[view]
		loca = (box.Min+box.Max)/2
	ElementTransformUtils.MoveElement(doc,element.Id,location.ToRevitType()-loca)
TransactionManager.Instance.TransactionTaskDone()

OUT=elements
# ----------------------------------------

# group: Testing
location = Room.Location()  # frozen; unwired: room
code_block_9 = CodeBlock { 2; }
ofRepeatedItem_3 = List.OfRepeatedItem(item=location@L1, amount=code_block_9)
flatten_3 = List.Flatten(list=ofRepeatedItem_3)
code_block_10 = CodeBlock(pointx=flatten_3) { Point.X(pointx)+100; Point.Y(pointx)+100; Point.Z(pointx); }

round = Math.Round(number=code_block_6.t2)
round_2 = Math.Round(number=code_block_6.t1)
name = Room.Name(room=code_block_3)
