# Dynamo graph 2021.01.22-VIEWS -FIND ALL VIEWS WHICH ARE OWNER AN 2D ELEMENT.DYN "BinhDuong - Views - Open all views which are owner an 2D elemetn - Ver2" (Dynamo 2.3.0.5885)

categories = Categories("OST_MaterialTags")  # graph input; frozen
all_elements_of_category = ElementsOfCategory(Category=categories)
elementType = Element.ElementType(element=all_elements_of_category)
name = Family.Name(family=elementType)
family_types = FamilyTypes("SJ-Material_Tag:SJ-Material_Tag")  # graph input; frozen
name_2 = Family.Name(family=family_types)
eq = name == name_2
filterByBoolMask = List.FilterByBoolMask(list=all_elements_of_category, mask=eq)
get_views_of_2d_items = Python(IN[0]=filterByBoolMask.in)
# ---------- get_views_of_2d_items.python (29 lines) ----------
# Load the Python Standard and DesignScript Libraries
import sys
import clr
clr.AddReference('ProtoGeometry')
from Autodesk.DesignScript.Geometry import *

# Import required librarires
# Revit API to access the required properties of the Revision Cloud
import clr
clr.AddReference('RevitAPI')
from Autodesk.Revit.DB import*
# RevitServices to access the REvit file content (aka document)
clr.AddReference('RevitServices')
from RevitServices.Persistence import DocumentManager
# Define the doc you want to work with
doc = DocumentManager.Instance.CurrentDBDocument

#The inputs to this node will be stored as a list in the IN variables.
dataEnteringNode = IN

# Get the element ready for Dynamo usage
# From that data retrieve the OwnerViewId
twoitemids = [UnwrapElement(rc).OwnerViewId for rc in IN[0]]

#Get each element's owener ID parameter
ownerviews = [doc.GetElement(id) for id in twoitemids]

#Assign your output to the OUT variable.
OUT = ownerviews
# ----------------------------------------
uniqueItems = List.UniqueItems(list=get_views_of_2d_items)
code_block = CodeBlock(Views=uniqueItems) { Views; }
opening_all_views_selected = Python(IN[0]=code_block)
# ---------- opening_all_views_selected.python (28 lines) ----------
# Load the Python Standard and DesignScript Libraries
import sys
import clr
clr.AddReference('ProtoGeometry')
from Autodesk.DesignScript.Geometry import *

import clr

clr.AddReference("RevitServices")
import RevitServices
from RevitServices.Persistence import DocumentManager
from RevitServices.Transactions import TransactionManager

clr.AddReference("RevitAPI")
import Autodesk
from Autodesk.Revit.DB import *

doc = DocumentManager.Instance.CurrentDBDocument
uidoc = DocumentManager.Instance.CurrentUIDocument

TransactionManager.Instance.EnsureInTransaction(doc)
TransactionManager.Instance.ForceCloseTransaction()

views = UnwrapElement(IN[0])
for view in views:
	uidoc.RequestViewChange(view)
# Assign your output to the OUT variable.
OUT = 0
# ----------------------------------------
categories_2 = Categories("OST_MaterialTags")  # graph input
all_elements_of_category_2 = ElementsOfCategory(Category=categories_2)
elementType_2 = Element.ElementType(element=all_elements_of_category_2)
name_3 = Family.Name(family=elementType_2)
family_types_2 = FamilyTypes("SJ-Material_Tag:SJ-Material_Tag")  # graph input
name_4 = Family.Name(family=family_types_2)
eq_2 = name_3 == name_4
filterByBoolMask_2 = List.FilterByBoolMask(list=all_elements_of_category_2, mask=eq_2)
string = StringInput("Workset")
getParameterValueByName = Element.GetParameterValueByName(element=filterByBoolMask_2.in, parameterName=string)
watch = Watch(getParameterValueByName)
