# Dynamo graph 2021.11.29-PAINT-FIND PAINTING MATERIAL BY FACE FROM WALL.DYN "Get Paint Material face from wall" (Dynamo 2.3.1.11775)

select_model_element = DSModelElementSelection()  # 1 picked in the model
python_script = Python(IN[0]=select_model_element)
# ---------- python_script.python (66 lines) ----------
import clr

#Import the Revit Services
clr.AddReference("RevitServices")
import RevitServices
from RevitServices.Persistence import DocumentManager
from RevitServices.Transactions import TransactionManager

doc = DocumentManager.Instance.CurrentDBDocument

#Import the Revit Nodes
clr.AddReference("RevitNodes")
import Revit
clr.ImportExtensions(Revit.Elements)
clr.ImportExtensions(Revit.GeometryConversion)

#Import the Revit API
clr.AddReference("RevitAPI")
import Autodesk
from Autodesk.Revit.DB import *

def tolist(obj1):
	if hasattr(obj1,"__iter__"):
		return obj1
	else:
		return [obj1]

def ReturnSingleOrList(list):
	if len(list)==1:
		return list[0]
	else:
		return list

#This returns all the Geometries in an element
def GetElementGeometries(element):
	element = UnwrapElement(element)
	result = []
	geometries = element.Geometry[Options()]
	for geometry in geometries:
		result.append(geometry)
	return ReturnSingleOrList(result)

#Define Input (IN)
walls = UnwrapElement(tolist(IN[0]))
output = []

# Start Transaction
TransactionManager.Instance.EnsureInTransaction(doc)

options = Options()
for wall in walls:
	wallMaterials = []
	wallGeometry = GetElementGeometries(wall)
	wallFaces = wallGeometry.Faces
	for face in wallFaces:
		materialId = face.MaterialElementId
		material = doc.GetElement(materialId)
		wallMaterials.append(material)
	output.append(wallMaterials)
	

#End Transaction
TransactionManager.Instance.TransactionTaskDone()

#Define Output (OUT)
OUT = output
# ----------------------------------------
watch = Watch(python_script)
name = Element.Name(element=watch)
