# Dynamo graph 2022.04.24-CAD-FIND ACAD FILES  WHICH ONLY USE FOR CURRENT VIEW.DYN "BinhDuong - Tìm File ACAD link only current View-ver1" (Dynamo 2.0.2.6826)

element_types = ElementTypes(index=160)  # graph input
all_elements_of_type = ElementsOfType(element_type=element_types)
string = StringInput("Find CAD Inserts")  # graph input
boolean = BoolSelector(true)  # graph input
string_2 = StringInput("OK")  # graph input
string_3 = StringInput("CAD Names")  # graph input
code_block = CodeBlock { "Name"; }
getParameterValueByName = Element.GetParameterValueByName(element=all_elements_of_type, parameterName=code_block)
uniqueItems = List.UniqueItems(list=getParameterValueByName)
ui_dropdown_data = Custom[UI.DropDown Data](InputName=string_3, Keys=uniqueItems, Values=uniqueItems)  # Create data for DropDown input in UI.MultiInputForm ++ . Check out www.data-shapes.net for more infos.
boolean_2 = BoolSelector(true)  # graph input
string_4 = StringInput("Cancel")  # graph input
code_block_2 = CodeBlock { 400; }
ui_multipleinputform = Custom[UI.MultipleInputForm ++](Description_optional=string, Logo_optional=boolean, ButtonText_optional=string_2, Inputs=ui_dropdown_data, Toggle=boolean_2, CancelButtonText_optional=string_4, Width_optional=code_block_2)  # Create a form with multiple inputs. see www.data-shapes.net for tutorials and infos!
code_block_3 = CodeBlock { 0; }
getItemAtIndex = List.GetItemAtIndex(list=ui_multipleinputform.User_Inputs, index=code_block_3)
eq = getItemAtIndex == getParameterValueByName
filterByBoolMask = List.FilterByBoolMask(list=all_elements_of_type, mask=eq)
python_script_getownerviewid = Python(IN[0]=filterByBoolMask.in)
# ---------- python_script_getownerviewid.python (37 lines) ----------
import clr
# Import RevitAPI Classes
clr.AddReference('RevitAPI')
from Autodesk.Revit.DB import *
#the above can be changed to import just specific classes separated by a comma

clr.AddReference('ProtoGeometry')
from Autodesk.DesignScript.Geometry import *

clr.AddReference('RevitNodes')
import Revit
# Adds ToDSType (bool) extension method to wrapped elements
clr.ImportExtensions(Revit.Elements)
#adds ToProtoType, ToRevitType geometry conversion extension methods to objects
clr.ImportExtensions(Revit.GeometryConversion)

#import documentmanager and transaction manager
clr.AddReference('RevitServices')
from RevitServices.Transactions import TransactionManager
from RevitServices.Persistence import DocumentManager
# create varible for revit document
doc = DocumentManager.Instance.CurrentDBDocument
elements = UnwrapElement(IN[0])
nams = []

# start transaction
TransactionManager.Instance.EnsureInTransaction(doc)

# code that modifies revit database goes here
for ele in elements:
	nams.append(doc.GetElement(ele.OwnerViewId))
	

#end transaction
TransactionManager.Instance.TransactionTaskDone()

OUT = nams
# ----------------------------------------
parameters = Element.Parameters(element=python_script_getownerviewid)
parameters_2 = Element.Parameters(element=all_elements_of_type)

# group: Group ví dụ về CADLink Type sẽ ít biến hơn ImportInstance
element_types_2 = ElementTypes(index=41)  # graph input
all_elements_of_type_2 = ElementsOfType(element_type=element_types_2)
watch = Watch(all_elements_of_type_2)
name = Element.Name(element=watch)
firstItem = List.FirstItem(list=watch)
parameters_3 = Element.Parameters(element=firstItem)

watch_2 = Watch(filterByBoolMask.in)
watch_3 = Watch(filterByBoolMask.out)
code_block_4 = CodeBlock { "View Name"; }
getParameterValueByName_2 = Element.GetParameterValueByName(element=python_script_getownerviewid, parameterName=code_block_4)
string_from_object = FromObject(obj=getParameterValueByName_2)
watch_4 = Watch(string_from_object)
id = Element.Id(element=python_script_getownerviewid)
string_5 = StringInput("BINH DUONG | VIEW NAME")
flatten = List.Flatten(list=getParameterValueByName_2)
string_from_object_2 = FromObject(obj=flatten)
dialog_result = Python(IN[0]=string_5, IN[1]=string_from_object_2)
# ---------- dialog_result.python (24 lines) ----------
# Enable Python support and load DesignScript library
import clr
clr.AddReference('ProtoGeometry')
from Autodesk.DesignScript.Geometry import *

import clr
clr.AddReference('RevitAPIUI')
from Autodesk.Revit.UI import TaskDialog

# The inputs to this node will be stored as a list in the IN variables.
dataEnteringNode = IN

# Place your code below this line

test = IN[1]
s = '\n'

windowTitle = IN[0]
windowMessage = s.join(test)
messageDialog = TaskDialog


# Assign your output to the OUT variable.
OUT = messageDialog.Show(windowTitle, windowMessage)
# ----------------------------------------
watch_5 = Watch(dialog_result)
