# Dynamo graph 2022.05.05-SPOT-SPOT ELEVATION AT FLOOR CENTERS_UPDATED.DYN "191119 - Spot Elevation at Floor Centers_Updated" (Dynamo 2.3.0.5885)

views = Views("03 - Floor")  # graph input
select_model_elements = DSModelElementsSelection()  # 1 picked in the model; graph input
geometry = Element.Geometry(element=select_model_elements)
flatten = List.Flatten(list=geometry)
explode = Geometry.Explode(geometry=flatten)
code_block = CodeBlock { 0.5; }
normalAtParameter = Surface.NormalAtParameter(surface=explode, u=code_block, v=code_block)
ZAxis = Vector.ZAxis()
isParallel = Vector.IsParallel(vector=normalAtParameter, other=ZAxis)
filterByBoolMask = List.FilterByBoolMask(list=explode, mask=isParallel)
code_block_2 = CodeBlock { 0.5; }
pointAtParameter = Surface.PointAtParameter(surface=filterByBoolMask.in, u=code_block_2, v=code_block_2)
firstItem = List.FirstItem(list=pointAtParameter@@L2)
firstItem_2 = List.FirstItem(list=filterByBoolMask.in@@L2)
byFloorLevel = Python(IN[0]=views, IN[1]=select_model_elements, IN[2]=firstItem, IN[3]=firstItem_2)  # "SpotElevation.ByFloorLevel"
# ---------- byFloorLevel.python (62 lines) ----------
# Enable Python support and load DesignScript library
import clr
clr.AddReference('ProtoGeometry')
from Autodesk.DesignScript.Geometry import *

clr.AddReference('RevitAPI')
from Autodesk.Revit.DB import *
from Autodesk.Revit.DB.Structure import *

clr.AddReference('RevitAPIUI')
from Autodesk.Revit.UI import *

clr.AddReference('System')
from System.Collections.Generic import List

clr.AddReference('RevitNodes')
import Revit
clr.ImportExtensions(Revit.GeometryConversion)
clr.ImportExtensions(Revit.Elements)

clr.AddReference('RevitServices')
import RevitServices
from RevitServices.Persistence import DocumentManager
from RevitServices.Transactions import TransactionManager

doc = DocumentManager.Instance.CurrentDBDocument
uidoc=DocumentManager.Instance.CurrentUIApplication.ActiveUIDocument

#Preparing input from dynamo to revit
View = UnwrapElement(IN[0])
element = UnwrapElement(IN[1])
pts = UnwrapElement(IN[2])

#Get Faces From Floors
faceArr = []
for e in element:
	op = Options()
	op.ComputeReferences = True
	geo = e.get_Geometry(op)
	for g in geo:
		face = g.Faces
	
	faceArr.append(face)

#Do some action in a Transaction
TransactionManager.Instance.EnsureInTransaction(doc)
#Create New Spot Elevation
surfaces = []
for f,p in zip(faceArr,pts):
	srfs = f[0].Reference
	pt = p.ToXyz()
	#for sf in f:
	if srfs != None:
		try:
			se = doc.Create.NewSpotElevation(View, srfs, pt, pt, pt ,pt, False)
		except:
			se = False		
	surfaces.append(se)

TransactionManager.Instance.TransactionTaskDone()

OUT = surfaces
# ----------------------------------------
watch = Watch()  # unwired: arg0
