# Dynamo graph 2022.07.30-VIEWTEMPLATE-PURGE UNUSED VIEW_TEMPLATE.DYN "BinhDuong - Unused View Templates - V2" (Dynamo 2.12.1.8246)

categories = Categories("OST_Views")
all_elements_of_category = ElementsOfCategory(Category=categories)
boolean = BoolSelector(false)
clean = List.Clean(list=all_elements_of_category, preserveIndices=boolean)
watch = Watch(clean)
clean_2 = List.Clean(list=watch, preserveIndices=boolean)
watch_2 = Watch(clean_2)
isViewTemplate = View.IsViewTemplate(view=watch_2)
filterByBoolMask = List.FilterByBoolMask(list=watch_2, mask=isViewTemplate)
watch_3 = Watch(filterByBoolMask.in)
code_block = CodeBlock { "View Template"; }
getParameterValueByName = Element.GetParameterValueByName(element=filterByBoolMask.out, parameterName=code_block)
setDifference = List.SetDifference(list1=watch_3, list2=getParameterValueByName)
watch_4 = Watch(setDifference)
