# Dynamo graph 2023.03.15-A-VIEW-CREATE ELEVATION BY SELECTED ROOM.DYN "ORI_R2023_CREATE-ELEVATIONS-BY-SELECTED-ROOMS" (Dynamo 2.13.1.3887)
# author: Revit Dynamo | Andrey Kim
# Dynamo script: Create Elevations by Rooms, apply View Templates and Place on Sheets
# packages: Rhythm 2022.7.2, archi-lab.net 2023.213.1523

# group: Get Rooms
select_model_elements_by = DSModelElementsByCategorySelection("OST_Rooms")  # "Select Model Elements By Category"; 10 picked in the model; graph input
# note: Custom Node: Rhythmv.2022.7.2
ʳʰʸᵗʰᵐ_rooms_centerroom = Rhythm.Revit.Elements.Rooms.CenterRoom(room=select_model_elements_by)

# group: Get Room Name and Number
name = Room.Name(room=ʳʰʸᵗʰᵐ_rooms_centerroom)
number = Room.Number(room=ʳʰʸᵗʰᵐ_rooms_centerroom)
code_block = CodeBlock(a=number, b=name) { " - " + a + " - " + b; }

# group: Create Elevations
location = Room.Location(room=ʳʰʸᵗʰᵐ_rooms_centerroom)
code_block_2 = CodeBlock { 96; }
# note: Custom Node: Rhythmv.2022.7.2
viewFamilyTypes = ViewFamilyTypes("Building Elevation")  # graph input
ʳʰʸᵗʰᵐ_elevationmarker = Rhythm.Revit.Elements.ElevationMarker.CreateElevationMarker(location=location, scaleFactor=code_block_2, viewFamilyType=viewFamilyTypes)
current = Document.Current()
activeView = Document.ActiveView(document=current)
code_block_3 = CodeBlock { 0..3; }
ʳʰʸᵗʰᵐ_elevationmarker_2 = Rhythm.Revit.Elements.ElevationMarker.CreateElevationByMarkerIndex(elevationMarker=ʳʰʸᵗʰᵐ_elevationmarker, planView=activeView, index=code_block_3)

# group: Build New Elevation Name
code_block_4 = CodeBlock { 1..4; "a".."d"; }
string_from_object = FromObject(object=code_block_4.out0)
byKeysValues = DesignScript.Builtin.Dictionary.ByKeysValues(keys=code_block_4.out1, values=string_from_object)
name_2 = Element.Name(element=ʳʰʸᵗʰᵐ_elevationmarker_2)
length = String.Length(string=name_2)
code_block_5 = CodeBlock(a=length) { a-1; 0; }
remove = String.Remove(string=name_2, startIndex=code_block_5.out1, count=code_block_5.out0)
valueAtKey = DesignScript.Builtin.Dictionary.ValueAtKey(dictionary=byKeysValues, key=remove)
add = valueAtKey + code_block

# group: Set Elevation Name
code_block_6 = CodeBlock { "View Name"; }
setParameterByName = Element.SetParameterByName(element=ʳʰʸᵗʰᵐ_elevationmarker_2, parameterName=code_block_6, value=add)

# group: Set View Template
# note: Custom Node: archilab
view_templates = ViewTemplatesUi("Architectural Elevation")  # graph input
setViewTemplate = archilab.Revit.Views.Views.SetViewTemplate(view=setParameterByName, viewTemplate=view_templates)

# group: CREATE SHEETS AND PLACE ELEVATION VIEWS
titleblock_types = TagTypes("A1 metric:A1 metric")  # graph input
byCoordinates = Point.ByCoordinates()
count = List.Count(list=setViewTemplate@L2)
ofRepeatedItem = List.OfRepeatedItem(item=byCoordinates, amount=count)
byNameNumberTitleBlockViewsAndLocations = Sheet.ByNameNumberTitleBlockViewsAndLocations(sheetName=name, sheetNumber=number, titleBlockFamilyType=titleblock_types, views=setViewTemplate, locations=ofRepeatedItem)
