# Dynamo graph 2023.03.15-B-VIEW-DELETE UNUSED VIEWS-V2.DYN "ORI_R2023_DELETE SELECTED UNPLACED VIEWS" (Dynamo 2.13.1.3887)
# packages: Genius Loci 2022.6.16, Crumple 2022.5.27, archi-lab.net 2023.213.1523, Clockwork for Dynamo 2.x 2.4.0, Data-Shapes 2022.2.103

# group: Get All Views, Schedules, Legends
# note: Custom Node: GeniusLociv.2022.6.16
collector_of_views = Custom[Collector of Views]()  # package Genius Loci; Collects all views in the active or given document.

# group: Filter by Dependancy
# note: Custom Node: Crumplev.2022.5.27
views_dependents = Custom[© Views.Dependents](views=collector_of_views.Without_Sheet_All_Views)  # package Crumple; For a view, returns any dependent views it has as well as whether it has any.
filterByBoolMask = List.FilterByBoolMask(list=collector_of_views.Without_Sheet_All_Views, mask=views_dependents.hasDependents)

# group: Get All Primary Views with Unplaced Dependant Views
# note: Custom Node: archilab
isOnSheet = archilab.Revit.Views.Views.IsOnSheet(view=filterByBoolMask.in)
filterByBoolMask_2 = List.FilterByBoolMask(list=filterByBoolMask.in, mask=isOnSheet)
# note: Custom Node: Crumplev.2022.5.27
views_dependents_2 = Custom[© Views.Dependents](views=filterByBoolMask_2.out)
isOnSheet_2 = archilab.Revit.Views.Views.IsOnSheet(view=views_dependents_2.dependentViews)
anyTrue = List.AnyTrue(list=isOnSheet_2, lacing=Longest)
filterByBoolMask_3 = List.FilterByBoolMask(list=filterByBoolMask_2.out, mask=anyTrue)

# group: Get All Independent Unplaced Views
# note: Custom Node: archilab
isOnSheet_3 = archilab.Revit.Views.Views.IsOnSheet(view=filterByBoolMask.out)
filterByBoolMask_4 = List.FilterByBoolMask(list=filterByBoolMask.out, mask=isOnSheet_3)

# group: Group By View Type
list_create = List.Create(item0=filterByBoolMask_3.out, item1=filterByBoolMask_4.out)
flatten = List.Flatten(list=list_create)
# note: Custom Node: Clockwork
type = Custom[View.Type](view=flatten)  # package Clockwork for Dynamo 2.x; Returns the type of a given view
groupByKey = List.GroupByKey(list=flatten, keys=type)

# group: Tree View Input
code_block = CodeBlock { "List of Unplaced Views"; }
addItemToFront = List.AddItemToFront(item=groupByKey.uniqueKeys@L1, list=groupByKey.groups@L2)
boolean = BoolSelector(true)
code_block_2 = CodeBlock { 350; }
# note: Custom Node: Data-Shapesv.2022.2.103
treeview_input = Custom[TreeView input](InputName=code_block, Data=addItemToFront, FirstItemIsTitle=boolean, Height=code_block_2)  # package Data-Shapes; Create a TreeView input for UI.MultipleInputForm ++ . Check out www.data-shapes.net for more infos and tips!

# group: Main UI Window
code_block_3 = CodeBlock { "Delete Views"; "Cancel"; 500; 200; }
boolean_2 = BoolSelector(true)
# note: Custom Node: Data-Shapesv.2022.2.103
multipleinputform = Custom[MultipleInputForm ++](ButtonText_optional=code_block_3.out0, Inputs=treeview_input, Toggle=boolean_2, CancelButtonText_optional=code_block_3.out1, Width_optional=code_block_3.out2, LabelWidth_optional=code_block_3.out3)  # package Data-Shapes; Create a form with multiple inputs. see www.data-shapes.net for tutorials and infos!

# group: Delete Selected Views
# note: Custom Node: archilab
delete = archilab.Revit.Elements.Elements.Delete(element=multipleinputform.User_Inputs)
