# Dynamo graph 2023.03.15-CHANGE TITLEBLOCKS ON SPECIFIED SHEETS.DYN "ORI_R2023_CHANGE TITLEBLOCKS ON SPECIFIED SHEETS" (Dynamo 2.13.1.3887)
# packages: Data-Shapes 2022.2.103, Clockwork for Dynamo 2.x 2.4.0

# group: 1. Get All Title Blocks in the Project
categories = Categories("OST_TitleBlocks")
# note: Custom Node: Clockwork
all_family_types_of_category = Custom[All Family Types Of Category](category=categories)  # package Clockwork for Dynamo 2.x; Gets all family types/symbols of a given category in the model.

# group: 2. Title Blocks Families UI Data
code_block = CodeBlock { "TitleBlock Types"; }
name = Element.Name(element=all_family_types_of_category)
# note: Custom Node: Data-Shapesv.2022.2.103
dropdown_data = Custom[DropDown Data](InputName=code_block, Keys=name, Values=all_family_types_of_category)  # package Data-Shapes; Create data for DropDown input in UI.MultiInputForm ++ . Check out www.data-shapes.net for more infos.

# group: 3. Get All Sheets in the Project
categories_2 = Categories("OST_Sheets")
all_elements_of_category = ElementsOfCategory(Category=categories_2)

# group: 4. Sheets Title Blocks UI Data
code_block_2 = CodeBlock { "List of Sheets"; 500; }
sheetNumber = Sheet.SheetNumber(sheet=all_elements_of_category)
sheetName = Sheet.SheetName(sheet=all_elements_of_category)
titleBlock = Sheet.TitleBlock(sheet=all_elements_of_category)
flatten = List.Flatten(list=titleBlock)
code_block_3 = CodeBlock(a=sheetNumber, b=sheetName, c=flatten) { a + " - " + b + " - " + c; }
boolean = BoolSelector(false)
# note: Custom Node: Data-Shapesv.2022.2.103
listview_data = Custom[Listview Data](InputName=code_block_2.out0, Keys=code_block_3, Values=flatten, Height_optionnal=code_block_2.out1, ShowId_optionnal=boolean)  # package Data-Shapes; Create data for ListView input in UI.MultiInputForm ++ . Check out www.data-shapes.net for more infos.

# group: 5. Main UI Window
code_block_4 = CodeBlock { "Select Sheets with Titleblock to be Replaced"; "Replace TitleBlock"; "Cancel"; 800; }
list_create = List.Create(item0=dropdown_data, item1=listview_data)
boolean_2 = BoolSelector(true)
# note: Custom Node: Data-Shapesv.2022.2.103
multipleinputform = Custom[MultipleInputForm ++](Description_optional=code_block_4.out0, ButtonText_optional=code_block_4.out1, Inputs=list_create, Toggle=boolean_2, CancelButtonText_optional=code_block_4.out2, Width_optional=code_block_4.out3)  # package Data-Shapes; Create a form with multiple inputs. see www.data-shapes.net for tutorials and infos!

# group: 6. Change Title Block
code_block_5 = CodeBlock(x=multipleinputform.User_Inputs) { x[0]; x[1]; }
code_block_6 = CodeBlock { "Type"; }
setParameterByName = Element.SetParameterByName(element=code_block_5.out1, parameterName=code_block_6, value=code_block_5.out0)
