# Dynamo graph 2023.03.15-REVISION-LOCATE AND DELETE REVISION.DYN "ORI_R2023_LOCATE AND DELETE REVISION CLOUDS" (Dynamo 2.13.1.3887)
# packages: Rhythm 2022.7.2, archi-lab.net 2023.213.1523, Data-Shapes 2022.2.103

# group: 7. Create Text Note UI Input
code_block = CodeBlock { "Select View or Sheets from which you want to remove Revision Clouds"; }
# note: Custom Node: Data-Shapesv.2022.2.103
textnote_data = Custom[TextNote Data](TextNote=code_block)  # package Data-Shapes; Create Data for TextNote input in UI.MultipleInputForm ++ . Check out www.data-shapes.net for more informations

# group: 1. Get All Revision in the Project
element_classes = ElementTypes("Revision")
all_elements_of_class = ElementsOfType(element_class=element_classes)

# group: 2. Create Drop-Down UI Input
code_block_2 = CodeBlock { "Revisions List"; }
name = Element.Name(element=all_elements_of_class)
# note: Custom Node: Data-Shapesv.2022.2.103
dropdown_data = Custom[DropDown Data](InputName=code_block_2, Keys=name, Values=all_elements_of_class)  # package Data-Shapes; Create data for DropDown input in UI.MultiInputForm ++ . Check out www.data-shapes.net for more infos.

# group: 3. Create Revisions UI Window Form
code_block_3 = CodeBlock { "Select Revision"; "Select"; }
boolean = BoolSelector(true)
# note: Custom Node: Data-Shapesv.2022.2.103
multipleinputform = Custom[MultipleInputForm ++](Description_optional=code_block_3.out0, ButtonText_optional=code_block_3.out1, Inputs=dropdown_data, Toggle=boolean)  # package Data-Shapes; Create a form with multiple inputs. see www.data-shapes.net for tutorials and infos!

# group: 4. Get All Revision Clouds of Selected Revision
categories = Categories("OST_RevisionClouds")
# note: Custom Node: Rhythmv.2022.7.2
ʳʰʸᵗʰᵐ_elements = Rhythm.Revit.Elements.Elements.DependentElementsOfCategory(element=multipleinputform.User_Inputs, category=categories)
flatten = List.Flatten(list=ʳʰʸᵗʰᵐ_elements)

# group: 5. Get View or Sheet name of each Revision Cloud
# note: Custom Node: archilab
ownerView = archilab.Revit.Elements.Elements.OwnerView(element=flatten)
viewType = archilab.Revit.Views.Views.ViewType(view=ownerView)
name_2 = Element.Name(element=ownerView)
code_block_4 = CodeBlock(a=viewType, b=name_2) { a + " - " + b; }

# group: 6. Create Views and Sheets UI List Input
# note: Custom Node: Data-Shapesv.2022.2.103
listview_data = Custom[Listview Data](Keys=code_block_4, Values=flatten)  # package Data-Shapes; Create data for ListView input in UI.MultiInputForm ++ . Check out www.data-shapes.net for more infos.

# group: 8. Create Views and Sheets UI Window Form
code_block_5 = CodeBlock { "Delete Revision Clouds"; "Delete"; "Cancel"; 550; 250; }
list_create = List.Create(item0=textnote_data, item1=listview_data)
boolean_2 = BoolSelector(true)
# note: Custom Node: Data-Shapesv.2022.2.103
multipleinputform_2 = Custom[MultipleInputForm ++](Description_optional=code_block_5.out0, ButtonText_optional=code_block_5.out1, Inputs=list_create, Toggle=boolean_2, CancelButtonText_optional=code_block_5.out2, Width_optional=code_block_5.out3, LabelWidth_optional=code_block_5.out4)

# group: 9. Delete Selected Revision Clouds
# note: Custom Node: archilab
delete = archilab.Revit.Elements.Elements.Delete(element=multipleinputform_2.User_Inputs)
