# Dynamo graph 2023.05.19-DIMENSION-CHECK THE VALUE OVERRIDE OF DIMENSIONS.DYN "01BinhDuong - Check the value override of Dimensions" (Dynamo 2.12.1.8246)
# packages: Rhythm 2022.11.2

clean_the_override = BoolSelector(true)  # graph input
select_model_elements = DSModelElementsSelection()  # 24 picked in the model; graph input
getCategory = Element.GetCategory(element=select_model_elements)
string_from_object = FromObject(object=getCategory)
categories = Categories("OST_Dimensions")
string_from_object_2 = FromObject(object=categories)
boolean = BoolSelector(true)
contains = String.Contains(string=string_from_object, searchFor=string_from_object_2, ignoreCase=boolean)
filterByBoolMask = List.FilterByBoolMask(list=select_model_elements, mask=contains)
watch = Watch(filterByBoolMask.in)
ʳʰʸᵗʰᵐ_dimensions_isoverriden = Rhythm.Revit.Elements.Dimensions.IsOverriden(dimension=watch)
filterByBoolMask_2 = List.FilterByBoolMask(list=watch, mask=ʳʰʸᵗʰᵐ_dimensions_isoverriden)
color_to_highlight = ColorPalette({R: 255, G: 99, B: 71, A: 255})
code_block = CodeBlock { 0; }
boolean_2 = BoolSelector(false)
byProperties = Revit.Filter.OverrideGraphicSettings.ByProperties(projectionFillColor=color_to_highlight, projectionLineColor=color_to_highlight, transparency=code_block, halftone=boolean_2)
overrideInView = Element.OverrideInView(element=filterByBoolMask_2.in, overrides=byProperties)
code_block_2 = CodeBlock { ""; }
if_ = RefactoredIf(test=clean_the_override, true=overrideInView, false=code_block_2)
watch_2 = Watch(if_)
code_block_3 = CodeBlock { ""; }
setValueOverride = Dimension.SetValueOverride(dimension=watch_2, values=code_block_3)
byProperties_2 = Revit.Filter.OverrideGraphicSettings.ByProperties()
overrideInView_2 = Element.OverrideInView(element=watch_2, overrides=byProperties_2)
