# Dynamo graph 2023.07.18-A-FAMILY-MODEL IN_PLACE CONVERT INTO LOADABLE FAMILY-V2.DYN "Binh DUONG - Model In-place Convert into Loadable Family" (Dynamo 2.12.1.8246)
# packages: Synthesize toolkit 12.7.5, Clockwork for Dynamo 2.x 2.4.0

# group: Input
select_model_element = DSModelElementSelection()  # 1 picked in the model; graph input

# group: Element Geometry
code_block = CodeBlock(element=select_model_element) { element; }
create = List.Create(item0=code_block)
flatten = List.Flatten(list=create)
code_block_2 = CodeBlock { detailLevel: string = "Medium"; }
code_block_3 = CodeBlock { includeInvisibleObjects: bool = false; }
code_block_4 = CodeBlock { view: Revit.Elements.Views.View = null; }
boolean = BoolSelector(true)  # graph input
inserts = Custom[Element.Inserts](element=flatten, includeOpenings=boolean, includeShadows=boolean, includeEmbeddedWalls=boolean, includeSharedEmbeddedInserts=boolean)  # package Clockwork for Dynamo 2.x; Gets all the objects inserted into a given element.
code_block_5 = CodeBlock { returnGeometryWithoutInserts: bool = false; }
python_script = Python(IN[0]=flatten, IN[1]=code_block_2, IN[2]=code_block_3, IN[3]=code_block_4, IN[4]=inserts, IN[5]=code_block_5)  # IronPython2
# ---------- python_script.python (87 lines) ----------
import clr
clr.AddReference('RevitAPI')
from Autodesk.Revit.DB import *

clr.AddReference("RevitNodes")
import Revit
clr.ImportExtensions(Revit.Elements)
clr.ImportExtensions(Revit.GeometryConversion)

clr.AddReference("RevitServices")
import RevitServices
from RevitServices.Persistence import DocumentManager
from RevitServices.Transactions import TransactionManager

# this function takes care of exploding 
# GeometryInstance objects. GI objects typically
# represent family instance geometry.
# in order to also catch possible nested families
# the fucntion calls itself recursively.
def convert_geometry_instance(geo, elementlist):
	for g in geo:
		if str(g.GetType()) == 'Autodesk.Revit.DB.GeometryInstance':
			elementlist = convert_geometry_instance(g.GetInstanceGeometry(), elementlist)
		else:
			try: 
				if g.Volume != 0:
					elementlist.append(g)
			except:
				pass
	return elementlist

doc = DocumentManager.Instance.CurrentDBDocument
items = UnwrapElement(IN[0])
if IN[1] == "Coarse": detail_lvl = ViewDetailLevel.Coarse
elif IN[1] == "Fine": detail_lvl = ViewDetailLevel.Fine
else: detail_lvl = ViewDetailLevel.Medium
inc_invis = IN[2]
view = UnwrapElement(IN[3])
inserts = UnwrapElement(IN[4])
remove_inserts = IN[5]
revitlist = list()
dynlist = list()
catlist = list()
# we might need a transaction in order to 
# temporarily delete all inserts and retrieve gross wall areas
TransactionManager.Instance.EnsureInTransaction(doc)
trans = SubTransaction(doc)
trans.Start()
i = 0
for item in items:
	if remove_inserts == True:
		for insert in inserts[i]:
			doc.Delete(insert.Id)
		doc.Regenerate()
	geo_options = Options()
	if view == None: geo_options.DetailLevel = detail_lvl
	geo_options.IncludeNonVisibleObjects = inc_invis
	if view != None: geo_options.View = view
	revitGeo = item.Geometry[geo_options]
	try:		
		revit_geos = convert_geometry_instance(revitGeo, list())
		revitlist.append(revit_geos)
		dyn_geos = list()
		cats = list()
		for geo in revit_geos:
			try:
				dyn_geos.append(geo.ToProtoType())
			except:
				dyn_geos.append(None)
			try:
				graphstyle = doc.GetElement(geo.GraphicsStyleId)
				if graphstyle != None:
					cats.append(Revit.Elements.Category.ById(graphstyle.GraphicsStyleCategory.Id.IntegerValue))
				else:
					cats.append(None)
			except:
				cats.append(None)
		dynlist.append(dyn_geos)
		catlist.append(cats)		
	except:
		revitlist.append(list())
		dynlist.append(list())
		catlist.append(list())
	i += 1
trans.RollBack()
TransactionManager.Instance.TransactionTaskDone()
OUT = (dynlist,revitlist,catlist)
# ----------------------------------------
code_block_6 = CodeBlock(seq=python_script) { seq[0]; seq[1]; seq[2]; }
returnListOrSingleValue = Custom[ReturnListOrSingleValue](unknownItem=code_block, seq=code_block_6.out0)  # package Clockwork for Dynamo 2.x; If the unknown item is not a list but rather a single item, only the first item of the list (input "seq") will be returned.
code_block_7 = CodeBlock(dynamoGeometry=returnListOrSingleValue) { dynamoGeometry; }
returnListOrSingleValue_2 = Custom[ReturnListOrSingleValue](unknownItem=code_block, seq=code_block_6.out1)
code_block_8 = CodeBlock(revitGeometry=returnListOrSingleValue_2) { revitGeometry; }
returnListOrSingleValue_3 = Custom[ReturnListOrSingleValue](unknownItem=code_block, seq=code_block_6.out2)
code_block_9 = CodeBlock(subCategory=returnListOrSingleValue_3) { subCategory; }

# group: Input
family_name = StringInput("Dynamo Family")  # graph input
categories = Categories("OST_Furniture")  # graph input
file_path = Filename("..\..\..\ProgramData\Autodesk\RVT 2022\Family Templates\English\Metric Generic Model.rft")  # graph input
string_from_object = FromObject(object=file_path)

# group: Family Insert
code_block_10 = CodeBlock(VARGeometryorSAT=code_block_7) { VARGeometryorSAT: var[]..[]; }
code_block_11 = CodeBlock { VAROverwriteParams: bool = false; }
code_block_12 = CodeBlock { VAROneFamily: bool = true; }
code_block_13 = CodeBlock { VARAvoidConfilct: bool = true; }
code_block_14 = CodeBlock { VARDynamoProcessSAT: bool = false; }
code_block_15 = CodeBlock { VARJoinAdjacentSurfacesForcesDynamoProcessSAT: bool = false; }
code_block_16 = CodeBlock { VARJoinAdjacentSolidsForcesDynamoProcessSAT: bool = false; }
code_block_17 = CodeBlock(VARFamilyName=family_name) { VARFamilyName; }
code_block_18 = CodeBlock { VARFamilyNumber: int = 1; }
code_block_19 = CodeBlock(VARFamilyCategory=categories) { VARFamilyCategory; x = Revit.Elements.Category.ByName("OST_GenericModel"); }
code_block_20 = CodeBlock { VARFamilyTemplatePath: var = null; }
isNull = Object.IsNull(object=code_block_20)
scopeIf = Custom[CW.ScopeIf+](VARtest=isNull, VARtrue=string_from_object, VARfalse=code_block_20)  # package Synthesize toolkit; A (hopefully) more robust implementation of ScopeIf. Tests a single boolean and returns a value accordingly.
smart_rft_path = Custom[Smart RFT Path](VARRFTFile=scopeIf, VARCategory=code_block_19.VARFamilyCategory)  # package Synthesize toolkit; Smart RFT Path
code_block_21 = CodeBlock { VARIsShared: bool = false; }
code_block_22 = CodeBlock { VARIsWorkplane: bool = false; }
code_block_23 = CodeBlock { VARIsAlwaysVertical: bool = false; }
code_block_24 = CodeBlock { VARToVoid: bool = false; }
code_block_25 = CodeBlock { VARMaterialName: string = ""; }
code_block_26 = CodeBlock { VARIsOneMaterial: bool = true; }
code_block_27 = CodeBlock { VARIsMaterialInstance: bool = true; }
code_block_28 = CodeBlock { VARMaterialParameter: string = "Material"; }
code_block_29 = CodeBlock { VARSubcategory: string = ""; }
code_block_30 = CodeBlock { VARSubcategoryMaterial: string = ""; }
code_block_31 = CodeBlock { VARSelfOrigin: bool = true; }
code_block_32 = CodeBlock { VARNamingSeparator: string = " "; }
code_block_33 = CodeBlock { VARDoubleFamiliesInProjectOnly: bool = false; }
code_block_34 = CodeBlock { VARAutoAlternative: bool = true; }
code_block_35 = CodeBlock { VARRecommendedSettings: bool = true; }
code_block_36 = CodeBlock { VARShowMessages: bool = false; }
code_block_37 = CodeBlock { VARDocumentImportMethod: bool = false; }
code_block_38 = CodeBlock { VARImportInstanceInstead: bool = false; }
code_block_39 = CodeBlock { VARByPassGeometryCheck: bool = false; }
python_script_2 = Python(IN[0]=code_block_10, IN[1]=code_block_11, IN[2]=code_block_12, IN[3]=code_block_13, IN[4]=code_block_14, IN[5]=code_block_15, IN[6]=code_block_16, IN[7]=code_block_17, IN[8]=code_block_18, IN[9]=code_block_19.VARFamilyCategory, IN[10]=smart_rft_path, IN[11]=code_block_21, IN[12]=code_block_22, IN[13]=code_block_23, IN[14]=code_block_24, IN[15]=code_block_24, IN[16]=code_block_25, IN[17]=code_block_26, IN[18]=code_block_27, IN[19]=code_block_28, IN[20]=code_block_29, IN[21]=code_block_30, IN[22]=code_block_31, IN[23]=code_block_32, IN[24]=code_block_33, IN[25]=code_block_34, IN[26]=code_block_35, IN[27]=code_block_36, IN[28]=code_block_37, IN[29]=code_block_38, IN[30]=code_block_39)  # IronPython2
# ---------- python_script_2.python (2243 lines) ----------
# Created By Karam Baki, karam@aecedx.com

import clr
import System

pf_path = System.Environment.GetFolderPath(System.Environment.SpecialFolder.ProgramFilesX86)
import sys
sys.path.append('%s\IronPython 2.7\Lib' %pf_path)
import traceback
import random
import string
import re

clr.AddReference('ProtoGeometry')
from Autodesk.DesignScript import Geometry as dg

clr.AddReference('RevitServices')
import RevitServices
from RevitServices.Persistence import DocumentManager
from RevitServices.Transactions import TransactionManager

clr.AddReference('RevitAPI')
from Autodesk.Revit.DB import *
from Autodesk.Revit.DB.Structure import StructuralType

clr.AddReference('RevitNodes')
import Revit
clr.ImportExtensions(Revit.Elements)
clr.ImportExtensions(Revit.GeometryConversion)

clr.AddReference('DynamoRevitDS')
import Dynamo

clr.AddReference("RevitAPIUI")
from Autodesk.Revit.UI import TaskDialog

clr.AddReference("System")
from System import Array

import math

if int(DocumentManager.Instance.CurrentUIApplication.Application.VersionNumber) < 2022:
	allSpecsNames = []
else:
	allSpecs = SpecUtils.GetAllSpecs()
	allSpecsNames = []
	for spec in allSpecs:
		allSpecsNames.append(LabelUtils.GetLabelForSpec(spec))

def getSpec(specName):
	indexOf = allSpecsNames.IndexOf(specName)
	if indexOf != -1:
		return allSpecs[indexOf]
	return None

# Family Load Options Class
class FamOpt1(IFamilyLoadOptions):
	def __init__(self):
		pass
	def OnFamilyFound(self,familyInUse, overwriteParameterValues):
		overwriteParameterValues.Value = True
		return True
	def OnSharedFamilyFound(self,familyInUse, source, overwriteParameterValues):
		overwriteParameterValues.Value = True
		return True

# Family Load Options Class - Without Overwriting Parameters
class FamOptWithout(IFamilyLoadOptions):
	def __init__(self):
		pass
	def OnFamilyFound(self,familyInUse, overwriteParameterValues):
		overwriteParameterValues.Value = False
		return True
	def OnSharedFamilyFound(self,familyInUse, source, overwriteParameterValues):
		overwriteParameterValues.Value = False
		return True

# Simple Warning Swallow Class
class WarnSwallowSimple(IFailuresPreprocessor):
	def PreprocessFailures(self, failuresAccessor):
		failuresAccessor.DeleteAllWarnings()
		return FailureProcessingResult.Continue

# Get/Create Wanted Family Type
def getfamtype(famdoc,famtypename = None):
	alltypes = famdoc.FamilyManager.Types
	if len(list(alltypes)) == 1 or famtypename == None:
		famtype = famdoc.FamilyManager.CurrentType
	elif len(list(alltypes)) == 0 or famtypename == None:
		famtype = famdoc.FamilyManager.NewType(famtypename)
		famdoc.FamilyManager.CurrentType = famtype
	else:
		for t in alltypes:
			if t.Name == famtypename:
				famdoc.FamilyManager.CurrentType = t
				famtype = t
				break
	return famtype

# To List
def tolist(obj1):
	if hasattr(obj1,'__iter__'): return obj1
	else: return [obj1]

# Free Form of Import Instance
def freeformfromimportinstance(famdoc,importedelement,opt1):
	geomfix = []
	if famdoc.IsFamilyDocument == True:
		geom = importedelement.get_Geometry(opt1)
		for e in geom:
			go = e.GetInstanceGeometry()
			for g in go:
				try:
					geomfix.append(FreeFormElement.Create(famdoc,g))
				except:
					pass
	else:
		geomfix.append(importedelement)
	return geomfix

# Flatten List
def flatten(x):
    result = []
    try:
    	for el in x:
        	if hasattr(el, "__iter__") and not isinstance(el, basestring):
        	    result.extend(flatten(el))
        	else:
        	    result.append(el)
    except:
    	result = x
    return result

# Change Material
def changemat(famname,doc,togolist,material,subcategory,subcategorymat,isonemat,ismatinstance,matparamname,separator):
	subcatmat = None
	if doc.IsFamilyDocument == True:
		mat_fec = FilteredElementCollector(doc).OfClass(Material)
		try:
			SUB_fam_mat = False
			if subcategorymat != "" and subcategorymat != None and subcategory != "" and subcategory != None:
				for sm in mat_fec:
					if sm.Name.lower() == subcategorymat.lower():
						SUB_fam_mat = sm.Id
						subcatmat = doc.GetElement(SUB_fam_mat)
						break
				if SUB_fam_mat == False:
					SUBnewmat = Material.Create(doc, subcategorymat)
					defcolor = Color(120,120,120)
					SUBmatelement = doc.GetElement(SUBnewmat)
					SUBmatelement.Color = defcolor
					if "transparen" in subcategorymat.lower():
						SUBmatelement.Transparency = 50
					subcatmat = SUBmatelement
		except: pass					
		if material != "" and material != None:
			fam_mat = False
			for m in mat_fec:
				if m.Name.lower() == material.lower():
					fam_mat = m.Id
					break
			if fam_mat == False:
				newmat = Material.Create(doc, material)
				defcolor = Color(120,120,120)
				matelement = doc.GetElement(newmat)
				matelement.Color = defcolor
				if "transparen" in material.lower():
					matelement.Transparency = 50
				fam_mat = newmat
		getfamtype(doc,famname)
		if material != None:
			if isonemat == False:
				#if len(togolist) == 1:
				#	actuallyone = True
				#else:
				#	actuallyone = False
				count = 1
				for k in togolist:
					matpname = matparamname + separator + str(count)
					#if actuallyone:
					#	matpname = matparamname
					#else:
					#	matpname = matparamname + separator + str(count)
					count += 1
					try:
						if int(DocumentManager.Instance.CurrentUIApplication.Application.VersionNumber) < 2022:
							famnewpar = doc.FamilyManager.AddParameter(matpname,BuiltInParameterGroup.PG_MATERIALS,ParameterType.Material,ismatinstance)
						else:
							famnewpar = doc.FamilyManager.AddParameter(matpname,GroupTypeId.Materials,getSpec("Material"),ismatinstance)
					except:
						existedparams = doc.FamilyManager.GetParameters()
						for existedp in existedparams:
							if existedp.Definition.Name == matpname:
								famnewpar = existedp
								if (ismatinstance and existedp.IsInstance) or (ismatinstance == False and existedp.IsInstance == False):
									break
								elif ismatinstance:
									doc.FamilyManager.MakeInstance(famnewpar)
								else:
									doc.FamilyManager.MakeType(famnewpar)
								break
					if isinstance(k, list):
						for minik in k:
							matparam = minik.get_Parameter(BuiltInParameter.MATERIAL_ID_PARAM)
							doc.FamilyManager.AssociateElementParameterToFamilyParameter(matparam,famnewpar)
					else:
						matparam = k.get_Parameter(BuiltInParameter.MATERIAL_ID_PARAM)
						doc.FamilyManager.AssociateElementParameterToFamilyParameter(matparam,famnewpar)
					if material != "" and material != None:
						doc.FamilyManager.Set(famnewpar,fam_mat)
			else:
				matpname = matparamname
				try:
					if int(DocumentManager.Instance.CurrentUIApplication.Application.VersionNumber) < 2022:
						famnewpar = doc.FamilyManager.AddParameter(matpname,BuiltInParameterGroup.PG_MATERIALS,ParameterType.Material,ismatinstance)
					else:
						famnewpar = doc.FamilyManager.AddParameter(matpname,GroupTypeId.Materials,getSpec("Material"),ismatinstance)
				except:
					existedparams = doc.FamilyManager.GetParameters()
					for existedp in existedparams:
						if existedp.Definition.Name == matpname:
							famnewpar = existedp
							if (ismatinstance and existedp.IsInstance) or (ismatinstance == False and existedp.IsInstance == False):
								break
							elif ismatinstance:
								doc.FamilyManager.MakeInstance(famnewpar)
							else:
								doc.FamilyManager.MakeType(famnewpar)
							break
				if material != "" and material != None:
					doc.FamilyManager.Set(famnewpar,fam_mat)
				togolist = flatten(togolist)
				for k in togolist:
					matparam = k.get_Parameter(BuiltInParameter.MATERIAL_ID_PARAM)
					doc.FamilyManager.AssociateElementParameterToFamilyParameter(matparam,famnewpar)
			doc.FamilyManager.SortParameters(ParametersOrder.Ascending)
	return subcatmat

# Change Subcategory
def changesubcat(doc,togolist,subcategory,subcatmat):
	if doc.IsFamilyDocument == True and subcategory != "" and subcategory != None:
		try:	
			subcat1 = subcategory
			current_fam_cat = doc.OwnerFamily.FamilyCategory
			sub_fec = current_fam_cat.SubCategories
			sub_cat = False
			for sub in sub_fec:
				if sub.Name.lower() == subcat1.lower():
					sub_cat = sub
					break
			if sub_cat == False:
				newsubcat = doc.Settings.Categories.NewSubcategory(current_fam_cat, subcat1)
				sub_cat = newsubcat
				try:
					sub_cat.Material = subcatmat
				except:
					pass
			togolist = flatten(togolist)
			for s2 in togolist:
				s2.Subcategory = sub_cat
		except: pass
	return "Done"

# Change to Void
def changetovoid(doc,togolist,tovoid):
	if tovoid == True and doc.IsFamilyDocument == True:
		togolist = flatten(togolist)
		for k in togolist:
			void_par = k.get_Parameter(BuiltInParameter.ELEMENT_IS_CUTTING)
			void_par.Set(1)
	return "Done"

# Free Form Function
def New_FreeForm(doc,view,opt1,dyngeom,factor,filemode,tovoid,material,subcategory,subcategorymat,temp_path,selforigin,unitfactor,mainvec,autoalternative,docimportmethod):
	if dyngeom == None or dyngeom == []:
		return None
	try:
		if filemode:
			sat_path = dyngeom
		else:
			randomname = "Dynamo-" + ''.join([random.choice(string.ascii_letters + string.digits) for n in xrange(5)])
			sat_path = '%s%s.sat' % (temp_path, randomname)
			dg.Geometry.ExportToSAT(dyngeom,sat_path,factor)
		togolist = []
		isgood = True
		if docimportmethod:
			satopt1 = SATImportOptions()
			importedelement = doc.GetElement(doc.Import(sat_path, satopt1, view))
			importedelement.Pinned = False
			togolist = freeformfromimportinstance(doc,importedelement,opt1)
			if doc.IsFamilyDocument == True:
				doc.Delete(importedelement.Id)
		else:
			shapeImporter = ShapeImporter()
			converted = shapeImporter.Convert(doc, sat_path)
			for e in converted:
				try:
					togolist.append(FreeFormElement.Create(doc,e))
				except:
					if autoalternative and filemode:
						isgood = False
						break
			shapeImporter.Dispose()
		if isgood == False:
			isdanger = True
			if len(togolist) != 0:
				for togo in togolist:
					doc.Delete(togo.Id)
		else:
			isdanger = False
		if isdanger:
			return None,True
		if len(togolist) == 0:
			satopt1 = SATImportOptions()
			importedelement = doc.GetElement(doc.Import(sat_path, satopt1, view))
			importedelement.Pinned = False
			togolist = freeformfromimportinstance(doc,importedelement,opt1)
			if doc.IsFamilyDocument == True:
				doc.Delete(importedelement.Id)
		if filemode == False: System.IO.File.Delete(sat_path)
		if selforigin and filemode:
			for togo in togolist:
				ElementTransformUtils.MoveElement(doc,togo.Id,mainvec.Scale(unitfactor).ToXyz())
		return togolist,isdanger
	except:
		return traceback.format_exc(),''

# Get/Create Wanted Family Type
def getfamtype(famdoc,famtypename = None):
	alltypes = famdoc.FamilyManager.Types
	if len(list(alltypes)) == 1 or famtypename == None:
		famtype = famdoc.FamilyManager.CurrentType
	elif len(list(alltypes)) == 0 or famtypename == None:
		famtype = famdoc.FamilyManager.NewType(famtypename)
		famdoc.FamilyManager.CurrentType = famtype
	else:
		for t in alltypes:
			if t.Name == famtypename:
				famdoc.FamilyManager.CurrentType = t
				famtype = t
				break
	return famtype

# Create New Family
def createfamily(fam_path,doc,famname,famcategory,isShared,isWorkplane,isVertical,isCuts):
	save_path = '%s%s.rfa' % (temp_path, famname)
	famdoc = doc.Application.NewFamilyDocument(fam_path)
	try:
		TransactionManager.Instance.ForceCloseTransaction()
		trans1 = Transaction(famdoc, 'New ' + famname + ' Family')
		trans1.Start()
		warnhandle = WarnSwallowSimple()
		foptions = trans1.GetFailureHandlingOptions()
		foptions.SetFailuresPreprocessor(warnhandle)
		trans1.SetFailureHandlingOptions(foptions)
		transferunit(doc,famdoc)
		try:
			fam_cat = famdoc.Settings.Categories.get_Item(famcategory)
			famdoc.OwnerFamily.FamilyCategory = fam_cat
		except:
			pass
		getfamtype(famdoc)
		if isShared == True:
			try:famdoc.OwnerFamily.get_Parameter(BuiltInParameter.FAMILY_SHARED).Set(1)
			except:pass
		else:
			try:famdoc.OwnerFamily.get_Parameter(BuiltInParameter.FAMILY_SHARED).Set(0)
			except:pass
		if isWorkplane == True:
			try:famdoc.OwnerFamily.get_Parameter(BuiltInParameter.FAMILY_WORK_PLANE_BASED).Set(1)
			except:pass
		else:
			try:famdoc.OwnerFamily.get_Parameter(BuiltInParameter.FAMILY_WORK_PLANE_BASED).Set(0)
			except:pass
		if isVertical == True:
			try:famdoc.OwnerFamily.get_Parameter(BuiltInParameter.FAMILY_ALWAYS_VERTICAL).Set(1)
			except:pass
		else:
			try:famdoc.OwnerFamily.get_Parameter(BuiltInParameter.FAMILY_ALWAYS_VERTICAL).Set(0)
			except:pass
		if isCuts == True:
			try:famdoc.OwnerFamily.get_Parameter(BuiltInParameter.FAMILY_ALLOW_CUT_WITH_VOIDS).Set(1)
			except:pass
		else:
			try:famdoc.OwnerFamily.get_Parameter(BuiltInParameter.FAMILY_ALLOW_CUT_WITH_VOIDS).Set(0)
			except:pass
		trans1.Commit()
		famdoc.SaveAs(save_path, SaveAsOpt)
		loaded = famdoc
	except:
		try:
			trans1.Commit()
		except:
			pass
		TransactionManager.Instance.ForceCloseTransaction()
		try:famdoc.Close(False)
		except:pass
		try:System.IO.File.Delete(save_path)
		except:pass
		loaded = None
	return loaded,save_path

# Load Family
def loadOP(famdoc,overwrite,doc,save_path,needsrestore,tmpname,tmpid,sorigin,mainvec,unitfactor,autoassociate,ismatinstance,famname,material):
	try:
		if famdoc != None and doc != None:
			if overwrite:
				loaded = famdoc.LoadFamily(doc,FamOpt1())
			else:
				loaded = famdoc.LoadFamily(doc,FamOptWithout())
			symbols = loaded.GetFamilySymbolIds().GetEnumerator()
			symbols.MoveNext()
			symbol1 = doc.GetElement(symbols.Current)
			TransactionManager.Instance.ForceCloseTransaction()
			trans1 = Transaction(doc, 'Placing Family ' + famname)
			trans1.Start()
			warnhandle = WarnSwallowSimple()
			foptions = trans1.GetFailureHandlingOptions()
			foptions.SetFailuresPreprocessor(warnhandle)
			trans1.SetFailureHandlingOptions(foptions)
			if doc.IsFamilyDocument:
				creation = doc.FamilyCreate
			else:
				creation = doc.Create
			if not symbol1.IsActive: symbol1.Activate()
			if needsrestore:
				existedelems = [x for x in FilteredElementCollector(doc).OfClass(FamilyInstance).ToElements() if tmpname == x.Symbol.FamilyName]
			else:
				existedelems = [x for x in FilteredElementCollector(doc).OfClass(FamilyInstance).ToElements() if loaded.Name == x.Symbol.FamilyName]
			if len(existedelems) == 0:
				try:
					newinstace = [creation.NewFamilyInstance(XYZ.Zero, symbol1, Structure.StructuralType.NonStructural)]
				except:
					pass
					try:
						firstlevel = doc.GetElement(FilteredElementCollector(doc).OfCategory(BuiltInCategory.OST_Levels).WhereElementIsNotElementType().FirstElementId())
						newinstace = creation.NewFamilyInstance(XYZ.Zero, symbol1, firstlevel, Structure.StructuralType.NonStructural)
					except:
						newinstace = [x for x in FilteredElementCollector(projectdoc).OfClass(FamilyInstance).ToElements() if loaded.Name == x.Symbol.FamilyName]
				if sorigin and autoassociate == False:
					ElementTransformUtils.MoveElement(doc,newinstace[-1].Id,mainvec.Reverse().Scale(unitfactor).ToXyz())
			elif needsrestore:
				newinstace = existedelems
				for e in newinstace:
					e.ChangeTypeId(symbol1.Id)
			else:
				newinstace = existedelems
			if tmpid != None:
				doc.Delete(tmpid)
			if autoassociate:
				if material != "" and material != None:
					mat_fec = FilteredElementCollector(doc).OfClass(Material)
					fam_mat = False
					for m in mat_fec:
						if m.Name.lower() == material.lower():
							fam_mat = m.Id
							break
					getfamtype(doc,famname)
					famtypeparams = list(symbol1.GetOrderedParameters()) + list(newinstace[-1].GetOrderedParameters())
					existedparams = False
					for famparam in famtypeparams:
						if int(DocumentManager.Instance.CurrentUIApplication.Application.VersionNumber) < 2022:
							isMaterialSpec = famparam.Definition.ParameterType.ToString() == "Material"
						else:
							isMaterialSpec = LabelUtils.GetLabelForSpec(famparam.Definition.GetDataType()) == "Material"
						if isMaterialSpec:
							defnametoadd = famparam.Definition.Name
							try:
								if int(DocumentManager.Instance.CurrentUIApplication.Application.VersionNumber) < 2022:
									famnewpar = doc.FamilyManager.AddParameter(defnametoadd,BuiltInParameterGroup.PG_MATERIALS,ParameterType.Material,ismatinstance)
								else:
									famnewpar = doc.FamilyManager.AddParameter(defnametoadd,GroupTypeId.Materials,getSpec("Material"),ismatinstance)
							except:
								if existedparams == False:
									existedparams = doc.FamilyManager.GetParameters()
								for existedp in existedparams:
									if existedp.Definition.Name == defnametoadd:
										famnewpar = existedp
										if (ismatinstance and existedp.IsInstance) or (ismatinstance == False and existedp.IsInstance == False):
											break
										elif ismatinstance:
											doc.FamilyManager.MakeInstance(famnewpar)
										else:
											doc.FamilyManager.MakeType(famnewpar)
										break
							doc.FamilyManager.Set(famnewpar,fam_mat)
							doc.FamilyManager.AssociateElementParameterToFamilyParameter(famparam,famnewpar)
					doc.FamilyManager.SortParameters(ParametersOrder.Ascending)
				else:
					getfamtype(doc,famname)
					famtypeparams = list(symbol1.GetOrderedParameters()) + list(newinstace[-1].GetOrderedParameters())
					existedparams = False
					for famparam in famtypeparams:
						if int(DocumentManager.Instance.CurrentUIApplication.Application.VersionNumber) < 2022:
							isMaterialSpec = famparam.Definition.ParameterType.ToString() == "Material"
						else:
							isMaterialSpec = LabelUtils.GetLabelForSpec(famparam.Definition.GetDataType()) == "Material"
						if isMaterialSpec:
							defnametoadd = famparam.Definition.Name
							try:
								if int(DocumentManager.Instance.CurrentUIApplication.Application.VersionNumber) < 2022:
									famnewpar = doc.FamilyManager.AddParameter(defnametoadd,BuiltInParameterGroup.PG_MATERIALS,ParameterType.Material,ismatinstance)
								else:
									famnewpar = doc.FamilyManager.AddParameter(defnametoadd,GroupTypeId.Materials,getSpec("Material"),ismatinstance)
							except:
								if existedparams == False:
									existedparams = doc.FamilyManager.GetParameters()
								for existedp in existedparams:
									if existedp.Definition.Name == defnametoadd:
										famnewpar = existedp
										if (ismatinstance and existedp.IsInstance) or (ismatinstance == False and existedp.IsInstance == False):
											break
										elif ismatinstance:
											doc.FamilyManager.MakeInstance(famnewpar)
										else:
											doc.FamilyManager.MakeType(famnewpar)
										break
							doc.FamilyManager.AssociateElementParameterToFamilyParameter(famparam,famnewpar)
					doc.FamilyManager.SortParameters(ParametersOrder.Ascending)
			trans1.Commit()
			famdoc.Close(False)
			if save_path != None:
				System.IO.File.Delete(save_path)
			return loaded,symbol1,newinstace
		else:
			return "ERROR"
	except:
		try:
			trans1.Commit()
		except:
			pass
		TransactionManager.Instance.ForceCloseTransaction()
		try:famdoc.Close(False)
		except:pass
		if save_path != None:
			System.IO.File.Delete(save_path)
		return "ERROR"

# Edit Existed Family
def editfamily(doc,famdoc,isWorkplane,isVertical,isCuts):
	try:
		TransactionManager.Instance.ForceCloseTransaction()
		trans1 = Transaction(famdoc, 'Editing ' + famname + ' Family')
		trans1.Start()
		warnhandle = WarnSwallowSimple()
		foptions = trans1.GetFailureHandlingOptions()
		foptions.SetFailuresPreprocessor(warnhandle)
		trans1.SetFailureHandlingOptions(foptions)
		transferunit(doc,famdoc)
		if isWorkplane == True:
			try:famdoc.OwnerFamily.get_Parameter(BuiltInParameter.FAMILY_WORK_PLANE_BASED).Set(1)
			except:pass
		else:
			try:famdoc.OwnerFamily.get_Parameter(BuiltInParameter.FAMILY_WORK_PLANE_BASED).Set(0)
			except:pass
		if isVertical == True:
			try:famdoc.OwnerFamily.get_Parameter(BuiltInParameter.FAMILY_ALWAYS_VERTICAL).Set(1)
			except:pass
		else:
			try:famdoc.OwnerFamily.get_Parameter(BuiltInParameter.FAMILY_ALWAYS_VERTICAL).Set(0)
			except:pass
		if isCuts == True:
			try:famdoc.OwnerFamily.get_Parameter(BuiltInParameter.FAMILY_ALLOW_CUT_WITH_VOIDS).Set(1)
			except:pass
		else:
			try:famdoc.OwnerFamily.get_Parameter(BuiltInParameter.FAMILY_ALLOW_CUT_WITH_VOIDS).Set(0)
			except:pass
		trans1.Commit()
		loaded = famdoc
	except:
		try:
			trans1.Commit()
		except:
			pass
		TransactionManager.Instance.ForceCloseTransaction()
		try:famdoc.Close(False)
		except:pass
		loaded = None
	return loaded

# Geometry Operation
def geometryOP(famcategory,famname,doc,dynaproc,geoms,tovoid,material,isonemat,ismatinstance,matparamname,separator,subcategory,subcategorymat,impOpt,opt1,temp_path,selforigin,joinsurfs,joinsolids,version,unitfactor,autoalternative,docimportmethod,bypasscheck):
	if int(DocumentManager.Instance.CurrentUIApplication.Application.VersionNumber) < 2022:
		if type(geoms[0]) is str:
			factor = 1000
			filemode = True
		else:
			if int(DocumentManager.Instance.CurrentUIApplication.Application.VersionNumber) < 2021:
				factor = UnitUtils.ConvertToInternalUnits(304.8,doc.GetUnits().GetFormatOptions(UnitType.UT_Length).DisplayUnits)
			else:
				factor = UnitUtils.ConvertToInternalUnits(304.8,doc.GetUnits().GetFormatOptions(SpecTypeId.Length).GetUnitTypeId())
			filemode = False
		if dynaproc and filemode:
			geoms = betteimport(doc,geoms[0],temp_path)
			if int(DocumentManager.Instance.CurrentUIApplication.Application.VersionNumber) < 2021:
				factor = UnitUtils.ConvertToInternalUnits(304.8,doc.GetUnits().GetFormatOptions(UnitType.UT_Length).DisplayUnits)
			else:
				factor = UnitUtils.ConvertToInternalUnits(304.8,doc.GetUnits().GetFormatOptions(SpecTypeId.Length).GetUnitTypeId())
			filemode = False
		if selforigin and filemode:
			if isinstance(geoms[0],str):
				tmpgeoms = betteimport(doc,geoms[0],temp_path)
				mainvec = dg.Vector.ByTwoPoints(midbottompoint(tmpgeoms), dg.Point.Origin())
				for tmp in tmpgeoms:
					tmp.Dispose()
			else:
				mainvec = dg.Vector.ByTwoPoints(midbottompoint(geoms), dg.Point.Origin())
		elif selforigin:
			mainvec = dg.Vector.ByTwoPoints(midbottompoint(geoms), dg.Point.Origin())
			trangeoms = []
			for g in geoms:
				trangeoms.append(g.Translate(mainvec))
			geoms = trangeoms
		else:
			mainvec = None
		if filemode == False and (joinsurfs or joinsolids):
			geoms = smartjoinOP(geoms,joinsurfs,joinsolids)
		TransactionManager.Instance.ForceCloseTransaction()
		trans1 = Transaction(doc, 'Creating FreeForms')
		trans1.Start()
		warnhandle = WarnSwallowSimple()
		foptions = trans1.GetFailureHandlingOptions()
		foptions.SetFailuresPreprocessor(warnhandle)
		trans1.SetFailureHandlingOptions(foptions)
		acceptable_views = ('ThreeD', 'FloorPlan', 'EngineeringPlan', 'CeilingPlan', 'Elevation', 'Section')
		all_views = FilteredElementCollector(doc).OfClass(View)
		active_view = None
		for view in all_views:
			if str(view.ViewType) in acceptable_views and not view.IsTemplate:
				break
		result = []
		cleaned = []
		dangermode = False
		for e in geoms:
			if filemode or isinstance(e,dg.Solid) or isinstance(e,dg.Surface) or isinstance(e,dg.PolySurface) or isinstance(e,dg.Cuboid):
				freeform = New_FreeForm(doc,view,opt1,e,factor,filemode,tovoid,material,subcategory,subcategorymat,temp_path,selforigin,unitfactor,mainvec,autoalternative,docimportmethod)
				if freeform[1]:
					dangermode = True
					break
				result.append(freeform[0])
				cleaned.append(freeform[0])
			else:
				result.append([None])
		if dangermode and filemode:
			geoms = betteimport(doc,geoms[0],temp_path)
			if int(DocumentManager.Instance.CurrentUIApplication.Application.VersionNumber) < 2021:
				factor = UnitUtils.ConvertToInternalUnits(304.8,doc.GetUnits().GetFormatOptions(UnitType.UT_Length).DisplayUnits)
			else:
				factor = UnitUtils.ConvertToInternalUnits(304.8,doc.GetUnits().GetFormatOptions(SpecTypeId.Length).GetUnitTypeId())
			filemode = False
			if selforigin:
				mainvec = dg.Vector.ByTwoPoints(midbottompoint(geoms), dg.Point.Origin())
				trangeoms = []
				for g in geoms:
					trangeoms.append(g.Translate(mainvec))
				geoms = trangeoms
			else:
				mainvec = None
			if joinsurfs or joinsolids:
				geoms = smartjoinOP(geoms,joinsurfs,joinsolids)
			for e in geoms:
				if isinstance(e,dg.Solid) or isinstance(e,dg.Surface) or isinstance(e,dg.PolySurface) or isinstance(e,dg.Cuboid):
					freeform = New_FreeForm(doc,view,opt1,e,factor,filemode,tovoid,material,subcategory,subcategorymat,temp_path,selforigin,unitfactor,mainvec,autoalternative,docimportmethod)
					result.append(freeform[0])
					cleaned.append(freeform[0])
				else:
					result.append([None])
		allfreeforms = flatten(cleaned)
		changetovoid(doc,allfreeforms,tovoid)
		if tovoid == False:
			subcatmat = changemat(famname,doc,allfreeforms,material,subcategory,subcategorymat,isonemat,ismatinstance,matparamname,separator)
			changesubcat(doc,allfreeforms,subcategory,subcatmat)
		trans1.Commit()
	else:
		if type(geoms[0]) is str:
			geoms = geoms[0]
			filemode = True
		else:
			filemode = False
		if dynaproc and filemode:
			geoms = dg.Geometry.ImportFromSAT(geoms)
			filemode = False
		if joinsurfs or joinsolids:
			if filemode:
				geoms = dg.Geometry.ImportFromSAT(geoms)
				filemode = False
			geoms = smartjoinOP(geoms,joinsurfs,joinsolids)
		allfreeforms = smartFreeForm(geoms,[1,1,1],doc,selforigin,famcategory,False,False,False,temp_path,bypasscheck,False) #[1,1,1] Will be replaced when Dynamo 2.11.1 or above is out.
		result = flatten(allfreeforms[0])
		mainvec = allfreeforms[1]
		dangermode = allfreeforms[2]
		TransactionManager.Instance.ForceCloseTransaction()
		trans1 = Transaction(doc, 'Changing Materials and Subcategories')
		trans1.Start()
		warnhandle = WarnSwallowSimple()
		foptions = trans1.GetFailureHandlingOptions()
		foptions.SetFailuresPreprocessor(warnhandle)
		trans1.SetFailureHandlingOptions(foptions)
		changetovoid(doc,result,tovoid)
		if tovoid == False:
			subcatmat = changemat(famname,doc,allfreeforms[0],material,subcategory,subcategorymat,isonemat,ismatinstance,matparamname,separator)
			changesubcat(doc,result,subcategory,subcatmat)
		trans1.Commit()
	return result,selforigin,mainvec,dangermode

# Better SAT Import Function
def betteimport(doc,sat,temp_path):
	geoms = dg.Geometry.ImportFromSAT(sat)
	geoms = cleangeomlist(geoms)
	if int(DocumentManager.Instance.CurrentUIApplication.Application.VersionNumber) < 2021:
		factor = round(UnitUtils.ConvertFromInternalUnits(3.280839895,doc.GetUnits().GetFormatOptions(UnitType.UT_Length).DisplayUnits),8) * 1000
	else:
		factor = round(UnitUtils.ConvertFromInternalUnits(3.280839895,doc.GetUnits().GetFormatOptions(SpecTypeId.Length).GetUnitTypeId()),8) * 1000
	randomname = "Dynamo-" + ''.join([random.choice(string.ascii_letters + string.digits) for n in xrange(5)])
	sat_path = '%s%s.sat' % (temp_path, randomname)
	dg.Geometry.ExportToSAT(geoms,sat_path,factor)
	for g in geoms:
		g.Dispose()
	scaledgeoms = dg.Geometry.ImportFromSAT(sat_path)
	System.IO.File.Delete(sat_path)
	return scaledgeoms

# Transfer Document Units
def transferunit(doc,famdoc):
	if int(DocumentManager.Instance.CurrentUIApplication.Application.VersionNumber) < 2021:
		unit = famdoc.GetUnits()
		currectformat = doc.GetUnits().GetFormatOptions(UnitType.UT_Length)
		accuracy = currectformat.Accuracy
		unit.SetFormatOptions(UnitType.UT_Length,FormatOptions(currectformat.DisplayUnits,accuracy))
		famdoc.SetUnits(unit)
	else:
		unit = famdoc.GetUnits()
		currectformat = doc.GetUnits().GetFormatOptions(SpecTypeId.Length)
		unit.SetFormatOptions(SpecTypeId.Length,currectformat)
		famdoc.SetUnits(unit)

# Deep Checking for Conflicts
def checkOP(famname,isShared,doublefamilies):
	existed = [x for x in FilteredElementCollector(projectdoc).OfClass(FamilySymbol).ToElements() if famname.lower() == x.FamilyName.lower()]
	existedelems = [x for x in FilteredElementCollector(projectdoc).OfClass(FamilyInstance).ToElements() if famname.lower() == x.Symbol.FamilyName.lower()]
	needsrestore = False
	needsremoval = False
	tmpname = None
	if len(existed) != 0:
		familyelem = existed[0].Family
		tmpid = familyelem.Id
		existedfamname = familyelem.Name
		existedcat = existed[0].Category.Name
		if len(existedelems) > 0:
			checksuper = existedelems[0].SuperComponent
		else:
			checksuper = None
		if (existedcat != "Mass" and famcategory == "Mass") or (existedcat == "Mass" and famcategory != "Mass") or (checksuper and isShared == False):
			TransactionManager.Instance.ForceCloseTransaction()
			trans1 = Transaction(projectdoc, 'Delete Category Conflicting Family')
			trans1.Start()
			warnhandle = WarnSwallowSimple()
			foptions = trans1.GetFailureHandlingOptions()
			foptions.SetFailuresPreprocessor(warnhandle)
			trans1.SetFailureHandlingOptions(foptions)
			projectdoc.Delete(existed[0].Family.Id)
			needsremoval = True
			trans1.Commit()
		elif isShared == False and doublefamilies == False:
			try:isinit_shared = familyelem.get_Parameter(BuiltInParameter.FAMILY_SHARED).AsInteger()
			except:isinit_shared = 0
			TransactionManager.Instance.ForceCloseTransaction()
			trans1 = Transaction(projectdoc, 'Renaming Conflicting Family')
			trans1.Start()
			warnhandle = WarnSwallowSimple()
			foptions = trans1.GetFailureHandlingOptions()
			foptions.SetFailuresPreprocessor(warnhandle)
			trans1.SetFailureHandlingOptions(foptions)
			if isinit_shared:
				originalname = existed[0].Family.Name
				tmpname = originalname + "_TMP_" + ''.join([random.choice(string.ascii_letters + string.digits) for n in xrange(5)])
				existed[0].Family.Name = tmpname
				needsrestore = True
			trans1.Commit()
	else:
		existedfamname = None
	if tmpname == None:
		tmpid = None
	return existedelems,existedfamname,needsrestore,needsremoval,tmpname,tmpid

# Check If Family Is Here
def isfamhere(projectdoc,famname):
	existed = [x for x in FilteredElementCollector(projectdoc).OfClass(FamilySymbol).ToElements() if famname.lower() == x.FamilyName.lower()]
	if len(existed) != 0:
		return True
	else:
		return False

# Main Operation
def mainOP(geoms,dynaproc,famname,famnumber,autoavoidconflict,famcategory,fam_path,isShared,isWorkplane,isVertical,isCuts,tovoid,material,isonemat,ismatinstance,matparamname,subcategory,subcategorymat,overwrite,projectdoc,SaveAsOpt,impOpt,opt1,temp_path,separator,selforigin,unitfactor,doublefamilies,joinsurfs,joinsolids,version,autoalternative,docimportmethod,bypasscheck):
	# Extra Suffix
	if selforigin:
		selfextra = separator + "Origin (Self)"
	else:
		selfextra = separator + "Origin (Global)"
	if projectdoc.IsFamilyDocument:
		extra = separator + "Nested" + selfextra
	else:
		extra = ""
		
	# Creating Name
	purefamname = famname
	famname = purefamname + separator + str(famnumber) + extra

	# Check If There Is A Conflict
	initconflict = isfamhere(projectdoc,famname)
	if initconflict and autoavoidconflict:
		conflict = True
	else:
		conflict = False
	
	reportnumber = None
	while conflict:
		number = int(re.findall(r'\d+', famname)[-1])
		number += 1
		famname = purefamname + separator + str(number) + extra
		reportnumber = number
		conflict = isfamhere(projectdoc,famname)
	
	if reportnumber == None:
		reportnumber = famnumber
	
	# Checking Existed Family
	checkexistedfamily = checkOP(famname,isShared,doublefamilies)
	existedinstances = checkexistedfamily[0]
	existedfamname = checkexistedfamily[1]
	needsrestore = checkexistedfamily[2]
	needsremoval = checkexistedfamily[3]
	tmpname = checkexistedfamily[4]
	tmpid = checkexistedfamily[5]
	if doublefamilies:
		firstfamname = famname + separator + "Nested" + selfextra
		initialfam1 = createfamily(fam_path,projectdoc,firstfamname,famcategory,False,False,False,isCuts)
		initialfamdoc1 = initialfam1[0]
		initialfamsavepath1 = initialfam1[1]
		geomOP = geometryOP(famcategory,firstfamname,initialfamdoc1,dynaproc,geoms,tovoid,material,isonemat,ismatinstance,matparamname,separator,subcategory,subcategorymat,impOpt,opt1,temp_path,selforigin,joinsurfs,joinsolids,version,unitfactor,autoalternative,docimportmethod,bypasscheck)
		sorigin = geomOP[1]
		mainvec = geomOP[2]
		wasidanger = geomOP[3]
		if initconflict and autoavoidconflict == False:
			fami = [x for x in FilteredElementCollector(projectdoc).OfClass(Family).ToElements() if famname.lower() == x.Name.lower()]
			if len(fami) != 0 and needsremoval == False:
				initialfamdoc2 = projectdoc.EditFamily(fami[-1])
				initialfamsavepath2 = None
				editfamily(projectdoc,initialfamdoc2,isWorkplane,isVertical,isCuts)
			else:
				initialfam2 = createfamily(fam_path,projectdoc,famname,famcategory,isShared,isWorkplane,isVertical,isCuts)
				initialfamdoc2 = initialfam2[0]
				initialfamsavepath2 = initialfam2[1]
		else:
			initialfam2 = createfamily(fam_path,projectdoc,famname,famcategory,isShared,isWorkplane,isVertical,isCuts)
			initialfamdoc2 = initialfam2[0]
			initialfamsavepath2 = initialfam2[1]
		loadOP(initialfamdoc1,overwrite,initialfamdoc2,initialfamsavepath1,needsrestore,tmpname,tmpid,sorigin,mainvec,unitfactor,True,ismatinstance,famname,material)
		result = loadOP(initialfamdoc2,overwrite,projectdoc,initialfamsavepath2,needsrestore,tmpname,tmpid,sorigin,mainvec,unitfactor,False,ismatinstance,famname,material)
		if result == "ERROR":
			result = ["Failed to Load","Failed to Load","Failed to Load"]
		family = result[0]
		familytype = result[1]
		familyinstance = result[2]
	else:
		initialfam = createfamily(fam_path,projectdoc,famname,famcategory,isShared,isWorkplane,isVertical,isCuts)
		initialfamdoc = initialfam[0]
		initialfamsavepath = initialfam[1]
		geomOP = geometryOP(famcategory,famname,initialfamdoc,dynaproc,geoms,tovoid,material,isonemat,ismatinstance,matparamname,separator,subcategory,subcategorymat,impOpt,opt1,temp_path,selforigin,joinsurfs,joinsolids,version,unitfactor,autoalternative,docimportmethod,bypasscheck)
		sorigin = geomOP[1]
		mainvec = geomOP[2]
		wasidanger = geomOP[3]
		result = loadOP(initialfamdoc,overwrite,projectdoc,initialfamsavepath,needsrestore,tmpname,tmpid,sorigin,mainvec,unitfactor,False,ismatinstance,famname,material)
		if result == "ERROR":
			result = ["Failed to Load","Failed to Load","Failed to Load"]
		family = result[0]
		familytype = result[1]
		familyinstance = result[2]
	return family,familytype,familyinstance,reportnumber,wasidanger

# House Clean Up Function
def housecleanup(doc,cleanlist):
	todel = []
	for clean in cleanlist:
		alltypes = [x for x in FilteredElementCollector(projectdoc).OfClass(FamilySymbol).ToElements() if clean.lower() in x.FamilyName.lower()]
		for eachtype in alltypes:
			elemsintype = [x for x in FilteredElementCollector(doc).OfClass(FamilyInstance).ToElements() if x.Symbol.FamilyName == eachtype.FamilyName]
			if len(elemsintype) == 0:				
				todel.append(eachtype.Family)
	familystatus = doc.IsFamilyDocument
	if len(todel) != 0:
		TransactionManager.Instance.ForceCloseTransaction()
		trans1 = Transaction(doc, 'House Cleanup')
		trans1.Start()
		warnhandle = WarnSwallowSimple()
		foptions = trans1.GetFailureHandlingOptions()
		foptions.SetFailuresPreprocessor(warnhandle)
		trans1.SetFailureHandlingOptions(foptions)
		for d in todel:
			if familystatus == False and "nested" in d.Name.lower():
				pass
			else:
				doc.Delete(d.Id)
		trans1.Commit()

# Detect Bottom Mid Point
def midbottompoint(geoms):
	bigbound = dg.BoundingBox.ByGeometry(geoms)
	minp = bigbound.MinPoint
	maxp = bigbound.MaxPoint
	maxpX = maxp.X
	maxpY = maxp.Y
	fixedmaxp = dg.Point.ByCoordinates(maxpX,maxpY,minp.Z)
	midP = dg.Curve.PointAtParameter(dg.Line.ByStartPointEndPoint(minp,fixedmaxp),0.5)
	return midP

def joinsurfsOP(surfs):
	def surf_doesinter(a,b,tollerance = 0.00001):
		if round(dg.Geometry.DistanceTo(a,b),2) < tollerance:
			return True
		else:
			return False
	crvs = flatten(tolist(surfs))
	crvGroup = [-1 for x in range(len(crvs))]
	crvGroup[0] = 0
	maxGroupNum = 1
	for i in range(len(crvs)):
		if (crvGroup[i] == -1):
			crvGroup[i] = i
		for j in range(len(crvs)):
			try:
				if i != j and surf_doesinter(crvs[i], crvs[j]):
					if (crvGroup[j] == -1):
						crvGroup[j] = crvGroup[i]
					elif (crvGroup[i] != crvGroup[j]):
						oldNum = crvGroup[j]
						for k in range(len(crvs)):
							if (crvGroup[k] == oldNum):
								crvGroup[k] = crvGroup[i]
			except:
				pass
	groups = []
	excluded = []
	for n in crvGroup:
		innercount = 0
		tmp = []
		for n2 in crvGroup:
			if n == n2 and n2 not in excluded:
				tmp.append(crvs[innercount])
			innercount += 1
		if len(tmp) == 0:
			continue
		try:
			tmp = dg.Surface.ByUnion(tmp)
			groups.append(tmp)
		except:
			try:
				tmp = dg.PolySurface.ByJoinedSurfaces(tmp)
				groups.append(tmp)
			except:
				for t in tmp:
					groups.append(t)
		excluded.append(n)
	joinedsurfs = groups
	return joinedsurfs

# Main Surface Join Operation
def surfjoinOP(surfaces):
	if len(surfaces) > 1:
		surfaces = joinsurfsOP(surfaces)
		if int(DocumentManager.Instance.CurrentUIApplication.Application.VersionNumber) < 2022:
			for s in surfaces:
				try:
					offset = dg.Surface.Offset(s,0)
					offset.Dispose()
					finalsurfaces.append(s)
				except:
					exploded = dg.Geometry.Explode(s)
					finalsurfaces.append(exploded)
		else:
			finalsurfaces = surfaces
		finalsurfaces = flatten(finalsurfaces)
		return finalsurfaces
	else:
		return surfaces

# Main Solid Union Operation
def tryunion(flattenedsolids):
	if len(flattenedsolids) > 1:
		solids = [x for x in flattenedsolids if x]
		if len(solids) > 1:
			pass
		else:
			return flattenedsolids
		unioned = [solids[0]]
		solids = solids[1:]
		for s in solids:
			i = 0
			unionDone = False
			while i < len(unioned):
				try:
					unioned[i] = unioned[i].Union(s)
					unionDone = True
					break
				except:	i += 1
			if not unionDone: unioned.append(s)
		return unioned
	else:
		return flattenedsolids

# Smart Join Operation
def smartjoinOP(geoms,joinsurfs,joinsolids):
	geoms = list(geoms)
	separatedsurfs = []
	separatedsolids = []
	for g in geoms:
		if isinstance(g,dg.Surface):
			separatedsurfs.append(g)
		else:
			separatedsolids.append(g)
	if joinsurfs:
		separatedsurfs = surfjoinOP(separatedsurfs)
	if joinsolids:
		separatedsolids = tryunion(separatedsolids)
	geoms = separatedsolids + separatedsurfs
	return geoms

def cleangeomlist(geoms):
	filteredgeoms = []
	for e in geoms:
		if isinstance(e,str) or isinstance(e,dg.Solid) or isinstance(e,dg.Surface) or isinstance(e,dg.PolySurface) or isinstance(e,dg.Cuboid):
			filteredgeoms.append(e)
	return filteredgeoms

def smartFreeForm(geoms,scaleup,doc,centermode=False,category="Generic Models",importinstance=False,singlefinalprocess=False,safemode=False,temp_path=System.IO.Path.GetTempPath(),bypasscheck=False,returnfailures=False):
	class WarnSwallowImport(IFailuresPreprocessor):
		def PreprocessFailures(self, failuresAccessor):
			failuresAccessor.DeleteAllWarnings()
			return FailureProcessingResult.Continue
	def finalimport(importinstance,geoms,satopt,singlefinalprocess):
		randomname = "Dynamo-" + ''.join([random.choice(string.ascii_letters + string.digits) for n in xrange(5)])
		sat_path = '%s%s.sat' % (temp_path, randomname)
		dg.Geometry.ExportToSAT(geoms,sat_path)
		if importinstance:
			imported = doc.Import(sat_path,satopt,None)
			element = doc.GetElement(imported)
			element.Pinned = False
			result = [element]
		else:
			result = []
			shapeImporter = ShapeImporter()
			converted = list(shapeImporter.Convert(doc, sat_path))
			if doc.IsFamilyDocument:
				for e in converted:
					try:
						result.append(FreeFormElement.Create(doc,e))
					except:
						pass
			else:
				form = DirectShape.CreateElement(doc,doc.Settings.Categories.get_Item(category).Id)
				try:
					form.SetShape(converted)
				except:
					doc.Delete(form.Id)
					imported = doc.Import(sat_path,satopt,None)
					element = doc.GetElement(imported)
					element.Pinned = False
					form = element
				result.append(form)
			shapeImporter.Dispose()
		System.IO.File.Delete(sat_path)
		return result
	def allisone(testlist):
		for t in testlist:
			if t != 1:
				return False
		return True
	def tolist(obj1):
		if hasattr(obj1,'__iter__'): return obj1
		else: return [obj1]
	def flatten(x):
		result = []
		for el in x:
			if hasattr(el, "__iter__") and not isinstance(el, basestring):
				result.extend(flatten(el))
			else:
				result.append(el)
		return result
	def movecenter(doc,elements):
		try:
			elements = flatten(elements)
			pts = []
			for e in elements:
				try:
					bbox = e.get_BoundingBox(None)
					pts.append(bbox.Max.ToPoint())
					pts.append(bbox.Min.ToPoint())
				except:
					pass
			Xs = []
			Ys = []
			Zs = []
			for pt in pts:
				Xs.append(pt.X)
				Ys.append(pt.Y)
				Zs.append(pt.Z)
			bigbox = dg.BoundingBox.ByCorners(dg.Point.ByCoordinates(max(Xs),max(Ys),max(Zs)),dg.Point.ByCoordinates(min(Xs),min(Ys),min(Zs)))
			minp = bigbox.MinPoint
			maxp = bigbox.MaxPoint
			midpoint = dg.Curve.PointAtParameter(dg.Line.ByStartPointEndPoint(minp,dg.Point.ByCoordinates(maxp.X,maxp.Y,minp.Z)),0.5)
			mainvec = dg.Vector.ByTwoPoints(midpoint, dg.Point.Origin())
			scaledvec = mainvec.Scale(unitconverter(1,doc,False))
			for e in elements:
				ElementTransformUtils.MoveElement(doc,e.Id,scaledvec.ToXyz())
			return mainvec
		except:
			return None
	def unitconverter(value,doc,frominternal=True):
		if int(DocumentManager.Instance.CurrentUIApplication.Application.VersionNumber) < 2021:
			if frominternal:
				value = UnitUtils.ConvertFromInternalUnits(value,doc.GetUnits().GetFormatOptions(UnitType.UT_Length).DisplayUnits)
			else:
				value = UnitUtils.ConvertToInternalUnits(value,doc.GetUnits().GetFormatOptions(UnitType.UT_Length).DisplayUnits)
		else:
			if frominternal:
				value = UnitUtils.ConvertFromInternalUnits(value,doc.GetUnits().GetFormatOptions(SpecTypeId.Length).GetUnitTypeId())
			else:
				value = UnitUtils.ConvertToInternalUnits(value,doc.GetUnits().GetFormatOptions(SpecTypeId.Length).GetUnitTypeId())
		return value
	def smartrevitsolid(surfs,doc,importinstance,safemode,geometrymode,disposeinit,temp_path):
		def polysurfaceOP(surfaces,chunks=12):
			def smartpolysurface(surfaces,times,round=0):
				if len(surfaces) > chunks:
					if times == 0:
						return surfaces
					result = []
					chopped = [surfaces[x:x+chunks] for x in xrange(0, len(surfaces), chunks)]
					for chop in chopped:
						try:
							joined = dg.PolySurface.ByJoinedSurfaces(chop)
							#if round != 0:
							#	for c in chop:
							#		c.Dispose()
							result.append(joined)
						except:
							for c in chop:
								result.append(c)
					times -= 1
					round += 1
					result = smartpolysurface(result,times,round)
					return result
				else:
					if isinstance(surfaces, dg.PolySurface):
						return surfaces
					else:
						return dg.PolySurface.ByJoinedSurfaces(surfaces)
			surfaces = flatten(tolist(surfaces))
			n = len(surfaces)
			times = 0
			while n > 1:
				n //= chunks
				times += 1
			times *= 1.5
			times = int(round(times))
			joined = smartpolysurface(surfaces,times)
			if isinstance(joined, list):
				try:
					joined = dg.PolySurface.ByJoinedSurfaces(joined)
				except:
					joined = joined
			return joined
		def isActuallygood(geomorsat,converted,firstTime,geometrymode,bypasscheck):
			if firstTime:
				if bypasscheck == False:
					originalfaces = []
					if isinstance(geomorsat,dg.Solid) or isinstance(geomorsat,dg.PolySurface):
						exploded = dg.Geometry.Explode(geomorsat)
						for exp in exploded:
							originalfaces.append(exp)
							if exp.Closed:
								originalfaces.append(exp)
					elif isinstance(geomorsat,dg.Surface):
						if geometrymode == False:
							originalfaces.append(geomorsat)
							if geomorsat.Closed:
								originalfaces.append(geomorsat)
						else:
							exploded = dg.Geometry.Explode(geomorsat)
							for exp in exploded:
								originalfaces.append(exp)
								if exp.Closed:
									originalfaces.append(exp)
					elif isinstance(geomorsat,str):
						geomsorsat = dg.Geometry.ImportFromSAT(geomorsat)
						for geomorsat in geomsorsat:
							if isinstance(geomorsat,dg.Solid) or isinstance(geomorsat,dg.PolySurface):
								exploded = dg.Geometry.Explode(geomorsat)
								for exp in exploded:
									originalfaces.append(exp)
									if exp.Closed:
										originalfaces.append(exp)
								if geometrymode == False and doc.IsFamilyDocument:
									geomorsat.Dispose()
							elif isinstance(geomorsat,dg.Surface):
								if geometrymode == False:
									originalfaces.append(geomorsat)
									if geomorsat.Closed:
										originalfaces.append(geomorsat)
								else:
									exploded = dg.Geometry.Explode(geomorsat)
									for exp in exploded:
										originalfaces.append(exp)
										if exp.Closed:
											originalfaces.append(exp)
						if geometrymode:
							geomorsat = list(geomsorsat)
					originalnum = len(originalfaces)
					for org in originalfaces:
						org.Dispose()
					FFfaces = []
					for e in converted:
						getfaces = e.Faces
						for gotten in getfaces:
							FFfaces.append(gotten)
					FFfacesnum = len(FFfaces)
					if FFfacesnum >= originalnum:
						samefaces = True
					else:
						samefaces = False
				else:
					samefaces = True
				freeforms = []
				if doc.IsFamilyDocument == False and singlefinalprocess and geometrymode == False and samefaces and importinstance == False:
					form = DirectShape.CreateElement(doc,doc.Settings.Categories.get_Item(category).Id)
					try:
						form.SetShape(converted)
						freeforms.append(form)
					except:
						doc.Delete(form.Id)
						satopt = SATImportOptions()
						freeforms.append(finalimport(True,geomsorsat,satopt,True)[0])
						satopt.Dispose()
				if geometrymode == False and samefaces and importinstance == False:
					for e in converted:
						if doc.IsFamilyDocument:
							form = FreeFormElement.Create(doc,e)
							freeforms.append(form)
						elif singlefinalprocess == False:
							form = DirectShape.CreateElement(doc,doc.Settings.Categories.get_Item(category).Id)
							try:
								form.SetShape([e])
								freeforms.append(form)
							except:
								doc.Delete(form.Id)
			else:
				samefaces = False
			if geometrymode:
				if isinstance(geomorsat, list):
					freeforms = geomorsat
				else:
					freeforms = [geomorsat]
			if len(freeforms) == 0:
				return [False]
			if firstTime == False:
				return freeforms
			elif samefaces and firstTime:
				return freeforms
			else:
				return [False]
		def isbellowarea(surface):
			if round(meternumber(surface.Area),2) < meternumber(0.0025):
				return True
			else:
				return False
		def isbellowlength(surface):
			edges = surface.Edges
			for e in edges:
				curvegeom = e.CurveGeometry
				length = curvegeom.Length
				curvegeom.Dispose()
				if length <= 0.0007803686370625:
					return True
			return False
		def meternumber(value):
			value = value
			return value
		def metersurfarea(surface):
			area = meternumber(surface.Area)
			return area
		def almostsame(surf1,surf2,tollerance = 2):
			if round(metersurfarea(surf1),tollerance) == round(metersurfarea(surf2),tollerance):
				return True
			else:
				return False
		def quickSATcheck(sat_path,customscale=[1,1,1],importinstance=False,firstTime=True,geometrymode=False,bypasscheck=False):
			if allisone(customscale) == False:
				return [False]
			converted = []
			shapeImporter = ShapeImporter()
			converted = list(shapeImporter.Convert(doc, sat_path))
			shapeImporter.Dispose()
			if bypasscheck:
				cleanconverted = []
				for e in converted:
					if e.ToString() == "Autodesk.Revit.DB.Mesh":
						continue
					else:
						cleanconverted.append(e)
				converted = cleanconverted
			else:
				for e in converted:
					if e.ToString() == "Autodesk.Revit.DB.Mesh":
						return [False]
			if len(converted) != 0:
				converted = isActuallygood(sat_path,converted,firstTime,geometrymode,bypasscheck)
			if (bypasscheck and importinstance) or (importinstance and converted[0] != False):
				satopt = SATImportOptions()
				imported = doc.Import(sat_path,satopt,None)
				element = doc.GetElement(imported)
				element.Pinned = False
				converted = [element]
				satopt.Dispose()
			if len(converted) == 0:
				return [False]
			return converted
		def batchattempt(temp_path,surfs,importinstance,bypasscheck,scaleup,sendmessage):
			randomname = "Dynamo-" + ''.join([random.choice(string.ascii_letters + string.digits) for n in xrange(5)])
			x_sat_path = '%s%s.sat' % (temp_path, randomname)
			dg.Geometry.ExportToSAT(surfs,x_sat_path)
			if importinstance and bypasscheck:
				satopt = SATImportOptions()
				imported = doc.Import(x_sat_path,satopt,None)
				element = doc.GetElement(imported)
				element.Pinned = False
				x_finalsurfaces = [element]
				satopt.Dispose()
			else:
				x_finalsurfaces = quickSATcheck(x_sat_path,scaleup,importinstance,True,False,bypasscheck)
			System.IO.File.Delete(x_sat_path)
			if x_finalsurfaces[0] == False:
				return [False]
			else:
				x_choppedfinal = []
				for xf in x_finalsurfaces:
					x_choppedfinal.append([xf])
				return x_choppedfinal,sendmessage,True
		def SurfacesLaundry(surfs,doc,importinstance,geometrymode,temp_path):
			#scaleup = round(unitconverter(3.280839895,doc,True),8)
			def tolist(obj1):
				if hasattr(obj1,'__iter__'): return obj1
				else: return [obj1]	
			def checkcompatible(geoms,customscale=[1,1,1],firstTime=False,geometrymode=True,bypasscheck=False):
				randomname = "Dynamo-" + ''.join([random.choice(string.ascii_letters + string.digits) for n in xrange(5)])
				sat_path = '%s%s.sat' % (temp_path, randomname)
				if allisone(customscale) == False:
					scaledgeoms = geoms.Scale(customscale[0],customscale[1],customscale[2])
					geoms = scaledgeoms
				dg.Geometry.ExportToSAT(geoms,sat_path)
				converted = []
				shapeImporter = ShapeImporter()
				converted = list(shapeImporter.Convert(doc, sat_path))
				shapeImporter.Dispose()
				System.IO.File.Delete(sat_path)
				for e in converted:
					if e.ToString() == "Autodesk.Revit.DB.Mesh":
						return [False]
				if len(converted) != 0:
					converted = isActuallygood(geoms,converted,firstTime,geometrymode,bypasscheck)
				if len(converted) == 0:
					return [False]
				return converted
			def revitOP(finalsub,nurbs=None,cleanexplodes=None,customscale=[1,1,1],disposeNurbs=True,geometrymode=True):
				if nurbs == None and cleanexplodes == None:
					testit = checkcompatible(finalsub,customscale,False,geometrymode)
					if testit[0] == False:
						raise Exception("Geometry Incompatible With Revit")
					else:
						if geometrymode == False:
							finalsub.Dispose()
						return testit
				cleanfinalsub = dg.Geometry.Explode(finalsub)
				revitgeom = []
				for c in cleanfinalsub:
					testit = checkcompatible(c,customscale,False,geometrymode)
					if testit[0] == False:
						c.Dispose()
						raise Exception("Geometry Incompatible With Revit")
					else:
						if geometrymode == False:
							c.Dispose()
						revitgeom.append(testit)
				revitgeom = flatten(revitgeom)
				if disposeNurbs:
					nurbs.Dispose()
				for cleanex in cleanexplodes:
					cleanex.Dispose()
				finalsub.Dispose()
				return revitgeom
			def cleanupSurface(surface):
				def subtractfunction(nurbs,cleanexplodes):
					def loopclean(nurbs,thick,counter):
						result = dg.Surface.SubtractFrom(nurbs,thick)[0]
						if counter != 0:
							nurbs.Dispose()
						thick.Dispose()
						return result
					thickforms = []
					for cleanex in cleanexplodes:
						safearea = metersurfarea(cleanex)/10
						if safearea > meternumber(0.1):
							maxthicken = meternumber(0.1)
						else:
							maxthicken = safearea
						thickforms.append(dg.Surface.Thicken(cleanex,maxthicken,True))
					counter = 0
					for thick in thickforms:
						nurbs = loopclean(nurbs,thick,counter)
						counter += 1
					return nurbs
				def tryingforall(surface,nurbs,cleanexplodes,geometrymode):
					try:
						finalsub = subtractfunction(nurbs,cleanexplodes)
						return revitOP(finalsub,nurbs,cleanexplodes,scaleup,True,geometrymode)
					except:
						try:
							finalsub = dg.Surface.Difference(nurbs,cleanexplodes)
							return revitOP(finalsub,nurbs,cleanexplodes,scaleup,True,geometrymode)
						except Exception as e:
							if str(e) == "Cannot difference an empty list" and almostsame(nurbs,surface):
								finalsub = nurbs
								try:
									return revitOP(finalsub,nurbs,cleanexplodes,scaleup,False,geometrymode)
								except:
									return None,finalsub
							else:
								return None,finalsub
				def gencleanexplodes(subtractnurbs):
					if isinstance(subtractnurbs, list):
						if len(subtractnurbs) == 0:
							return []
					else:
						explodednurbs = dg.Geometry.Explode(subtractnurbs)
						cleanexplodes = []
						if safemode:
							for ex in explodednurbs:
								if ex.Area < meternumber(0.002):
									ex.Dispose()
								else:
									cleanexplodes.append(ex)
						else:
							cleanexplodes = list(explodednurbs)
						subtractnurbs.Dispose()
						return cleanexplodes
				def easymethod(surface,geometrymode):
					try:
						nurbs = dg.Surface.ToNurbsSurface(surface)
						if almostsame(nurbs,surface):
							try:
								return True,revitOP(nurbs,None,None,scaleup,True,geometrymode)
							except:
								return None,nurbs
						else:
							return None,nurbs
					except:
						return None,None
				def isplanarsurf(s):
					norms = [0,0.333,0.666,1]
					pts = []
					for n in norms:
						for n2 in norms:
							pts.append(dg.Surface.PointAtParameter(s,n,n2))
					plane = dg.Plane.ByBestFitThroughPoints(pts)
					status = True
					for p in pts:
						try:
							inter = dg.Geometry.DoesIntersect(p,plane)
							if inter == False:
								status = False
								break
						except:
							pass
					return status
				def joincurves(crvs):
					def PointsEqual(pt1, pt2):
						tolerance = 0.00001
						if (math.fabs(pt1.X - pt2.X) < tolerance and
						    math.fabs(pt1.Y - pt2.Y) < tolerance and
						    math.fabs(pt1.Z - pt2.Z) < tolerance):
							return True
						else:
							return False
					crvs = flatten(tolist(crvs))
					crvGroup = [-1 for x in range(len(crvs))]
					crvGroup[0] = 0
					maxGroupNum = 1
					starts = []
					ends = []
					for crv in crvs:
						starts.append(crv.PointAtParameter(0))
						ends.append(crv.PointAtParameter(1))
					for i in range(len(crvs)):
						if (crvGroup[i] == -1):
							crvGroup[i] = i
						for j in range(len(crvs)):
							if (i != j and
								(PointsEqual(starts[i], starts[j]) or
								PointsEqual(starts[i], ends[j]) or
								PointsEqual(ends[i], starts[j]) or
								PointsEqual(ends[i], ends[j]))):
								if (crvGroup[j] == -1):
									crvGroup[j] = crvGroup[i]
								elif (crvGroup[i] != crvGroup[j]):
									oldNum = crvGroup[j]
									for k in range(len(crvs)):
										if (crvGroup[k] == oldNum):
											crvGroup[k] = crvGroup[i]
					groups = []
					excluded = []
					for n in crvGroup:
						innercount = 0
						tmp = []
						for n2 in crvGroup:
							if n == n2 and n2 not in excluded:
								tmp.append(crvs[innercount])
							innercount += 1
						if len(tmp) == 0:
							continue
						try:
							tmp = dg.PolyCurve.ByJoinedCurves(tmp)
							groups.append(tmp)
						except:
							for t in tmp:
								groups.append(dg.PolyCurve.ByJoinedCurves([t]))
						excluded.append(n)
					joinedcurves = groups
					return joinedcurves
				def simplifypolycurve(polycurves,safeangle=0.001):
					result = []
					for polycurve in polycurves: 
						try:
							exploded = dg.Geometry.Explode(polycurve)
							count = 0
							totalpts = []
							curves = []
							triggerlast = False
							for exp in exploded:
								vec1 = dg.Curve.TangentAtParameter(exploded[count],0)
								vec2 = dg.Curve.TangentAtParameter(exploded[count - 1],1)
								angle = dg.Vector.AngleWithVector(vec1,vec2)
								nurbspts = exp.ToNurbsCurve().ControlPoints()
								if angle >= safeangle:
									totalpts.append(nurbspts)
								else:
									if len(totalpts) == 0:
										triggerlast = True
										storelast = nurbspts
									else:
										last_list = list(totalpts[-1])
										nurbspts = nurbspts[1:]
										for n in nurbspts:
											last_list.append(n)
										totalpts[-1] = last_list
								count += 1
							if triggerlast:
								last_list = list(totalpts[-1])
								nurbspts = storelast[1:]
								for n in nurbspts:
									last_list.append(n)
								totalpts[-1] = last_list
							
							for total in totalpts:
								curves.append(dg.NurbsCurve.ByControlPoints(total))
							joinedcurve = dg.PolyCurve.ByJoinedCurves(curves)
							result.append(joinedcurve)
						except:
							result.append(polycurve)
					return result
				def trimloopmethod(surface,nurbs,geometrymode):
					try:
						if surface.Closed:
							return [None]
						try:
							joinedperms = [dg.PolyCurve.ByJoinedCurves(surface.PerimeterCurves())]
						except:
							joinedperms = joincurves(surface.PerimeterCurves())
						finalsub = dg.Surface.TrimWithEdgeLoops(nurbs,joinedperms)
						if almostsame(finalsub,surface):
							return revitOP(finalsub,None,None,scaleup,True,geometrymode)
						else:
							return [None]
					except:
						return [None]
				def trimloopmethodSimplified(surface,nurbs,geometrymode):
					try:
						if surface.Closed:
							return [None]
						try:
							joinedperms = [dg.PolyCurve.ByJoinedCurves(surface.PerimeterCurves())]
						except:
							joinedperms = joincurves(surface.PerimeterCurves())
						joinedperms = simplifypolycurve(joinedperms)
						try:
							finalsub = dg.Surface.TrimWithEdgeLoops(nurbs,joinedperms)
						except:
							pulledPerms = []
							for joinedperm in joinedperms:
								try:
									pulled = dg.Curve.PullOntoSurface(joinedperm,nurbs)
									if pulled.NumberOfCurves == joinedperm.NumberOfCurves:
										pulledPerms.append(pulled)
									else:
										pulledPerms.append(joinedperm)
								except:
									pulledPerms.append(joinedperm)
							finalsub = dg.Surface.TrimWithEdgeLoops(nurbs,pulledPerms)
						if almostsame(finalsub,surface,1):
							return revitOP(finalsub,None,None,scaleup,True,geometrymode)
						else:
							return [None]
					except:
						return [None]
				def thickenintersectMethod(surface,nurbs,geometrymode,pointOneMeter):
					try:
						tmp_thicken = dg.Surface.Thicken(surface,pointOneMeter,True)
						isplanar = isplanarsurf(surface)
						if isplanar:
							tmp_pt = dg.Surface.PointAtParameter(surface,0.5,0.5)
							tmp_norm = dg.Surface.NormalAtPoint(surface,tmp_pt)
							intersecter = dg.Plane.ByOriginNormal(tmp_pt,tmp_norm)
							finalsub = dg.Geometry.Intersect(intersecter,tmp_thicken)
							for f in finalsub:
								if isinstance(f,dg.Surface):
									finalsub = f
									break
							tmp_thicken.Dispose()
						else:
							finalsub = dg.Geometry.Intersect(nurbs,tmp_thicken)
							for f in finalsub:
								if isinstance(f,dg.Surface):
									finalsub = f
									break
							tmp_thicken.Dispose()
						try:
							return revitOP(finalsub,None,None,scaleup,True,geometrymode)
						except:
							return None,finalsub
					except:
						return [None]
				def inithickenMethod(surface,nurbs,geometrymode):
					try:
						safearea = metersurfarea(surface)/10
						if safearea > meternumber(0.1):
							maxthicken = meternumber(0.1)
						else:
							maxthicken = safearea
						thickeninit = dg.Surface.Thicken(surface,maxthicken,True)
						try:
							subtractnurbs = dg.Surface.SubtractFrom(nurbs,thickeninit)[0]
						except Exception as e:
							if "index out of range" in str(e) and almostsame(nurbs,surface):
								subtractnurbs = []
							elif "index out of range" in str(e):
								try:
									subtractnurbs = dg.Surface.Difference(nurbs,[surface])
								except Exception as e:
									if str(e) == "Unable to get FACE from BODY: no faces in BODY":
										subtractnurbs = []
						thickeninit.Dispose()
						cleanexplodes = gencleanexplodes(subtractnurbs)
						tryall = tryingforall(surface,nurbs,cleanexplodes,geometrymode)
						if tryall[0] != None:
							return tryall
						else:
							return None,tryall[1]
					except:
						return [None]
				def simplesubmethod(surface,nurbs,geometrymode):
					try:
						try:
							subtractnurbs = dg.Surface.Difference(nurbs,[surface])
						except Exception as e:
							if str(e) == "Unable to get FACE from BODY: no faces in BODY":
								try:
									try:
										return revitOP(nurbs,None,None,scaleup,True,geometrymode)
									except:
										return None,nurbs
								except:
									return [None]
						cleanexplodes = gencleanexplodes(subtractnurbs)
						tryall = tryingforall(surface,nurbs,cleanexplodes,geometrymode)
						if tryall[0] != None:
							return tryall
						else:
							return None,tryall[1]
					except:
						return [None]
				easy = easymethod(surface,geometrymode)
				pointOneMeter = unitconverter(0.3280,doc,True)
				if easy[0] != None:
					return easy[1]
				elif easy[0] == None and easy[1] == None:
					return None
				else:
					nurbs = easy[1]
				failsafesurfs = []
				trimloop = trimloopmethod(surface,nurbs,geometrymode)
				if trimloop[0] != None:
					return trimloop
				trimloopSimplified = trimloopmethodSimplified(surface,nurbs,geometrymode)
				if trimloopSimplified[0] != None:
					return trimloopSimplified
				simple = simplesubmethod(surface,nurbs,geometrymode)
				if simple[0] != None:
					return simple
				else:
					try:
						failsafesurfs.append(simple[1])
					except:
						pass
				inithick = inithickenMethod(surface,nurbs,geometrymode)
				if inithick[0] != None:
					return inithick
				else:
					try:
						failsafesurfs.append(inithick[1])
					except:
						pass
				thickeninter = thickenintersectMethod(surface,nurbs,geometrymode,pointOneMeter)
				if thickeninter[0] != None:
					return thickeninter
				else:
					try:
						failsafesurfs.append(thickeninter[1])
					except:
						pass
				for failsurf in failsafesurfs:
					surface = failsurf
					easy = easymethod(surface,geometrymode)
					if easy[0] != None:
						return easy[1]
					elif easy[0] == None and easy[1] == None:
						return None
					else:
						nurbs = easy[1]
					trimloop = trimloopmethod(surface,nurbs,geometrymode)
					if trimloop[0] != None:
						return trimloop
					simple = simplesubmethod(surface,nurbs,geometrymode)
					if simple[0] != None:
						return simple
					inithick = inithickenMethod(surface,nurbs,geometrymode)
					if inithick[0] != None:
						return inithick
					thickeninter = thickenintersectMethod(surface,nurbs,geometrymode,pointOneMeter)
					if thickeninter[0] != None:
						return thickeninter
				return None
			sendmessage = False
			is_sat = False
			if isinstance(surfs,str) == False:
				surfs = flatten(tolist(surfs))
				x_scaledown = round(unitconverter(0.3048,doc,False),8)
				x_pure = []
				for xs in surfs:
					if isinstance(xs,dg.Solid) or isinstance(xs,dg.Surface) or isinstance(xs,dg.PolySurface) or isinstance(xs,dg.Cuboid):
						if x_scaledown != 1:
							x_pure.append(xs.Scale(x_scaledown))
						else:
							x_pure.append(xs)
				surfs = x_pure
				bOP = batchattempt(temp_path,surfs,importinstance,bypasscheck,scaleup,sendmessage)
				if bOP[0] == False:
					pass
				else:
					return bOP
			if isinstance(surfs,str):
				if ".sat" in surfs.lower():
					finalsurfaces = quickSATcheck(surfs,scaleup,importinstance,True,False,bypasscheck)
					if finalsurfaces[0] == False:
						surfs = dg.Geometry.ImportFromSAT(surfs)
						x_pure = []
						for xs in surfs:
							if isinstance(xs,dg.Solid) or isinstance(xs,dg.Surface) or isinstance(xs,dg.PolySurface) or isinstance(xs,dg.Cuboid):
								x_pure.append(xs)
						surfs = x_pure
						is_sat = True
					else:
						choppedfinal = []
						for f in finalsurfaces:
							choppedfinal.append([f])
						return choppedfinal,sendmessage,True
				else:
					return [],sendmessage
				scaledown = 1
			else:
				scaledown = round(unitconverter(0.3048,doc,False),8)
			surfs = flatten(tolist(surfs))
			finalsurfaces = []
			precheck = []
			for s in surfs:
				try:
					if isinstance(s,dg.Surface):
						exploded = dg.Geometry.Explode(s)
						if disposeinit:
							s.Dispose()
						if len(exploded) > 1:
							try:
								precheck.append(dg.PolySurface.ByJoinedSurfaces(exploded))
							except:
								for exp in exploded:
									precheck.append(exp)
						else:
							for exp in exploded:
								precheck.append(exp)
					else:
						precheck.append(s)
				except:
					precheck.append(s)
			surfs = precheck
			bOP = batchattempt(temp_path,surfs,importinstance,bypasscheck,scaleup,sendmessage)
			if bOP[0] == False:
				pass
			else:
				return bOP
			for s in surfs:
				surface = s
				safe = True
				if safemode:
					if isinstance(surface,dg.Solid) or isinstance(surface,dg.PolySurface):
						nicesurfaces = []
						explodedcheck = dg.Geometry.Explode(surface)
						for explocheck in explodedcheck:
							if isbellowarea(explocheck):
								safe = False
								explocheck.Dispose()
								sendmessage = True
							else:
								nicesurfaces.append(explocheck)
						if safe:
							for n in nicesurfaces:
								n.Dispose()
					else:
						if isbellowarea(surface):
							s.Dispose()
							if scaledown != 1 and geometrymode == False:
								surface.Dispose()
							sendmessage = True
							continue
				if safe == False:
					tmp = []
					for mini_s in nicesurfaces:
						testit = checkcompatible(mini_s,scaleup,False,geometrymode)
						if testit[0] == False:
							cleanedup = cleanupSurface(mini_s)
							if cleanedup != None:
								tmp.append(cleanedup)
						else:
							tmp.append(testit)
						if geometrymode == False and testit[0] != False:
							mini_s.Dispose()
					if len(tmp) != 0:
						finalsurfaces.append(flatten(tmp))
					else:
						finalsurfaces.append(["FAILED"])
					if (disposeinit or is_sat) and geometrymode == False:
						s.Dispose()
					if scaledown != 1 and geometrymode == False:
						if isinstance(surface,list):
							for surf in surface:
								surf.Dispose()
						else:
							surface.Dispose()
					continue
				testit = checkcompatible(surface,scaleup,True,geometrymode)
				if testit[0] == False:
					isexploded = False
					if isinstance(surface,dg.Solid) or isinstance(surface,dg.PolySurface):
						surface = list(dg.Geometry.Explode(surface))
						isexploded = True
					if isexploded:
						tmp = []
						for mini_s in surface:
							testit = checkcompatible(mini_s,scaleup,False,geometrymode)
							if testit[0] == False:
								cleanedup = cleanupSurface(mini_s)
								if cleanedup != None:
									tmp.append(cleanedup)
							else:
								tmp.append(testit)
							if geometrymode == False and testit[0] != False:
								mini_s.Dispose()
						if len(tmp) != 0:
							try:
								soljoin = polysurfaceOP(flatten(tmp))
								try:
									sol = dg.Solid.ByJoinedSurfaces([soljoin])
									soljoin.Dispose()
								except:
									sol = soljoin
								testit = checkcompatible(sol,scaleup,True,geometrymode)
								if testit[0] == False:
									sol.Dispose()
									finalsurfaces.append(flatten(tmp))
								else:
									finalsurfaces.append([sol])
							except:
								finalsurfaces.append(flatten(tmp))
						else:
							finalsurfaces.append(["FAILED"])
						sendmessage = True
					else:
						cleanedup = cleanupSurface(surface)
						if cleanedup != None:
							finalsurfaces.append(cleanedup)
						else:
							finalsurfaces.append(["FAILED"])
				else:
					finalsurfaces.append(testit)
				if (disposeinit or is_sat) and geometrymode == False:
					s.Dispose()
				if scaledown != 1 and geometrymode == False:
					if isinstance(surface,list):
						for surf in surface:
							surf.Dispose()
					else:
						surface.Dispose()
			return finalsurfaces,sendmessage
		forms = []
		laundryMain = SurfacesLaundry(surfs,doc,importinstance,geometrymode,temp_path)
		result = laundryMain[0]
		sendmessage = laundryMain[1]
		for rlist in result:
			tmp = []
			for r in rlist:
				tmp.append(r)
			if len(tmp) != 0:
				forms.append(tmp)
		if len(laundryMain) == 3:
			return forms,sendmessage,True
		else:
			return forms,sendmessage
	if geoms == [] or geoms == None:
		return [],None,False
	geometrymode = True
	disposeinit = False
	TransactionManager.Instance.ForceCloseTransaction()
	if importinstance:
		trans = Transaction(doc, 'Create ImportInstance')
	else:
		if doc.IsFamilyDocument:
			trans = Transaction(doc, 'Create FreeForm')
		else:
			trans = Transaction(doc, 'Create DirectShape')
	trans.Start()
	warnhandle = WarnSwallowImport()
	foptions = trans.GetFailureHandlingOptions()
	foptions.SetFailuresPreprocessor(warnhandle)
	foptions.SetClearAfterRollback(True)
	trans.SetFailureHandlingOptions(foptions)
	try:
		smartrevitsolidMain = smartrevitsolid(geoms,doc,importinstance,safemode,geometrymode,disposeinit,temp_path)
	except:
		trans.RollBack()
		return [],None,False
	if len(smartrevitsolidMain) == 3:
		trans.Commit()
	else:
		trans.RollBack()
	freeformslists = smartrevitsolidMain[0]
	sendmessage = smartrevitsolidMain[1]
	result = [] 
	singlelist = []
	TransactionManager.Instance.ForceCloseTransaction()
	if importinstance:
		if singlefinalprocess:
			trans = Transaction(doc, 'Create ImportInstance')
		else:
			trans = Transaction(doc, 'Create ImportInstances')
	else:
		if doc.IsFamilyDocument:
			trans = Transaction(doc, 'Create FreeForms')
		else:
			trans = Transaction(doc, 'Create DirectShape')
	if len(smartrevitsolidMain) == 3:
		if singlefinalprocess:
			trans = Transaction(doc, 'Move ImportInstance')
		else:
			trans = Transaction(doc, 'Move ImportInstances')
	trans.Start()
	satopt = SATImportOptions()
	for slist in freeformslists:
		tmp = []
		tmpexport = []
		for s in slist:
			if s == "FAILED":
				if returnfailures:
					tmp.append(None)
				continue
			compare = s.ToString()
			if compare == "Autodesk.Revit.DB.FreeFormElement" or compare == "Autodesk.Revit.DB.Solid" or compare == "Autodesk.Revit.DB.ImportInstance" or compare == "Autodesk.Revit.DB.DirectShape":
				tmp.append(s)
			else:
				if singlefinalprocess:
					singlelist.append(s)
				else:
					tmpexport.append(s)
		if len(tmp) != 0:
			result.append(tmp)
		if len(tmpexport) != 0:
			result.append(finalimport(importinstance,tmpexport,satopt,singlefinalprocess))
	if len(singlelist) != 0:
		result.append(finalimport(importinstance,singlelist,satopt,singlefinalprocess))
	satopt.Dispose()
	mainvec = None
	if len(result) != 0 and centermode:
		doc.Regenerate()
		mainvec = movecenter(doc,result)
	trans.Commit()
	if importinstance or (singlefinalprocess and doc.IsFamilyDocument == False):
		cleanresult = []
		for r in result:
			cleanresult.append(r[0])
		result  = cleanresult
		if (singlefinalprocess and importinstance) or (singlefinalprocess and doc.IsFamilyDocument == False):
			result = result[0]
	return result,mainvec,sendmessage

# Inputs
safegeom = True
if IN[0] == [] or IN[0] == None:
	safegeom = False
geoms = UnwrapElement(flatten(tolist(IN[0])))
overwrite = IN[1]
onefam = IN[2]
autoavoidconflict = IN[3]
dynaproc = IN[4]
joinsurfs = IN[5]
joinsolids = IN[6]
famname = IN[7]
famnumber = int(IN[8])
famcategory = UnwrapElement(IN[9])
fam_path = IN[10]
isShared = IN[11]
isWorkplane = IN[12]
isVertical = IN[13]
isCuts = IN[14]
tovoid = IN[15]
material = IN[16]
isonemat = IN[17]
ismatinstance = IN[18]
matparamname = IN[19]
subcategory = IN[20]
subcategorymat = IN[21]
selforigin = IN[22]
separator = IN[23]
doublefamilies = IN[24]
autoalternative = IN[25]
recommended = IN[26]
showmessages = IN[27]
docimportmethod = IN[28]
importinstance = IN[29]
bypasscheck = IN[30]

if tovoid:
	filteredGeoms = []
	for geom in geoms:
		if isinstance(geom,dg.Surface) == False:
			filteredGeoms.append(geom)
	geoms = filteredGeoms

cleanlist = ["Dynamo Wall Intersects Family","Dynamo K-Paneling","Dynamo Solid or Void Family","Dynamo Splitted Mass","Dynamo Converted Element","Dynamo Converted Face","Dynamo Loft Family","Dynamo Scaled Mass","Dynamo Generated Patch","Dynamo Sliced Pieces","Dynamo Chamfered Element","Dynamo Filleted Element","Dynamo Stairs K-Fill","Dynamo Room Family","Dynamo Topography Stepped","Dynamo Model Text","Dynamo Converted Project","Dynamo Converted Site","Dynamo Free Form Family","Dynamo Subergion","Dynamo Smart Voider","Dynamo T-Spline Form","Dynamo Water Family","Dynamo Adaptive Offset"]

# Windows Temp Path
temp_path = System.IO.Path.GetTempPath()

# Project Document and UI
projectdoc = DocumentManager.Instance.CurrentDBDocument
uiapp = DocumentManager.Instance.CurrentUIApplication

# Filter Geometry List
geoms = cleangeomlist(geoms)

# Stabelizing Category Name
try:
	famcategory = famcategory.Name
except:
	pass

if importinstance:
	if int(DocumentManager.Instance.CurrentUIApplication.Application.VersionNumber) < 2022:
		result = []
		if type(geoms[0]) is str:
			geoms = betteimport(projectdoc,geoms[0],temp_path)
		if onefam:
			geoms = Array[dg.Geometry](geoms)
			result.append(Revit.Elements.ImportInstance.ByGeometries(geoms))
		else:
			for geom in geoms:
				result.append(Revit.Elements.ImportInstance.ByGeometry(geom))
		OUT = None,None,result
	else:
		if type(geoms[0]) is str:
			geoms = geoms[0]
		OUT = None,None,smartFreeForm(geoms,[1,1,1],projectdoc,False,famcategory,True,onefam,False,temp_path,True)[0]
elif safegeom:
	# Unit Factor
	if int(DocumentManager.Instance.CurrentUIApplication.Application.VersionNumber) < 2021:
		unitfactor = UnitUtils.ConvertToInternalUnits(1,projectdoc.GetUnits().GetFormatOptions(UnitType.UT_Length).DisplayUnits)
	else:
		unitfactor = UnitUtils.ConvertToInternalUnits(1,projectdoc.GetUnits().GetFormatOptions(SpecTypeId.Length).GetUnitTypeId())
	
	# Dynamo Version
	version = Dynamo.Applications.DynamoRevit().RevitDynamoModel.Version
	version = int(version.split(".")[0])
	
	# Revit Version
	revitversion = int(uiapp.Application.VersionNumber)
	
	# Check If SAT and One Family Is Disabled
	onefam_message = False
	if onefam == False:
		if type(geoms[0]) is str:
			geoms = betteimport(projectdoc,geoms[0],temp_path)
			onefam_message = "Switched To Alternative Sync Method Due To Request Of Multiple Families For SAT file"
			count = len(geoms)
			famnumbers = range(famnumber,famnumber + count,1)
		else:
			count = len(geoms)
			famnumbers = range(famnumber,famnumber + count,1)
	
	# Applying Recommended Settings
	oldrevitmessage = False
	if recommended:
		if projectdoc.IsFamilyDocument:
			currentcat = projectdoc.OwnerFamily.FamilyCategory.Name
		else:
			currentcat = "Project"
		if tovoid:
			isCuts = True
		if famcategory == "Mass":
			if subcategory == "" or subcategory == None:
				subcategory = "Form"
				subcategorymat = None
		if currentcat == "Mass" and famcategory != "Mass":
			isShared = True
			doublefamilies = False
		elif currentcat == "Mass" and famcategory == "Mass":
			isShared = False
			doublefamilies = False
		elif currentcat == "Project" and famcategory != "Mass":
			doublefamilies = False
		elif currentcat == "Project" and famcategory == "Mass":
			doublefamilies = True
		if revitversion < 2021 and autoalternative:
			dynaproc = True
			oldrevitmessage = "You Are Using Old Revit Version\nForced Alternative Sync Method\n\nYou Can Disable Forcing By Disabling\n'Auto Alternative Sync Method' Option"

	# Force Disable Double Families If Not In Project
	if projectdoc.IsFamilyDocument:
		doublefamilies = False
	
	# Force Unshare If Double Families Is On
	if doublefamilies:
		isShared = False
	
	# Check If Input Geometry is Safe	
	if geoms[0] != None and geoms[0] != []:
		#TransactionManager.Instance.ForceCloseTransaction()
		#tGroup = TransactionGroup(projectdoc, 'K-Inserting Families')
		#tGroup.Start()
		
		# Family Saving Options
		SaveAsOpt = SaveAsOptions()
		SaveAsOpt.OverwriteExistingFile = True
		
		# Import and Geometry Options
		impOpt = SATImportOptions()
		opt1 = Options()
			
		# Main Run
		danger_status = []
		message = False
		if onefam:
			operate = mainOP(geoms,dynaproc,famname,famnumber,autoavoidconflict,famcategory,fam_path,isShared,isWorkplane,isVertical,isCuts,tovoid,material,isonemat,ismatinstance,matparamname,subcategory,subcategorymat,overwrite,projectdoc,SaveAsOpt,impOpt,opt1,temp_path,separator,selforigin,unitfactor,doublefamilies,joinsurfs,joinsolids,version,autoalternative,docimportmethod,bypasscheck)
			danger_rep = operate[-1]
			operate = operate[:-1]
			if danger_rep:
				if revitversion < 2022:
					danger_status.append("Detected Geometry Problem\nForced Alternative Sync Method\n\nYou Can Disable Forcing By Disabling\n'Auto Alternative Sync Method' Option\n\nAffected Family:")
				else:
					danger_status.append("Detected Geometry Problem\nSome Geometry Got Exploded\n\nAffected Family:")
				danger_status.append(operate[0].Name)
				danger_status = danger_status
				message = "\n".join(danger_status)
			elif onefam_message:
				message = onefam_message
			elif oldrevitmessage:
				message = oldrevitmessage
		else:
			operate = []
			dan_names = []
			count = 0
			for famnumber in famnumbers:
				geom = [geoms[count]]
				count += 1
				mainoperate = mainOP(geom,dynaproc,famname,famnumber,autoavoidconflict,famcategory,fam_path,isShared,isWorkplane,isVertical,isCuts,tovoid,material,isonemat,ismatinstance,matparamname,subcategory,subcategorymat,overwrite,projectdoc,SaveAsOpt,impOpt,opt1,temp_path,separator,selforigin,unitfactor,doublefamilies,joinsurfs,joinsolids,version,autoalternative,docimportmethod,bypasscheck)
				danger_rep = mainoperate[-1]
				if danger_rep:
					dan_names.append(mainoperate[0].Name)
				operate.append(mainoperate[:-1])
			if len(dan_names) != 0:
				if revitversion < 2022:
					danger_status.append("Detected Geometry Problem\nForced Alternative Sync Method\n\nYou Can Disable Forcing By Disabling\n'Auto Alternative Sync Method' Option\n\nAffected Families:")
				else:
					danger_status.append("Detected Geometry Problem\nSome Geometry Got Exploded\n\nAffected Families:")
				danger_status = danger_status + dan_names
				message = "\n".join(danger_status)
			elif onefam_message:
				message = onefam_message
			elif oldrevitmessage:
				message = oldrevitmessage
			operate = [list(i) for i in zip(*operate)]
		# House Clean Up
		housecleanup(projectdoc,cleanlist)
		
		# Check If There Is Message
		if message and showmessages:
			TransactionManager.Instance.ForceCloseTransaction()
			trans1 = Transaction(projectdoc, 'Show Message')
			trans1.Start()
			TaskDialog.Show("AECedx - Karam", message)
			trans1.Commit()
		#tGroup.Assimilate()
		SaveAsOpt.Dispose()
		impOpt.Dispose()
		opt1.Dispose()
		OUT = operate
	else:
		OUT = "ERROR"
else:
	OUT = IN[0]
# ----------------------------------------
code_block_40 = CodeBlock(a=python_script_2) { a[0]; a[1]; a[2]; a[3]; }
code_block_41 = CodeBlock(VARFamily=code_block_40.out0) { VARFamily; }
code_block_42 = CodeBlock(VARFamilyType=code_block_40.out1) { VARFamilyType; }
code_block_43 = CodeBlock(VARFamilyNumber=code_block_40.out3) { VARFamilyNumber; }
code_block_44 = CodeBlock(VARFamilyInstancesOrImportSymbols=code_block_40.out2) { VARFamilyInstancesOrImportSymbols; }
