# Dynamo graph 2023.07.19-VIEW-CREATING ELEVATIONS FROM WALL OR ELEMENT.DYN "BinhDUONG - View - Elevations From Wall or Element" (Dynamo 2.12.1.8246)

boolean = BoolSelector(true)
select_model_element = DSModelElementSelection()  # 1 picked in the model; graph input
getLocation = Element.GetLocation(element=select_model_element)
code_block = CodeBlock { 0.5; }
coordinateSystemAtParameter = Curve.CoordinateSystemAtParameter(curve=getLocation, param=code_block)
byCartesianCoordinates = Point.ByCartesianCoordinates(coordinateSystem=coordinateSystemAtParameter)
XAxis = CoordinateSystem.XAxis(coordinateSystem=coordinateSystemAtParameter)
offset_inner_face = DoubleSlider(1000, range=-2000..2000 step 0.1)  # graph input
translate = Geometry.Translate(geometry=byCartesianCoordinates, direction=XAxis, distance=offset_inner_face)
view_family_types = ViewFamilyTypes("Interior Elevation")  # graph input
python_script = Python(IN[0]=boolean, IN[1]=translate, IN[2]=byCartesianCoordinates, IN[3]=select_model_element, IN[4]=view_family_types)  # IronPython2
# ---------- python_script.python (83 lines) ----------
import clr
import sys
from math import *
import System
clr.AddReference('ProtoGeometry')
from Autodesk.DesignScript.Geometry import *
import Autodesk.DesignScript.Geometry as DS

clr.AddReference('RevitAPI')
import Autodesk
from Autodesk.Revit.DB import *

from System.Collections.Generic import List

clr.AddReference('RevitNodes')
import Revit
clr.ImportExtensions(Revit.GeometryConversion)

clr.AddReference('RevitServices')
import RevitServices
from RevitServices.Persistence import DocumentManager
from RevitServices.Transactions import TransactionManager
doc = DocumentManager.Instance.CurrentDBDocument

def getFaceloop(wall):
	lstref = HostObjectUtils.GetSideFaces(wall, ShellLayerType.Interior)
	for ref in lstref:
		face = wall.GetGeometryObjectFromReference(ref)
		edgLoopArr = face.EdgeLoops
		for lstEdg in edgLoopArr:
			lstCurvDS = [x.AsCurve().ToProtoType() for x in lstEdg]
			polycurvDS = DS.PolyCurve.ByJoinedCurves(lstCurvDS)
			lstCurv = List[Curve]([x.ToRevitType() for x in polycurvDS.Curves()])
			curvLoop = CurveLoop.Create(lstCurv)
			return curvLoop
			
toggle = IN[0]
point = UnwrapElement(IN[1])
modelPoint = UnwrapElement(IN[2])
wall =  UnwrapElement(IN[3])
viewType = UnwrapElement(IN[4])

#get propreties
curvloopWall = getFaceloop(wall)
lst = []

TransactionManager.Instance.EnsureInTransaction(doc)
	
#Retrieve the mid point of model lines and get X,Y.		
modelMP = modelPoint.ToXyz()
modelMPX = modelMP.X
modelMPY = modelMP.Y
					
# Create a line in the z-Axis for elevation marker to rotate around.	
elevationPT = point.ToXyz()
elptRotate = XYZ(elevationPT.X, elevationPT.Y, elevationPT.Z+100)
ln = Line.CreateBound(elevationPT, elptRotate)

#Calculate the angle between Model Mid Point and Elevation Point.
elevationPTY = elevationPT.Y
elevationPTX = elevationPT.X							
combY = elevationPTY-modelMPY
combX = elevationPTX-modelMPX			
ang = atan2(combY, combX)

#Create elevation marker and elevation in position 0.
eleMarker = ElevationMarker.CreateElevationMarker(doc, viewType.Id, elevationPT, 100)
ele = eleMarker.CreateElevation(doc, doc.ActiveView.Id , 0)
		
#Rotate elevation marker towars model line.
ElementTransformUtils.RotateElement(doc, eleMarker.Id, ln, ang)	
crManager = ele.GetCropRegionShapeManager()

try:			
	crManager.SetCropShape(curvloopWall)
	lst.append("Elevation Created")
		
except:
	pass
	lst.append("Missed Elevation")

TransactionManager.Instance.TransactionTaskDone()
OUT = lst
# ----------------------------------------
