# Dynamo graph 2023.07.20-A-FAMILY-STANDARDIZATION WITH CATALOGUE OF ALL EXISTING FLOOR TYPES.DYN "00BinhDUONG - Floor - Standardization with catalogue of all existing floor types" (Dynamo 2.12.1.8246)

select_location_line = DSModelElementSelection()  # 1 picked in the model; graph input
geometry = Element.Geometry(element=select_location_line)
startPoint = Curve.StartPoint(curve=geometry)
code_block = CodeBlock(x=startPoint) { x.X; x.Y; x.Z; }
code_block_2 = CodeBlock { 1; }
segmentLengthAtParameter = Curve.SegmentLengthAtParameter(curve=geometry, parameter=code_block_2)
space = DoubleSlider(3000, range=500..10000 step 100)  # graph input
code_block_3 = CodeBlock(x=segmentLengthAtParameter, y=space) { x/y; }
floor = Math.Floor(number=code_block_3)
sequence = Sequence(amount=floor, step=space)
add = code_block.out0 + sequence@L1
flatten = List.Flatten(list=add)
code_block_4 = CodeBlock(x=sequence) { x*-1; }
add_2 = code_block.out1 + code_block_4@L1
flatten_2 = List.Flatten(list=add_2)
byCoordinates = Point.ByCoordinates(x=flatten, y=flatten_2, lacing=CrossProduct)
transpose = List.Transpose(lists=byCoordinates)
flatten_3 = List.Flatten(list=transpose)
watch = Watch(flatten_3)
size_of_square = DoubleSlider(2000, range=0..5000 step 100)  # graph input
code_block_5 = CodeBlock(x=watch, dis=size_of_square) { x.X+dis; x.Y; x.Z; }
byCoordinates_2 = Point.ByCoordinates(x=code_block_5.out0, y=code_block_5.out1, z=code_block_5.out2)
code_block_6 = CodeBlock(x=watch, dis=size_of_square) { x.X+dis; x.Y-dis; x.Z; }
byCoordinates_3 = Point.ByCoordinates(x=code_block_6.out0, y=code_block_6.out1, z=code_block_6.out2)
code_block_7 = CodeBlock(x=watch, dis=size_of_square) { x.X; x.Y-dis; x.Z; }
byCoordinates_4 = Point.ByCoordinates(x=code_block_7.out0, y=code_block_7.out1, z=code_block_7.out2)
list_create = List.Create(item0=watch, item1=byCoordinates_2, item2=byCoordinates_3, item3=byCoordinates_4)
transpose_2 = List.Transpose(lists=list_create)
element_types = ElementTypes("FloorType")  # graph input
all_elements_of_type = ElementsOfType(element_type=element_types)
count = List.Count(list=all_elements_of_type)
takeItems = List.TakeItems(list=transpose_2, amount=count)
byCornerPoints = Rectangle.ByCornerPoints(points=takeItems)
curves = PolyCurve.Curves(polyCurve=byCornerPoints)
levels = Levels("L0 - Ground Floor FFL")
byOutlineTypeAndLevel = Floor.ByOutlineTypeAndLevel(outlineCurves=curves, floorType=all_elements_of_type, level=levels)
