# Dynamo graph 2023.07.26-B-PURGE-DEEP PURGE MODEL.DYN "ORI_R2023_DEEP PURGE MODEL" (Dynamo 2.16.1.2727)
# packages: Genius Loci 2022.6.16, Data-Shapes 2022.2.103

# group: GET ALL VIEWS, SCHEDULES, LEGENDS AND SHEETS
collector_of_views = Custom[Collector of Views]()  # package Genius Loci; Collects all views in the active or given document.

# group: VIEWS LIST UI
code_block = CodeBlock { "VIEWS TO KEEP"; true; false; }
name = Element.Name(element=collector_of_views.View)
listview_data = Custom[Listview Data](InputName=code_block.out0, Keys=name, Values=collector_of_views.View, SortItems_optionnal=code_block.out1, ShowId_optionnal=code_block.out2)  # package Data-Shapes; Create data for ListView input in UI.MultiInputForm ++ . Check out www.data-shapes.net for more infos.

# group: SCHEDULES LIST UI
code_block_2 = CodeBlock { "SCHEDULES TO KEEP"; true; false; 100; }
name_2 = Element.Name(element=collector_of_views.Schedule)
listview_data_2 = Custom[Listview Data](InputName=code_block_2.out0, Keys=name_2, Values=collector_of_views.Schedule, Height_optionnal=code_block_2.out3, SortItems_optionnal=code_block_2.out1, ShowId_optionnal=code_block_2.out2)

# group: LEGENDS LIST UI
code_block_3 = CodeBlock { "LEGENDS  TO KEEP"; true; false; 100; }
name_3 = Element.Name(element=collector_of_views.Legend)
listview_data_3 = Custom[Listview Data](InputName=code_block_3.out0, Keys=name_3, Values=collector_of_views.Legend, Height_optionnal=code_block_3.out3, SortItems_optionnal=code_block_3.out1, ShowId_optionnal=code_block_3.out2)

# group: SHEETS LIST UI
code_block_4 = CodeBlock { "SHEETS TO KEEP"; true; false; }
name_4 = Element.Name(element=collector_of_views.Sheet)
listview_data_4 = Custom[Listview Data](InputName=code_block_4.out0, Keys=name_4, Values=collector_of_views.Sheet, SortItems_optionnal=code_block_4.out1, ShowId_optionnal=code_block_4.out2)

# group: MAIN UI
code_block_5 = CodeBlock { true; 350; 100; "PROCEED"; "CANCEL"; }
list_create = List.Create(item0=listview_data, item1=listview_data_2, item2=listview_data_3, item3=listview_data_4)
multipleinputform = Custom[MultipleInputForm ++](ButtonText_optional=code_block_5.out3, Inputs=list_create, Toggle=code_block_5.out0, CancelButtonText_optional=code_block_5.out4, Width_optional=code_block_5.out1, LabelWidth_optional=code_block_5.out2)  # package Data-Shapes; Create a form with multiple inputs. see www.data-shapes.net for tutorials and infos!
code_block_6 = CodeBlock(X=multipleinputform.User_Inputs) { X[0]; X[1]; X[2]; X[3]; }

# group: REMOVE SELECTED VIEWS FROM THE LIST
indexOf = List.IndexOf(list=collector_of_views.View, element=code_block_6.out0)
removeItemAtIndex = List.RemoveItemAtIndex(list=collector_of_views.View, indices=indexOf)

# group: REMOVE SELECTED SCHEDULES FROM THE LIST
indexOf_2 = List.IndexOf(list=collector_of_views.Schedule, element=code_block_6.out1)
removeItemAtIndex_2 = List.RemoveItemAtIndex(list=collector_of_views.Schedule, indices=indexOf_2)

# group: REMOVE SELECTED LEGENDS FROM THE LIST
indexOf_3 = List.IndexOf(list=collector_of_views.Legend, element=code_block_6.out2)
removeItemAtIndex_3 = List.RemoveItemAtIndex(list=collector_of_views.Legend, indices=indexOf_3)

# group: REMOVE SELECTED SHEETS FROM THE LIST
indexOf_4 = List.IndexOf(list=collector_of_views.Sheet, element=code_block_6.out3)
removeItemAtIndex_4 = List.RemoveItemAtIndex(list=collector_of_views.Sheet, indices=indexOf_4)

# group: DELETE UNSELECTED ELEMENTS
list_create_2 = List.Create(item0=removeItemAtIndex, item1=removeItemAtIndex_2, item2=removeItemAtIndex_3, item3=removeItemAtIndex_4)
flatten = List.Flatten(list=list_create_2)
clean = List.Clean(list=flatten)
delete_elements = Custom[Delete Elements](element=clean)  # package Genius Loci; Delete the input list of elements from the given Revit document. The node returns the number of successfully deleted elements and their Ids as a string. Based on a Springs node

# group: DEEP CLEAN THE MODEL
boolean = BoolSelector(true)
code_block_7 = CodeBlock(x=boolean, waitfor=delete_elements.deletedIds_str) { [x,waitfor][0]; }
purge_unused = Custom[Purge Unused](RunIt=code_block_7, Deeply=boolean)  # package Genius Loci; Purge the document completely including materials an assets using the API. The optional input "deeply" allows to purge unused view templates, unused view filters, imported line Patterns from DWG and "Imports in Families" Object Styles. Can be used with documents open in the background. Works only in Revit 2017 and later.
