# Dynamo graph 2023.07.26-B-VIEW-FLOOR PLAN BY ROOMS.DYN "ORI_R2023_FLOOR-PLAN-BY-ROOMS" (Dynamo 2.13.1.3887)
# author: Revit Dynamo | Andrey Kim
# Create Plans by Selected Rooms and Apply View Template
# packages: archi-lab.net 2023.213.1523

select_rooms_in_revit_should_be = DSModelElementsByCategorySelection("OST_Rooms")  # "Select Rooms in Revit (Should be visible in view)"; 1 picked in the model; graph input
prefix = StringInput("ORI")  # graph input
room_crop_offset = IntegerSlider(4, range=0..10 step 1)  # graph input
toggle = BoolSelector(true)  # graph input
byRoom = Custom[FloorPlan.ByRoom](room=select_rooms_in_revit_should_be, prefix=prefix, offset=room_crop_offset, runIt=toggle)  # package archi-lab.net; This node takes input of a Room and creates a Floor Plan View with Crop Box set around that room.
view_templates = ViewTemplatesUi("RD_Plan_Pres_Blueprint")  # graph input
setViewTemplate = archilab.Revit.Views.Views.SetViewTemplate(view=byRoom, viewTemplate=view_templates)
