# Dynamo graph 2023.07.26-C-CAD-CLEAN UP IMPORTED AND LINKED ACAD-V3.DYN "ORI_R2023_DELETE IMPORTED AND LINKED DWGs" (Dynamo 2.13.1.3887)
# packages: bimorphNodes 4.2.1, Data-Shapes 2022.2.103, archi-lab.net 2023.213.1523

# group: 1. Get All DWG Files in the Current Project
# note: Custom Node: BimorphNodesv.4.2.1
reportInstances = Revit.ImportInstance.ReportInstances()

# group: 2. Split Linked and Imported DWGs
# note: Custom Node: BimorphNodesv.4.2.1
isLinked = Revit.ImportInstanceReport.IsLinked(importInstanceReport=reportInstances)
filterByBoolMask = List.FilterByBoolMask(list=reportInstances, mask=isLinked)

# group: 3. List View of Imported DWGs Input
code_block = CodeBlock { "All Imported DWGs"; 250; }
# note: Custom Node: BimorphNodesv.4.2.1
name = Revit.ImportInstanceReport.Name(importInstanceReport=filterByBoolMask.out)
importInstance = Revit.ImportInstanceReport.ImportInstance(importInstanceReport=filterByBoolMask.out)
boolean = BoolSelector(true)
# note: Custom Node: Data-Shapesv.2022.2.103
listview_data = Custom[Listview Data](InputName=code_block.out0, Keys=name, Values=importInstance, Height_optionnal=code_block.out1, ShowElementCount_optionnal=boolean)  # package Data-Shapes; Create data for ListView input in UI.MultiInputForm ++ . Check out www.data-shapes.net for more infos.

# group: 4. List View of Linked DWGs Input
code_block_2 = CodeBlock { "All Linked DWGs"; 250; }
# note: Custom Node: BimorphNodesv.4.2.1
name_2 = Revit.ImportInstanceReport.Name(importInstanceReport=filterByBoolMask.in)
importInstance_2 = Revit.ImportInstanceReport.ImportInstance(importInstanceReport=filterByBoolMask.in)
boolean_2 = BoolSelector(true)
# note: Custom Node: Data-Shapesv.2022.2.103
listview_data_2 = Custom[Listview Data](InputName=code_block_2.out0, Keys=name_2, Values=importInstance_2, Height_optionnal=code_block_2.out1, ShowElementCount_optionnal=boolean_2)

# group: 5. Main UI Window
code_block_3 = CodeBlock { "Delete DWGs"; "Delete"; "Cancel"; 600; }
list_create = List.Create(item0=listview_data, item1=listview_data_2)
boolean_3 = BoolSelector(true)
# note: Custom Node: Data-Shapesv.2022.2.103
multipleinputform = Custom[MultipleInputForm ++](Description_optional=code_block_3.out0, ButtonText_optional=code_block_3.out1, Inputs=list_create, Toggle=boolean_3, CancelButtonText_optional=code_block_3.out2, Width_optional=code_block_3.out3)  # package Data-Shapes; Create a form with multiple inputs. see www.data-shapes.net for tutorials and infos!

# group: 6. Delete Selected DWGs
# note: Custom Node: archilab
delete = archilab.Revit.Elements.Elements.Delete(element=multipleinputform.User_Inputs)
