# Dynamo graph 2023.09.25-FLOOR-CREATE THE FLOORS AS PLAIN CEMENT CONCRETE.DYN "Modeling - Create the floors as Plain Cement Concrete" (Dynamo 2.12.1.8246)
# packages: Genius Loci 2022.9.16

element_level = Custom[Element Level]()  # package Genius Loci; Gets an element's level. Based on a Clockwork's node; unwired: element
select_model_elements = DSModelElementsSelection()  # 4 picked in the model; graph input

# group: Get Closest Level of elements
closest_level = Python(IN[0]=select_model_elements)  # IronPython2
# ---------- closest_level.python (68 lines) ----------
#Alban de Chasteigner 2020
#twitter : @geniusloci_bim
#geniusloci.bim@gmail.com
#https://github.com/albandechasteigner/GeniusLociForDynamo

import clr
clr.AddReference("RevitAPI")
import Autodesk
from Autodesk.Revit.DB import *

clr.AddReference("RevitServices")
import RevitServices
from RevitServices.Persistence import DocumentManager
doc = DocumentManager.Instance.CurrentDBDocument

items = UnwrapElement(IN[0]) if isinstance(IN[0],list) else [UnwrapElement(IN[0])]
search = []

levels = FilteredElementCollector(doc).OfClass(Level).ToElements()
sortedLevels = sorted(levels,key=lambda level : level.Elevation, reverse=True)

def closest(sortedLevels, number): 
	try:
		result= min([level for level in sortedLevels if level.ProjectElevation <= number], key=lambda x: abs(x.ProjectElevation-number))
	except:
		result= min([level for level in sortedLevels if level.ProjectElevation >= number], key=lambda x: abs(x.ProjectElevation-number))
	return result
	
for item in items:
	if hasattr(item, "Location") :
		loc = item.Location
		if loc:
			# line-based elements (e.g. walls)
			if isinstance(loc,LocationCurve):
				try:elementZ=loc.Curve.Evaluate(0.5, True).Z
				except:elementZ=loc.Curve.Evaluate(0.5, False).Z
			# point-based elements (e.g. most loadable families)
			elif isinstance(loc,LocationPoint):
				elementZ=loc.Point.Z
			elif isinstance(item,Instance):
				elementZ = item.GetTotalTransform().Origin.Z
			elif hasattr(item, "Origin"):
				elementZ = item.Origin.Z
			##Section Marker and ReferenceElevationMarker(Doesn't work for ReferenceElevationMarker)
			elif ElementId(BuiltInCategory.OST_Viewers) == item.Category.Id :
				viewSection = doc.GetElement(ElementId(element.Id.IntegerValue + 1))
				elementZ = viewSection.Origin.Z
			#Elevation Marker
			elif isinstance(item,Autodesk.Revit.DB.ElevationMarker) :
				marker = doc.GetElement(ElementId(item.Id.IntegerValue + 1))
				box=marker.BoundingBox[doc.ActiveView]
				elementZ = ((box.Min+box.Max)/2).Z
			# Grid	
			elif isinstance(item,Autodesk.Revit.DB.Grid):
				elementZ=item.Curve.Evaluate(0.5,True).Z
			# view specific elements (e.g. filled regions)
			elif hasattr(item, "OwnerViewId") and item.OwnerViewId != ElementId.InvalidElementId :
				view=item.Document.GetElement(item.OwnerViewId)
				box = item.BoundingBox[view]
				elementZ = ((box.Min+box.Max)/2).Z
			# sketch-based elements (e.g. floors)
			else :
				box = item.get_BoundingBox(None)
				elementZ = box.Max.Z
		try:search.append(closest(sortedLevels, elementZ))
		except:search.append(None)

OUT = search
# ----------------------------------------
code_block = CodeBlock(level=closest_level) { level; }

watch = Watch(code_block)

# group: Element Level
element_level_2 = Python(IN[0]=select_model_elements)  # IronPython2
# ---------- element_level_2.python (77 lines) ----------
import clr
clr.AddReference('RevitAPI')
from Autodesk.Revit.DB import *

clr.AddReference("RevitNodes")
import Revit
clr.ImportExtensions(Revit.Elements)

#Definition by Daniel Woodcock
def get_sketch_ids(item):
	eIds = []
	t = Transaction(item.Document, "Temp")
	t.Start()   
	eIds = item.Document.Delete(item.Id) 
	t.RollBack()  
	return eIds
	
#Inspired by Clockwork
def GetLevel(item):
	val = None
	doc = item.Document
	if hasattr(item, "LevelId"): 
		val = doc.GetElement(item.LevelId)
		if val: return val
	if hasattr(item, "Level"):
		val = item.Level
		if val: return val
	if hasattr(item, "GenLevel"):
		val = item.GenLevel
		if val: return val
	if (item.GetType().ToString() in ("Autodesk.Revit.DB.Architecture.StairsRun", "Autodesk.Revit.DB.Architecture.StairsLanding")):
		item = item.GetStairs()
	if (item.GetType().ToString() == "Autodesk.Revit.DB.Architecture.Stairs") or item.Category.Id == ElementId(BuiltInCategory.OST_Ramps):
		try: return doc.GetElement(item.get_Parameter(BuiltInParameter.STAIRS_BASE_LEVEL_PARAM).AsElementId())
		except: pass
	if (item.GetType().ToString() == "Autodesk.Revit.DB.ExtrusionRoof"):
		try: return doc.GetElement(item.get_Parameter(BuiltInParameter.ROOF_CONSTRAINT_LEVEL_PARAM).AsElementId())
		except: pass
	if (item.GetType().ToString() == "Autodesk.Revit.DB.Mechanical.Duct" or "Autodesk.Revit.DB.Electrical.Conduit"):
		try: return doc.GetElement(item.get_Parameter(BuiltInParameter.RBS_START_LEVEL_PARAM).AsElementId())
		except: pass
	if hasattr(item, "OwnerViewId"):
		view = doc.GetElement(item.OwnerViewId)
		if hasattr(view, "GenLevel"):
			val = view.GenLevel
			if val: return val
	if not val:
		collector = FilteredElementCollector(doc).OfClass(Level).ToElements()
		if isinstance(item,FamilyInstance) and item.Symbol.Family.IsInPlace:
			ids = get_sketch_ids(item)
			elems = [doc.GetElement(id) for id in ids]
			lName = next((ex.get_Parameter(BuiltInParameter.SKETCH_PLANE_PARAM).AsString() for ex in elems if ex.GetType() == Extrusion), None)
			try: return [level for level in FilteredElementCollector(doc).OfClass(Level).ToElements() if lName.split(": ")[-1] == level.Name][0]
			except: return None
		else:
			try: return doc.GetElement(item.get_Parameter(BuiltInParameter.INSTANCE_REFERENCE_LEVEL_PARAM).AsElementId())
			except: 
				try: return doc.GetElement(item.get_Parameter(BuiltInParameter.INSTANCE_SCHEDULE_ONLY_LEVEL_PARAM).AsElementId())
				except: 
					try: return doc.GetElement(item.get_Parameter(BuiltInParameter.SCHEDULE_LEVEL_PARAM).AsElementId())
					except:
						#if item is work plane based
						try: return [level for level in collector if item.get_Parameter(BuiltInParameter.SKETCH_PLANE_PARAM).AsString().split(": ")[-1] == level.Name][0]
						except: return None

ProcessLists = lambda function, lists: [ProcessLists(function, item) if isinstance(item, list) else function(item) for item in lists]
ApplyFunction = lambda func, objs: ProcessLists(func, objs) if isinstance(objs, list) else [func(objs)]

def Unwrap(item):
    return UnwrapElement(item)
    
if isinstance(IN[0], list):
	items = ProcessLists(Unwrap, IN[0])
else:
	items = Unwrap(IN[0])

OUT=ApplyFunction(GetLevel,items)
# ----------------------------------------
code_block_2 = CodeBlock(level=element_level_2) { level; }

watch_2 = Watch(code_block_2)
elevation = Level.Elevation(level=watch_2)
geometry = Element.Geometry(element=select_model_elements)
flatten = List.Flatten(list=geometry)
bySolid = PolySurface.BySolid(solid=flatten)
surfaces = PolySurface.Surfaces(polySurface=bySolid)
code_block_3 = CodeBlock { 0.5; }
pointAtParameter = Surface.PointAtParameter(surface=surfaces, u=code_block_3, v=code_block_3)
Z = Point.Z(point=pointAtParameter)
minimumItem = List.MinimumItem(list=Z@@L2)
indexOf = List.IndexOf(list=Z@@L2, element=minimumItem@L1)
getItemAtIndex = List.GetItemAtIndex(list=surfaces@L2, index=indexOf, lacing=Shortest)
perimeterCurves = Surface.PerimeterCurves(surface=getItemAtIndex@L1)
byJoinedCurves = PolyCurve.ByJoinedCurves(curves=perimeterCurves@@L2)
offset = DoubleInput(50)  # graph input
boolean = BoolSelector(false)
offset_2 = PolyCurve.Offset(polyCurve=byJoinedCurves, signedDistance=offset, extendCircular=boolean)
byJoinedCurves_2 = PolyCurve.ByJoinedCurves(curves=offset_2@@L1)
floor_types = FloorTypes("75mm thk pcc")  # graph input
count = List.Count(list=offset_2)
cycle = List.Cycle(list=floor_types, amount=count)
byOutlineTypeAndLevel = Floor.ByOutlineTypeAndLevel(outline=byJoinedCurves_2, floorType=cycle, level=watch_2)
string = StringInput("Height Offset From Level")
projectElevation = Level.ProjectElevation(level=watch_2)
code_block_4 = CodeBlock(x=minimumItem, y=projectElevation) { x-y; }
setParameterByName = Element.SetParameterByName(element=byOutlineTypeAndLevel, parameterName=string, value=code_block_4)
