# Dynamo graph 2024.01.09-WALL-OPENING FOR PIPE  BASE ON INTERFERENCE CHECK REPORT (ROUND)-V1.DYN "02BinhDUONG - Wall - Opening for Pipe (Round)-V1" (Dynamo 2.12.1.8246)

family_types = FamilyTypes("NIA-AR-GEN-Wall_Void:Void Instance Size")  # graph input

# group: Taking Interface report to get ID
file_path = Filename("New folder\YIAPL-E1-PH1-GC-T1-ARIN-M3-ZZ-100-G-1200-V2.html.csv")
importCSV = Data.ImportCSV(filePath=file_path)
watch = Watch(importCSV)

# group: Filter the Wall and Linked Element ID
code_block = CodeBlock { 0..6; }
removeItemAtIndex = List.RemoveItemAtIndex(list=watch@L2, indices=code_block)
watch_2 = Watch(removeItemAtIndex)
code_block_2 = CodeBlock(x=watch_2) { x[3]; x[4]; }
walls = Watch(code_block_2.out0)
ducts_pipes_linked_elements = Watch(code_block_2.out1)

element_by_id = ElementById(Id=walls)
solids = Element.Solids(element=element_by_id)
bySolid = PolySurface.BySolid(solid=solids)
surfaces = PolySurface.Surfaces(polySurface=bySolid)
code_block_3 = CodeBlock { 0.5; }
normalAtParameter = Surface.NormalAtParameter(surface=surfaces, u=code_block_3, v=code_block_3)
ZAxis = Vector.ZAxis()
isParallel = Vector.IsParallel(vector=normalAtParameter, otherVector=ZAxis)
filterByBoolMask = List.FilterByBoolMask(list=surfaces, mask=isParallel)
watch_3 = Watch(filterByBoolMask.out)
area = Surface.Area()  # unwired: surface
maximumItemByKey = List.MaximumItemByKey(list=watch_3@@L2, keyFunction=area)
watch_4 = Watch(maximumItemByKey)
flatten = List.Flatten(list=watch_4)
get_linked_elements_by_id = Python(IN[0]=ducts_pipes_linked_elements)  # "Get Linked Elements By ID(Integer)"; IronPython2
# ---------- get_linked_elements_by_id.python (42 lines) ----------
import clr

clr.AddReference("RevitAPIUI")
from  Autodesk.Revit.UI import *

clr.AddReference("RevitAPI")
from  Autodesk.Revit.DB import *

clr.AddReference("RevitServices")
import RevitServices
from RevitServices.Persistence import DocumentManager
doc = DocumentManager.Instance.CurrentDBDocument
uidoc=DocumentManager.Instance.CurrentUIApplication.ActiveUIDocument

clr.AddReference("RevitNodes")
import Revit
clr.ImportExtensions(Revit.Elements)

ids = []
linkedElements = []
c = 0
try:
	c = len(IN[0])
except:
	c = 1
if c > 1:
	for id in IN[0]:
		ids.Add(ElementId(id))
else:
	ids.Add(ElementId(IN[0]))

sel = uidoc.Selection
obType = Selection.ObjectType.Element

rLinkRef = sel.PickObject(obType, "Please Select a Revit Link")

rLink = doc.GetElement(rLinkRef.ElementId)
rLinkDoc = rLink.GetLinkDocument()

for id in ids:
	linkedElements.Add(rLinkDoc.GetElement(id).ToDSType(True))
OUT = linkedElements
# ----------------------------------------
geometry = Element.Geometry(element=get_linked_elements_by_id)
flatten_2 = List.Flatten(list=geometry)
intersect = Geometry.Intersect(geometry=flatten, other=flatten_2)
isEmpty = List.IsEmpty(list=intersect@L2)
filterByBoolMask_2 = List.FilterByBoolMask(list=element_by_id, mask=isEmpty)
watch_5 = Watch(filterByBoolMask_2.out)
filterByBoolMask_3 = List.FilterByBoolMask(list=intersect, mask=isEmpty)
byUnion = Surface.ByUnion(surfaces=filterByBoolMask_3.out@L2)

# group: Find the intersect point
flatten_3 = List.Flatten(list=byUnion@L3)
code_block_4 = CodeBlock { 0.5; }
pointAtParameter = Surface.PointAtParameter(surface=flatten_3@@L1, u=code_block_4, v=code_block_4, lacing=Longest)
flatten_4 = List.Flatten(list=pointAtParameter)
watch_6 = Watch(flatten_4)

byHostAndPoint = FamilyInstance.ByHostAndPoint(familyType=family_types, host=watch_5, point=watch_6)
watch_7 = Watch(byHostAndPoint)
flatten_5 = List.Flatten(list=watch_7)
string = StringInput("Width")  # graph input
filterByBoolMask_4 = List.FilterByBoolMask(list=get_linked_elements_by_id, mask=isEmpty)
watch_8 = Watch(filterByBoolMask_4.out)
string_2 = StringInput("Width")
getParameterValueByName = Element.GetParameterValueByName(element=watch_8, parameterName=string_2)
code_block_5 = CodeBlock(x=getParameterValueByName) { x+50; }
setParameterByName = Element.SetParameterByName(element=flatten_5, parameterName=string, value=code_block_5)
string_3 = StringInput("Height")  # graph input
string_4 = StringInput("Height")
getParameterValueByName_2 = Element.GetParameterValueByName(element=watch_8, parameterName=string_4)
code_block_6 = CodeBlock(x=getParameterValueByName_2) { x+50; }
setParameterByName_2 = Element.SetParameterByName(element=flatten_5, parameterName=string_3, value=code_block_6)
getLocation = Element.GetLocation(element=element_by_id)
string_5 = StringInput("Unconnected Height")
getParameterValueByName_3 = Element.GetParameterValueByName(element=element_by_id, parameterName=string_5)
extrude = Curve.Extrude(curve=getLocation, distance=getParameterValueByName_3)
area_2 = Surface.Area(surface=watch_3)
