# Dynamo graph 2024.01.25-WALL-PROVIDE OPENING FOR DUCT BASE ON INTERFERENCE CHECK REPORT (RECTANGE)-V1.DYN "01BinhDUONG - Wall - Opening for Duct (Rectange)-V1" (Dynamo 2.12.1.8246)
# packages: Bakery 2019.5.8

family_types = FamilyTypes("NIA-AR-GEN-Wall_Rectange_Opening:Wall_Rectange_Opening-Instance_Size")  # graph input
familyType = Watch(family_types)
file_path = Filename("..\New folder\WallvsDuct.html.csv")

# group: Taking Interface report to get ID
importCSV = Data.ImportCSV(filePath=file_path)
watch = Watch(importCSV)

# group: Filter the Wall and Linked Element ID
code_block = CodeBlock { 0..6; }
firstItem = List.FirstItem(list=watch)
count = List.Count(list=firstItem)
code_block_2 = CodeBlock(x=count) { [x-2,x-1]; }
list_create = List.Create(item0=code_block, item1=code_block_2)
flatten = List.Flatten(list=list_create)
removeItemAtIndex = List.RemoveItemAtIndex(list=watch@L2, indices=flatten)
watch_2 = Watch(removeItemAtIndex)
code_block_3 = CodeBlock(x=watch_2) { x[1]; x[2]; }
list_create_2 = List.Create(item0=code_block_3.out0, item1=code_block_3.out1)

watch_3 = Watch(list_create_2)

# group: Take ID only
code_block_4 = CodeBlock { "id"; }
indexOf = String.IndexOf(string=watch_3@@L1, searchFor=code_block_4)
code_block_5 = CodeBlock(x=indexOf) { x+2; }
length = String.Length(string=watch_3@@L1)
code_block_6 = CodeBlock(len=length, indexID=code_block_5) { len-indexID; }
substring = String.Substring(string=watch_3, startIndex=code_block_5, length=code_block_6)
watch_4 = Watch(substring)

code_block_7 = CodeBlock(x=watch_4) { x[0]; x[1]; }
walls = Watch(code_block_7.out0)
element_by_id = ElementById(Id=walls)
solids = Element.Solids(element=element_by_id)

# group: Filter error Walls
isEmpty = List.IsEmpty(list=solids@L2)
filterByBoolMask = List.FilterByBoolMask(list=solids, mask=isEmpty)
watch_5 = Watch(filterByBoolMask.out)

bySolid = PolySurface.BySolid(solid=watch_5)
surfaces = PolySurface.Surfaces(polySurface=bySolid)
code_block_8 = CodeBlock { 0.5; }
normalAtParameter = Surface.NormalAtParameter(surface=surfaces, u=code_block_8, v=code_block_8)
ZAxis = Vector.ZAxis()
isParallel = Vector.IsParallel(vector=normalAtParameter, otherVector=ZAxis)
filterByBoolMask_2 = List.FilterByBoolMask(list=surfaces, mask=isParallel)
watch_6 = Watch(filterByBoolMask_2.out)
area = Surface.Area()  # unwired: surface
maximumItemByKey = List.MaximumItemByKey(list=watch_6@@L2, keyFunction=area)
watch_7 = Watch(maximumItemByKey)
flatten_2 = List.Flatten(list=watch_7)
ducts_pipes_linked_elements = Watch(code_block_7.out1)

# group: Filter error Walls
filterByBoolMask_3 = List.FilterByBoolMask(list=ducts_pipes_linked_elements, mask=isEmpty)
watch_8 = Watch(filterByBoolMask_3.out)

toNumber = String.ToNumber(string=watch_8@L1)
get_linked_elements_by_id = Python(IN[0]=toNumber)  # "Get Linked Elements By ID(Integer)"; IronPython2
# ---------- get_linked_elements_by_id.python (42 lines) ----------
import clr

clr.AddReference("RevitAPIUI")
from  Autodesk.Revit.UI import *

clr.AddReference("RevitAPI")
from  Autodesk.Revit.DB import *

clr.AddReference("RevitServices")
import RevitServices
from RevitServices.Persistence import DocumentManager
doc = DocumentManager.Instance.CurrentDBDocument
uidoc=DocumentManager.Instance.CurrentUIApplication.ActiveUIDocument

clr.AddReference("RevitNodes")
import Revit
clr.ImportExtensions(Revit.Elements)

ids = []
linkedElements = []
c = 0
try:
	c = len(IN[0])
except:
	c = 1
if c > 1:
	for id in IN[0]:
		ids.Add(ElementId(id))
else:
	ids.Add(ElementId(IN[0]))

sel = uidoc.Selection
obType = Selection.ObjectType.Element

rLinkRef = sel.PickObject(obType, "Please Select a Revit Link")

rLink = doc.GetElement(rLinkRef.ElementId)
rLinkDoc = rLink.GetLinkDocument()

for id in ids:
	linkedElements.Add(rLinkDoc.GetElement(id).ToDSType(True))
OUT = linkedElements
# ----------------------------------------
watch_9 = Watch(get_linked_elements_by_id)
geometry = Element.Geometry(element=watch_9)
flatten_3 = List.Flatten(list=geometry)
intersect = Geometry.Intersect(geometry=flatten_2, other=flatten_3)
isEmpty_2 = List.IsEmpty(list=intersect@L2)
filterByBoolMask_4 = List.FilterByBoolMask(list=element_by_id, mask=isEmpty_2)
walls_get_by_id = Watch(filterByBoolMask_4.out)
filterByBoolMask_5 = List.FilterByBoolMask(list=intersect, mask=isEmpty_2)
byUnion = Surface.ByUnion(surfaces=filterByBoolMask_5.out@L2)

# group: Find the intersect point
flatten_4 = List.Flatten(list=byUnion@L3)
code_block_9 = CodeBlock { 0.5; }
pointAtParameter = Surface.PointAtParameter(surface=flatten_4@@L1, u=code_block_9, v=code_block_9, lacing=Longest)
flatten_5 = List.Flatten(list=pointAtParameter)
points = Watch(flatten_5)

byHostAndPoint = FamilyInstance.ByHostAndPoint(familyType=familyType, host=walls_get_by_id, point=points)  # frozen
watch_10 = Watch(byHostAndPoint)
flatten_6 = List.Flatten(list=watch_10)
string = StringInput("Width")  # graph input
filterByBoolMask_6 = List.FilterByBoolMask(list=watch_9, mask=isEmpty_2)
linked_elements = Watch(filterByBoolMask_6.out)
string_2 = StringInput("Width")
getParameterValueByName = Element.GetParameterValueByName(element=linked_elements, parameterName=string_2)
code_block_10 = CodeBlock(x=getParameterValueByName) { x+50*2; }
setParameterByName = Element.SetParameterByName(element=flatten_6, parameterName=string, value=code_block_10)
string_3 = StringInput("Height")  # graph input
string_4 = StringInput("Height")
getParameterValueByName_2 = Element.GetParameterValueByName(element=linked_elements, parameterName=string_4)
code_block_11 = CodeBlock(x=getParameterValueByName_2) { x+50*2; }
setParameterByName_2 = Element.SetParameterByName(element=flatten_6, parameterName=string_3, value=code_block_11)
area_2 = Surface.Area(surface=watch_6)
get_linked_rvt_documents = Custom[Get Linked RVT Documents]()  # package Bakery
watch_11 = Watch(get_linked_rvt_documents.Link_Name)
string_5 = StringInput("MEGN")  # frozen
contains = String.Contains(string=watch_11, searchFor=string_5)
watch_12 = Watch(contains)
code_block_12 = CodeBlock { true; }
firstIndexOf = List.FirstIndexOf(list=watch_12, item=code_block_12)
getItemAtIndex = List.GetItemAtIndex(list=get_linked_rvt_documents.Link_Doc, index=firstIndexOf)
watch_13 = Watch(getItemAtIndex)
firstItem_2 = List.FirstItem(list=watch_13)
code_block_13 = CodeBlock(linkdoclist=firstItem_2) { linkdoclist; }
code_block_14 = CodeBlock(elementIDlist=watch_8) { elementIDlist; }
get_element_from_doc_using = Custom[Get Element from Doc using Element Id](linkdoc=code_block_13, elementId=code_block_14)  # package Bakery; slow way to go
code_block_15 = CodeBlock(element=get_element_from_doc_using.Matching) { element; }
watch_14 = Watch(code_block_15)
code_block_16 = CodeBlock(item=firstItem_2) { item; }
select_model_element = DSModelElementSelection()  # 1 picked in the model
id = Element.Id(element=select_model_element)
get_linked_elements_by_id_2 = Python(IN[0]=toNumber, IN[1]=id)  # "Get Linked Elements By ID(Integer)"; IronPython2
# ---------- get_linked_elements_by_id_2.python (41 lines) ----------
import clr

clr.AddReference("RevitAPIUI")
from  Autodesk.Revit.UI import *

clr.AddReference("RevitAPI")
from  Autodesk.Revit.DB import *

clr.AddReference("RevitServices")
import RevitServices
from RevitServices.Persistence import DocumentManager
doc = DocumentManager.Instance.CurrentDBDocument
uidoc=DocumentManager.Instance.CurrentUIApplication.ActiveUIDocument

clr.AddReference("RevitNodes")
import Revit
clr.ImportExtensions(Revit.Elements)

ids = []
linkedElements = []
c = 0
try:
	c = len(IN[0])
except:
	c = 1
if c > 1:
	for id in IN[0]:
		ids.Add(ElementId(id))
else:
	ids.Add(ElementId(IN[0]))

sel = uidoc.Selection
obType = Selection.ObjectType.Element

rLinkRef = IN[1]
rLink = doc.GetElement(rLinkRef.ElementId)
rLinkDoc = rLink.GetLinkDocument()

for id in ids:
	linkedElements.Add(rLinkDoc.GetElement(id).ToDSType(True))
OUT = linkedElements
# ----------------------------------------
watch_15 = Watch(get_linked_elements_by_id_2)
