# Dynamo graph 2024.04.27-NIA_PIM-SELECTION ELEMENTS FROM A SCOPE BOX AND ASSIGN SCOPEBOX NAME TO A PARAMETER.DYN "NIA - PIM - Selection elements from a scope box and assign Scopebox name to a parameter" (Dynamo 2.12.1.8246)
# packages: Data-Shapes 2022.2.103

# group: WIP
# note: Notes not considered part of the final package

# group: DEBUG
# note: Nodes used to debug the graph logic

# group: SET
# note: Set parameter values of Revit objects

# group: OUTPUT
# note: Object creation in Revit, Final output

# group: FUNCTION
# note: Data manipulation on Dynamo objects

# group: INPUT
# note: Data input and preparation

# group: GET
# note: Get parameter values from Revit objects

code_block = CodeBlock { "BinhDUONG"; }

# group: GET ALL SCOPE BOXES IN MODEL
code_block_2 = CodeBlock { "Scope Boxes"; }
# note: Get parameter values from Revit objects
categories = Categories("OST_VolumeOfInterest")
all_elements_of_category = ElementsOfCategory(Category=categories)
name = Element.Name(element=all_elements_of_category)
listview_data = Custom[Listview Data](InputName=code_block_2, Keys=name, Values=all_elements_of_category)  # package Data-Shapes; Create data for ListView input in UI.MultiInputForm ++ . Check out www.data-shapes.net for more infos.

# group: GET CATEGORIES
code_block_3 = CodeBlock { "Category"; }
# note: Get parameter values from Revit objects
categories_2 = Categories("OST_SpecialityEquipment")
categories_3 = Categories("OST_PlumbingFixtures")
categories_4 = Categories("OST_Furniture")
categories_5 = Categories("OST_Casework")
categories_6 = Categories("OST_Doors")
categories_7 = Categories("OST_Windows")
list_create = List.Create(item0=categories_2, item1=categories_3, item2=categories_4, item3=categories_5, item4=categories_6, item5=categories_7)
string_from_object = FromObject(object=list_create)
dropdown_data = Custom[DropDown Data](InputName=code_block_3, Keys=string_from_object, Values=list_create)  # package Data-Shapes; Create data for DropDown input in UI.MultiInputForm ++ . Check out www.data-shapes.net for more infos.

# group: INPUT PARAMETER OF CATEGORY ELEMENTs
# note: Data input and preparation
code_block_4 = CodeBlock { "Parameter"; }
string = StringInput("NIA_GN_Tile Number")
textbox_data = Custom[TextBox Data](InputName=code_block_4, DefaultText=string)  # package Data-Shapes; Create Data for TextBox input in UI.MultipleInputForm ++ . Check out www.data-shapes.net for more informations

list_create_2 = List.Create(item0=listview_data, item1=dropdown_data, item2=textbox_data)
boolean = BoolSelector(true)
multipleinputform = Custom[MultipleInputForm ++](Description_optional=code_block, Inputs=list_create_2, Toggle=boolean)  # package Data-Shapes; Create a form with multiple inputs. see www.data-shapes.net for tutorials and infos!
code_block_5 = CodeBlock(x=multipleinputform.User_Inputs) { x[0]; x[1]; x[2]; }
watch = Watch(code_block_5.out1)
watch_2 = Watch(code_block_5.out0)

# group: FUNCTION SELECTING ALL ELEMENT IN SCOPE BOXIES
code_block_6 = CodeBlock(category=watch) { category: var[]..[]; }
boundingBox = Element.BoundingBox(element=watch_2)
# note: Data manipulation on Dynamo objects
code_block_7 = CodeBlock(boundingBox=boundingBox) { boundingBox: var[]..[]; }
code_block_8 = CodeBlock { null; }
select_by_category_bounding_box = Python(IN[0]=code_block_6, IN[1]=code_block_7, IN[2]=code_block_8)  # IronPython2
# ---------- select_by_category_bounding_box.python (62 lines) ----------
#By Einar_Raknes

import clr
clr.AddReference('RevitAPI')
clr.AddReference('System')
clr.AddReference('RevitNodes')
clr.AddReference('RevitServices')
import Revit
import RevitServices
from Autodesk.Revit.DB import *
from System.Collections.Generic import List
from RevitServices.Persistence import DocumentManager
clr.ImportExtensions(Revit.Elements)
clr.ImportExtensions(Revit.GeometryConversion)

#Functions for list handling
def ProcessList(_func, _list):
   return map( lambda x: ProcessList(_func, x) if type(x)==list else _func(x), _list )

#Preparing input from dynamo to revit
def ToRevit(item):
	return item.ToRevitType(True)

if isinstance(IN[0], list):
	cats = ProcessList(UnwrapElement, IN[0])
else:
	cats = [UnwrapElement(IN[0])]

if isinstance(IN[1], list):
	bblist = ProcessList(ToRevit, IN[1])
else:
	bblist = [ToRevit(IN[1])]

if isinstance(IN[0], list):
	inputdocs = ProcessList(UnwrapElement, IN[2])
else:
	inputdocs = [UnwrapElement(IN[2])]
	
#Part of script from Clockwork
for inputdoc in inputdocs :
	if inputdoc == None:
		doc = DocumentManager.Instance.CurrentDBDocument
	elif inputdoc.GetType().ToString() == "Autodesk.Revit.DB.Document":
		doc = inputdoc
	elif inputdoc.GetType().ToString() == "Autodesk.Revit.DB.RevitLinkInstance":
		doc = inputdoc.GetLinkDocument()
	else: doc = None

catlist = []
for cat in cats:
	catlist.append(cat.Id)
filtercats = List[ElementId](catlist)
catfilter = ElementMulticategoryFilter(filtercats)

def collectElementsInBB(bb):
	outline = Outline(bb.Min, bb.Max)
	bbfilter = BoundingBoxIntersectsFilter(outline)
	andfilter = LogicalAndFilter(catfilter,bbfilter)
	collector = FilteredElementCollector(doc).WherePasses(andfilter)
	return [e.ToDSType(True) for e in collector]

OUT = ProcessList(collectElementsInBB, bblist)
# ----------------------------------------
code_block_9 = CodeBlock(elements=select_by_category_bounding_box) { elements; }

# group: FUNCTION CLEAN THE VALUE
# note: Data manipulation on Dynamo objects
name_2 = Element.Name(element=code_block_5.out0)
code_block_10 = CodeBlock { -4; 4; }
substring = String.Substring(string=name_2, startIndex=code_block_10.out0, length=code_block_10.out1)

# group: OUTPUT
watch_3 = Watch(code_block_9)
watch_4 = Watch(code_block_5.out2)
watch_5 = Watch(substring)
# note: Object creation in Revit, Final output
setParameterByName = Element.SetParameterByName(element=watch_3, parameterName=watch_4, value=watch_5)

# group: NOTES
# note: GUIDELINES
# Read the instructions.
# Add Notes and Comments to the graph.
# Use Node Groups and the Standard Color Coding.
# Rename Nodes: <OriginalName> | <Description>.
# Write Input and Output Notes for Python Scripts.
# Prefer repeatable simple node structures.
# note: KNOWN ISSUES AND LIMITATIONS
# <ISSUES>
# <LIMITATIONS>
# note: INSTRUCTIONS
# <DESCRIPTIONS>
# <INSTRUCTIONS>
useful_links_ctrl_click_the_link = CodeBlock()  # "Useful Links | CTRL + Click the link below"
# ---------- useful_links_ctrl_click_the_link.designscript (2 lines) ----------
"http://primer.dynamobim.org/Appendix/A-3_packages.html";
"http://primer.dynamobim.org/13_Best-Practice/13-1_Introduction.html";
# ----------------------------------------
# note: GRAPH INFO
# Copyright 2019 Autodesk, Inc. All rights reserved.
# Company: Surbana Jurong
# Office: <office>
# Version: 1.0.0
# Author: <author>
# Keywords: [KEYWORDS]
# Tested on:
# Dynamo : 2.0.3
# Revit : 2019
python_script_reference_lib = Python()  # IronPython2; frozen; unwired: IN[0]
# ---------- python_script_reference_lib.python (37 lines) ----------
import clr

clr.AddReference('ProtoGeometry')
from Autodesk.DesignScript.Geometry import *

clr.AddReference('RevitAPI')
from Autodesk.Revit.DB import *
from Autodesk.Revit.DB.Structure import *

clr.AddReference('RevitAPIUI')
from Autodesk.Revit.UI import *

clr.AddReference('System')
from System.Collections.Generic import List

clr.AddReference('RevitNodes')
import Revit
clr.ImportExtensions(Revit.GeometryConversion)
clr.ImportExtensions(Revit.Elements)

clr.AddReference('RevitServices')
import RevitServices
from RevitServices.Persistence import DocumentManager
from RevitServices.Transactions import TransactionManager

doc = DocumentManager.Instance.CurrentDBDocument
uidoc=DocumentManager.Instance.CurrentUIApplication.ActiveUIDocument

# Preparing input from Dynamo to Revit
element = UnwrapElement(IN[0])

# Do some action in a Transaction
TransactionManager.Instance.EnsureInTransaction(doc)

TransactionManager.Instance.TransactionTaskDone()

OUT = element
# ----------------------------------------
