# Dynamo graph 2024.05.24-NIA_PIM-FIND THE ELEMENT IN ROOM (LINKED) AND FILL ELEMENT'S PARA VALUE FROM ROOM.DYN "NIA_PIM - Find the element in Room (Linked) and fill element's para value from Room" (Dynamo 2.12.1.8246)
# packages: bimorphNodes 4.2.1, Rhythm 2020.6.22, archi-lab.net 2021.25.7

# group: DEBUG
# note: Nodes used to debug the graph logic

# group: WIP
# note: Notes not considered part of the final package

# group: SET
# note: Set parameter values of Revit objects

# group: FUNCTION
# note: Data manipulation on Dynamo objects

# group: OUTPUT
# note: Object creation in Revit, Final output

# group: INPUT
# note: Data input and preparation

# group: GET
# note: Get parameter values from Revit objects

# group: INPUT
link_rooms_or_host_rooms = BoolSelector(false)  # graph input
# note: Data input and preparation
categories = Categories("OST_Rooms")
all_elements_of_category = ElementsOfCategory(Category=categories)

# group: INPUT
# note: Data input and preparation
links = Links("YIAPL-E1-PH1-GC-T1-ARGN-M3-ZZ-100-G-0100.rvt : 130 : location <Not Shared>")  # graph input

# group: GET
# note: Get parameter values from Revit objects
categories_2 = Categories("OST_Rooms")
ofCategory = Revit.LinkElement.OfCategory(linkInstance=links, category=categories_2)

if_ = RefactoredIf(test=link_rooms_or_host_rooms, true=ofCategory, false=all_elements_of_category)
watch = Watch(if_)

# group: INPUT
# note: Data input and preparation
parameter_name = StringInput("NIA_GN_Room Tag")  # graph input

code_block = CodeBlock(ParameterToAssign=parameter_name) { ParameterToAssign; }

# group: DEBUG
# note: Nodes used to debug the graph logic
getParameterValueByName = Revit.LinkElement.GetParameterValueByName(linkElement=watch, parameterName=code_block)  # frozen

# group: INPUT
# note: Data input and preparation
select_model_elements = DSModelElementsSelection()  # 84 picked in the model; graph input

watch_2 = Watch(select_model_elements)

# group: GET
# note: Get parameter values from Revit objects
elements_in_room = Custom[Elements in Room](elements=watch_2, rooms=watch)  # package archi-lab.net; This node will check if any of the elements are inside any of the supplied rooms.
isEmpty = List.IsEmpty(list=elements_in_room@L2)
filterByBoolMask = List.FilterByBoolMask(list=elements_in_room, mask=isEmpty)
getParameterValueByName_2 = Element.GetParameterValueByName(element=watch, parameterName=code_block)
filterByBoolMask_2 = List.FilterByBoolMask(list=getParameterValueByName_2, mask=isEmpty)

# group: SET
# note: Set parameter values of Revit objects
watch_3 = Watch(filterByBoolMask.out)
watch_4 = Watch(filterByBoolMask_2.out)
setParameterByName = Element.SetParameterByName(element=watch_3, parameterName=code_block, value=watch_4)

getParameterValueByName_3 = Element.GetParameterValueByName(element=setParameterByName, parameterName=code_block)
