# Dynamo graph 2024.06.17-SHEET-DELETE SHEET WITH VIEWPORTS.DYN "Sheet - Delete Sheet with views" (Dynamo 2.12.1.8246)
# packages: Data-Shapes 2022.2.103, Bakery 2019.5.8, Crumple 2022.5.27, LunchBox for Dynamo 2016.11.11

# group: Get parameters
string = StringInput("Sheets")
byName = Category.ByName(name=string)
all_elements_of_category = ElementsOfCategory(Category=byName)
firstItem = List.FirstItem(list=all_elements_of_category)
parameters = Element.Parameters(element=firstItem)
name = Parameter.Name(parameter=parameters)

# group: Build UI
code_block = CodeBlock { "Select filter parameters"; "Next step"; "Cancel"; 500; 500; }
code_block_2 = CodeBlock { "Sheet Parameter"; 0; }
dropdown_data = Custom[DropDown Data](InputName=code_block_2.out0, Keys=name, Values=name, DefaultValueIndex=code_block_2.out1)  # package Data-Shapes; Create data for DropDown input in UI.MultiInputForm ++ . Check out www.data-shapes.net for more infos.
boolean = BoolSelector(true)
ui_multipleinputform = Custom[UI.MultipleInputForm ++](Description_optional=code_block.out0, ButtonText_optional=code_block.out1, Inputs=dropdown_data, Toggle=boolean, CancelButtonText_optional=code_block.out2, MaxHeight_optional=code_block.out3, Width_optional=code_block.out4)  # package Data-Shapes; Create a form with multiple inputs. see www.data-shapes.net for tutorials and infos!

flatten = List.Flatten(list=ui_multipleinputform.User_Inputs)

# group: Get parameters, clean up lists
getParameterValueByName = Element.GetParameterValueByName(element=all_elements_of_category, parameterName=flatten, lacing=Longest)
uniqueItems = List.UniqueItems(list=getParameterValueByName)
string_2 = StringInput("")
eq = uniqueItems == string_2
filterByBoolMask = List.FilterByBoolMask(list=uniqueItems, mask=eq)

# group: Build List UI
code_block_3 = CodeBlock { "Select what to delete..."; "Delete!"; "Cancel"; 500; }
code_block_4 = CodeBlock { "Sheet Parameter"; 500; false; true; }
ui_listview_data = Custom[UI.Listview Data](InputName=code_block_4.out0, Keys=filterByBoolMask.out, Values=filterByBoolMask.out, Height_optionnal=code_block_4.out1, HilightInView_optionnal=code_block_4.out2, DisplayModeOnly_optionnal=code_block_4.out2, ShowElementCount_optionnal=code_block_4.out3, SortItems_optionnal=code_block_4.out3, ShowId_optionnal=code_block_4.out2)  # package Data-Shapes; Create data for ListView input in UI.MultiInputForm ++ . Check out www.data-shapes.net for more infos.
boolean_2 = BoolSelector(true)
ui_multipleinputform_2 = Custom[UI.MultipleInputForm ++](Description_optional=code_block_3.out0, ButtonText_optional=code_block_3.out1, Inputs=ui_listview_data, Toggle=boolean_2, CancelButtonText_optional=code_block_3.out2, Width_optional=code_block_3.out3)

# group: Find matching sheets
isNull = Object.IsNull(object=firstItem)
filterByBoolMask_2 = List.FilterByBoolMask(list=all_elements_of_category, mask=isNull, lacing=Longest)
getParameterValueByName_2 = Element.GetParameterValueByName(element=filterByBoolMask_2.out, parameterName=ui_multipleinputform.User_Inputs, lacing=Longest)
contains = List.Contains(list=ui_multipleinputform_2.User_Inputs, item=getParameterValueByName_2@L1)
filterByBoolMask_3 = List.FilterByBoolMask(list=filterByBoolMask_2.out, mask=contains)

# group: Merge and Delete
flatten_2 = List.Flatten(list=filterByBoolMask_3.in)
delete = Element.Delete(element=flatten_2)
views = Sheet.Views(sheet=flatten_2)

flatten_3 = List.Flatten(list=views)
uniqueItems_2 = List.UniqueItems(list=flatten_3)
watch = Watch(uniqueItems_2)
list_all_views = Custom[List All Views]()  # package Bakery; not including sheets
views_parent = Custom[© Views.Parent](views=list_all_views)  # package Crumple; For a view, return it's next related parent view if any. Will only retrieve one level above (even if it's parent has a parent etc.).
uniqueItems_3 = List.UniqueItems(list=views_parent.parentView)
watch_2 = Watch(uniqueItems_3)
views_primary = Custom[© Views.Primary](view=list_all_views)  # package Crumple; For a dependent view, return it's primary view, as well as if it has one.
uniqueItems_4 = List.UniqueItems(list=views_primary.primaryView)
watch_3 = Watch(uniqueItems_4)
get_all_views = Custom[Get All Views]()  # package Bakery; taken from archi-lab
watch_4 = Watch(get_all_views.Legends)
join = List.Join(list0=watch_2, list1=watch_3, list2=watch_4, list3=get_all_views.Undefined_Views, list4=get_all_views.Schedules)
uniqueItems_5 = List.UniqueItems(list=join)
removeNulls = Lists.Manage.RemoveNulls(Data=uniqueItems_5)
watch_5 = Watch(removeNulls.Cleaned)
firstIndexOf = List.FirstIndexOf(list=watch, item=watch_5)
removeItemAtIndex = List.RemoveItemAtIndex(list=watch, indices=firstIndexOf)
watch_6 = Watch(removeItemAtIndex)
delete_2 = Element.Delete(element=watch_6)
watch_7 = Watch(removeNulls.Indices)
watch_8 = Watch(firstIndexOf)
