# Dynamo graph 2024.06.18-A-VIEW-DELETE UNUSED VIEWS FILTER PARENT VIEWS AND DEPENCE VIEWS.DYN "View - Delete Unused views" (Dynamo 2.12.1.8246)
# packages: LunchBox for Dynamo 2016.11.11, Crumple 2022.5.27, Bakery 2019.5.8

list_all_views = Custom[List All Views]()  # package Bakery; not including sheets
views_parent = Custom[© Views.Parent](views=list_all_views)  # package Crumple; For a view, return it's next related parent view if any. Will only retrieve one level above (even if it's parent has a parent etc.).
uniqueItems = List.UniqueItems(list=views_parent.parentView)
watch = Watch(uniqueItems)
views_primary = Custom[© Views.Primary](view=list_all_views)  # package Crumple; For a dependent view, return it's primary view, as well as if it has one.
uniqueItems_2 = List.UniqueItems(list=views_primary.primaryView)
watch_2 = Watch(uniqueItems_2)
views = Views("***Welcome Page***")
get_all_views = Custom[Get All Views]()  # package Bakery; taken from archi-lab
join = List.Join(list0=watch, list1=watch_2, list2=views, list3=get_all_views.Legends, list4=get_all_views.Undefined_Views, list5=get_all_views.Schedules)
uniqueItems_3 = List.UniqueItems(list=join)
removeNulls = Lists.Manage.RemoveNulls(Data=uniqueItems_3)
watch_3 = Watch(removeNulls.Indices)
code_block = CodeBlock { "Sheet Number"; }
getParameterValueByName = Element.GetParameterValueByName(element=list_all_views, parameterName=code_block)
watch_4 = Watch(getParameterValueByName)
code_block_2 = CodeBlock { "---"; }
eq = watch_4 == code_block_2
filterByBoolMask = List.FilterByBoolMask(list=list_all_views, mask=eq)
flatten = List.Flatten(list=filterByBoolMask.in)
watch_5 = Watch(removeNulls.Cleaned)
firstIndexOf = List.FirstIndexOf(list=flatten, item=watch_5)
watch_6 = Watch(firstIndexOf)
removeItemAtIndex = List.RemoveItemAtIndex(list=flatten, indices=firstIndexOf)
watch_7 = Watch(removeItemAtIndex)
delete = Element.Delete(element=watch_7)  # frozen
file_path = Filename("..\..\Excel Worksheet.csv")
id = Element.Id(element=watch_7)
exportCSV = Data.ExportCSV(filePath=file_path, data=id)
list_create = List.Create(item0=watch_7, item1=id)
type = Object.Type(object=watch_7)
groupByKey = List.GroupByKey(list=watch_7, keys=type)
number_slider = DoubleSlider(0, range=0..4 step 1)
getItemAtIndex = List.GetItemAtIndex(list=groupByKey.groups@L3, index=number_slider)
flatten_2 = List.Flatten(list=getItemAtIndex)
id_2 = Element.Id(element=flatten_2)
list_create_2 = List.Create(item0=flatten_2, item1=id_2)
transpose = List.Transpose(lists=list_create_2)
