# Dynamo graph 2024.07.26-ROOM-COPY ROOMS SEPARATELY BY LINKED ROOMS LEVEL WISE.DYN "Room - Copy Room Separate by Linked Room" (Dynamo 2.12.1.8246)
# packages: spring nodes 203.2.0, archi-lab.net 2021.25.7, Clockwork for Dynamo 2.x 2.3.0, Rhythm 2020.6.22, Synthesize toolkit 12.7.5, Orchid 212.3.0.8381, bimorphNodes 4.2.1, Genius Loci 2022.9.16

ꟿ_document_activeview = Custom[ꟿ Document.ActiveView]()  # package spring nodes; Selects the current document's active view. Supports more view types than the built-in option. Will be depreciated once the bult in node works with all plan types.
# note: Custom Node: Rhythm v.2020.6.22
links = Links("YIAPL-E1-PH1-GC-T1-ARGN-M3-ZZ-100-G-0100.rvt : 130 : location <Not Shared>")  # graph input
ʳʰʸᵗʰᵐ_revitlink_getdocument = Rhythm.Revit.Elements.RevitLink.GetDocument(linkInstance=links)
categories = Categories("OST_Rooms")
# note: Custom Node: archilab v.2021.25.7
get_all_elements_from_linked = Custom[Get All Elements From Linked Model](linkDoc=ʳʰʸᵗʰᵐ_revitlink_getdocument, category=categories)  # package archi-lab.net; This node is based on code posted by Julien Benoit. Big thanks to Julien for sharing his work. This node will retrieve all elements of a given category from a given linked model.
code_block = CodeBlock { "Level"; }
getParameterValueByName = Revit.LinkElement.GetParameterValueByName(linkElement=get_all_elements_from_linked, parameterName=code_block)
current = Document.Current()
activeView = Document.ActiveView(document=current)

# group: View.Level
level = Python(IN[0]=activeView)  # "View.Level"; IronPython2
# ---------- level.python (12 lines) ----------
import clr
clr.AddReference('RevitAPI')
from Autodesk.Revit.DB import View

def GetLevel(view) :
	if hasattr(view, "GenLevel") : return view.GenLevel
	else : return None

views = UnwrapElement(IN[0])

if isinstance(IN[0], list): OUT = [GetLevel(x) for x in views]
else: OUT = GetLevel(views)
# ----------------------------------------
view_level = Custom[View Level](view=activeView)  # package Genius Loci; Returns the level to which a view is associated.

name = Element.Name(element=level)
watch = Watch(name)
contains = String.Contains(string=getParameterValueByName, searchFor=watch)
filterByBoolMask = List.FilterByBoolMask(list=get_all_elements_from_linked, mask=contains)
watch_2 = Watch(filterByBoolMask.in)
# note: Custom Node: spring nodes v.203.2.0
finishBoundary = Room.FinishBoundary(room=watch_2)
XY = Plane.XY()
byPlane = SketchPlane.ByPlane(plane=XY)
# note: Custom Node: Clockwork v.2.3.0
fromCurve = Custom[RoomSeparator.FromCurve](curve=finishBoundary, sketchPlane=byPlane, view=activeView)  # frozen; package Clockwork for Dynamo 2.x
# note: Custom Node: Sysnthesize
isEmpty = List.IsEmpty(list=finishBoundary@L3)
filterByBoolMask_2 = List.FilterByBoolMask(list=finishBoundary, mask=isEmpty)
fromCurve_2 = Custom[CW.RoomSeparator.FromCurve](VARcurve=filterByBoolMask_2.out, VARsketchPlane=byPlane, VARview=activeView)  # package Synthesize toolkit; Creates room separation lines from geometry curves.
# note: Custom Node: Orchid
o_link_copyelement = Orchid.RevitProject.Common.Link.CopyElement(instance=links, element=watch_2)  # frozen
code_block_2 = CodeBlock { "Phase"; "Phase 1"; }
getParameterValueByName_2 = Revit.LinkElement.GetParameterValueByName(linkElement=get_all_elements_from_linked, parameterName=code_block_2.out0)
name_2 = Element.Name(element=getParameterValueByName_2)
contains_2 = String.Contains(string=name_2, searchFor=code_block_2.out1)
filterByBoolMask_3 = List.FilterByBoolMask(list=get_all_elements_from_linked, mask=contains_2)
o_link_copyelement_2 = Orchid.RevitProject.Common.Link.CopyElement(instance=links, element=filterByBoolMask_3.in)
