# Dynamo graph 2024.08.12-PARAMETER-CLEAN UP UNUSED PARAMETERS-FIND AND REMOVE FROM 3D VIEW.DYN "PUB-001-Parameter-Shared Parameters Unused - Find and remove from 3D view" (Dynamo 2.12.1.8246)
# packages: Data-Shapes 2022.2.103, LunchBox for Dynamo 2016.11.11

# group: WIP
# note: Notes not considered part of the final package

# group: DEBUG
# note: Nodes used to debug the graph logic

# group: SET
# note: Set parameter values of Revit objects

# group: OUTPUT
# note: Object creation in Revit, Final output

# group: FUNCTION
# note: Data manipulation on Dynamo objects

# group: GET
# note: Get parameter values from Revit objects

# group: INPUT
# note: Data input and preparation

# group: NOTES
# note: GUIDELINES
# Read the instructions.
# Add Notes and Comments to the graph.
# Use Node Groups and the Standard Color Coding.
# Rename Nodes: <OriginalName> | <Description>.
# Write Input and Output Notes for Python Scripts.
# Prefer repeatable simple node structures.
# note: KNOWN ISSUES AND LIMITATIONS
# <ISSUES>
# <LIMITATIONS>
# note: INSTRUCTIONS
# <DESCRIPTIONS>
# <INSTRUCTIONS>
# note: GRAPH INFO
# Copyright 2019 Autodesk, Inc. All rights reserved.
# Company: Surbana Jurong
# Office: <office>
# Version: 1.0.0
# Author: <author>
# Keywords: [KEYWORDS]
# Tested on:
# Dynamo : 2.0.3
# Revit : 2019

# group: INPUT
views = Views("ThreeDforChecking")
elementType = Element.ElementType(element=views)
# note: Data input and preparation
watch = Watch(views)

# group: INPUT
string = StringInput("Select a 3D view")
file_path = Filename("..\..\Dynamo Script\Logo.jpg")
string_2 = StringInput("Select")
string_3 = StringInput("SELECT VIEW")
# note: Data input and preparation
element_types = ElementTypes("View3D")
all_elements_of_type = ElementsOfType(element_type=element_types)
name = Element.Name(element=all_elements_of_type)
watch_2 = Watch(all_elements_of_type)
listview_data = Custom[Listview Data](InputName=string_3, Keys=name, Values=watch_2)  # package Data-Shapes; Create data for ListView input in UI.MultiInputForm ++ . Check out www.data-shapes.net for more infos.
boolean = BoolSelector(true)
multipleinputform = Custom[MultipleInputForm ++](Description_optional=string, Logo_optional=file_path, ButtonText_optional=string_2, Inputs=listview_data, Toggle=boolean)  # package Data-Shapes; Create a form with multiple inputs. see www.data-shapes.net for tutorials and infos!
watch_3 = Watch(multipleinputform.User_Inputs)

# group: DEBUG
# note: Nodes used to debug the graph logic
flatten = List.Flatten(list=watch_3)
firstItem = List.FirstItem(list=flatten)
elementType_2 = Element.ElementType(element=firstItem)

# group: FUNCTION - Create 3DView
# note: Data manipulation on Dynamo objects
code_block = CodeBlock()
# ---------- code_block.designscript (2 lines) ----------
/*String*/
ViewName: var[]..[] = "ThreeDforChecking";
# ----------------------------------------
code_block_2 = CodeBlock()
# ---------- code_block_2.designscript (2 lines) ----------
/* Use only if you want to query a linked model*/
document: var = null;
# ----------------------------------------
create_3dview = Python(IN[0]=code_block, IN[1]=code_block_2)  # IronPython2
# ---------- create_3dview.python (53 lines) ----------
#Suggestion by Marck Ackerley
#Suggestion of improvement by Jonathan Atger
import clr
# Import DocumentManager and TransactionManager
clr.AddReference('RevitServices')
import RevitServices
from RevitServices.Persistence import DocumentManager
from RevitServices.Transactions import TransactionManager

# Import RevitAPI
clr.AddReference('RevitAPI')
import Autodesk
from Autodesk.Revit.DB import *

def ProcessParallelLists(_func, *lists):
	return map( lambda *xs: ProcessParallelLists(_func, *xs) if all(type(x) is list for x in xs) else _func(*xs), *lists )

def tolist(obj1):
    if hasattr(obj1,"__iter__"): return obj1
    else: return [obj1]

viewNames = tolist(IN[0])
inputdoc = tolist(UnwrapElement(IN[1]))
inputdoc = inputdoc[0]
	
#Inputdoc : Part of script by Andreas Dieckmann
if inputdoc == None:
	doc = DocumentManager.Instance.CurrentDBDocument
elif inputdoc.GetType().ToString() == "Autodesk.Revit.DB.Document":
	doc = inputdoc
elif inputdoc.GetType().ToString() == "Autodesk.Revit.DB.RevitLinkInstance":
	doc = inputdoc.GetLinkDocument()
else :
	doc = DocumentManager.Instance.CurrentDBDocument

#Get 3D View ViewFamilyType
viewType = FilteredElementCollector(doc).OfClass(ViewFamilyType).ToElements().Find(lambda x : x.ViewFamily == ViewFamily.ThreeDimensional)

def CreateView(name):
	view = View3D.CreateIsometric(doc, viewType.Id)
	try:view.Name = name
	except:pass
	return view

TransactionManager.Instance.ForceCloseTransaction()
t = Transaction(doc,'Create3D')
t.Start()
views=ProcessParallelLists(CreateView, viewNames)
t.Commit()
#TransactionManager.Instance.ForceCloseTransaction()

#Assign your output to the OUT variable
OUT = views, doc
# ----------------------------------------
code_block_3 = CodeBlock(x=create_3dview) { x[0]; x[1]; }
code_block_4 = CodeBlock(Document=code_block_3.out1) { Document; }
code_block_5 = CodeBlock(View=code_block_3.out0) { View; }
flatten_2 = List.Flatten(list=code_block_5)
firstItem_2 = List.FirstItem(list=flatten_2)
watch_4 = Watch(firstItem_2)

# group: GET - Collecting all Category in Revit
# note: Get parameter values from Revit objects
code_block_6 = CodeBlock()
# ---------- code_block_6.designscript (17 lines) ----------
"
import clr
clr.AddReference('RevitAPI')
from Autodesk.Revit.DB import*
clr.AddReference('RevitServices')
from RevitServices.Persistence import DocumentManager


doc = DocumentManager.Instance.CurrentDBDocument


cat = doc.Settings.Categories



OUT = cat , [x.Name for x in cat]
";
# ----------------------------------------
python_script_from_string = PythonStringNode(script=code_block_6)  # IronPython2; unwired: IN[0]
code_block_7 = CodeBlock(x=python_script_from_string) { x[0]; x[1]; }
category_name = Watch(code_block_7.out1)
original_python_script = Python()  # IronPython2; graph input
# ---------- original_python_script.python (19 lines) ----------
#Copyright (c) mostafa el ayoubi
#Data-Shapes www.data-shapes.net 2016 elayoub.mostafa@gmail.com


import clr
clr.AddReference('RevitAPI')
from Autodesk.Revit.DB import*
clr.AddReference('RevitServices')
from RevitServices.Persistence import DocumentManager


doc = DocumentManager.Instance.CurrentDBDocument


cat = doc.Settings.Categories



OUT = cat , [x.Name for x in cat]
# ----------------------------------------
revit_Categories = Watch(code_block_7.out0)

# group: SETTING
file_path_2 = Filename(".\B logo.jpg")
code_block_8 = CodeBlock { 1000; }

# group: FUNCTION - Select all Project Parameters
# note: Get parameter values from Revit objects
# note: OPTION 2: Select all Project Parameters and Shared Parameters but will be include Built-in Parameters (noname)
code_block_9 = CodeBlock()
# ---------- code_block_9.designscript (52 lines) ----------
"import System
import clr
clr.AddReference('RevitAPI')
from Autodesk.Revit.DB import *
import Autodesk

clr.AddReference('RevitNodes')
import Revit
clr.ImportExtensions(Revit.Elements)

clr.AddReference('RevitServices')
import RevitServices
from RevitServices.Persistence import DocumentManager

inputdoc = UnwrapElement(IN[1])
if inputdoc == None:
	doc = DocumentManager.Instance.CurrentDBDocument
elif inputdoc.GetType().ToString() == 'Autodesk.Revit.DB.RevitLinkInstance':
	doc = inputdoc.GetLinkDocument()
elif inputdoc.GetType().ToString() == 'Autodesk.Revit.DB.Document':
	doc = inputdoc
else: doc = None

names = []
cats = []
elems = []
guids = []

iterator = doc.ParameterBindings.ForwardIterator()
while iterator.MoveNext():

	names.append(iterator.Key.Name)

	elem = doc.GetElement(iterator.Key.Id)
	elems.append(elem)
	if elem.GetType().ToString() == 'Autodesk.Revit.DB.SharedParameterElement':
		guids.append(elem.GuidValue)
	else: guids.append(None)

	thesecats = []

	for cat in iterator.Current.Categories:
		try:
			thesecats.append(Revit.Elements.Category.ById(cat.Id.IntegerValue))
		except:
			# Return null if category is not supported by Dynamo
			# This way the user knows there are unsupported categories assigned
			thesecats.append(None)
	cats.append(thesecats)

OUT = (names, cats, elems, guids)
";
# ----------------------------------------
# note: Data manipulation on Dynamo objects
code_block_10 = CodeBlock { toggle: bool = true; }
code_block_11 = CodeBlock()
# ---------- code_block_11.designscript (2 lines) ----------
/* Use only if you want to query a linked model*/
docOrRevitLinkInstance: var = null;
# ----------------------------------------
select_all_project_parameters = PythonStringNode(script=code_block_9, IN[0]=code_block_10, IN[1]=code_block_11)  # IronPython2
code_block_12 = CodeBlock(seq=select_all_project_parameters) { seq[0]; seq[1]; seq[2]; seq[3]; }
n08 = CodeBlock(parameterElement=code_block_12.out2) { parameterElement; }  # "08"
watch_5 = Watch(n08)
n09 = CodeBlock(GUID=code_block_12.out3) { GUID; }  # "09"
n02 = CodeBlock(categories=code_block_12.out1) { categories; }  # "02"
n01 = CodeBlock(paramName=code_block_12.out0) { paramName; }  # "01"
watch_6 = Watch(n01)

# group: GET - Collecting all Shared Parameter in current doc
code_block_13 = CodeBlock()
# ---------- code_block_13.designscript (18 lines) ----------
"
import clr
clr.AddReference('RevitServices')
import RevitServices
from RevitServices.Persistence import DocumentManager
from RevitServices.Transactions import TransactionManager
clr.AddReference('RevitAPI')
import Autodesk.Revit.DB as DB

# Get the current Revit document
doc = DocumentManager.Instance.CurrentDBDocument

# Get all shared parameters in the model
sharedParameters = DB.FilteredElementCollector(doc).OfClass(DB.SharedParameterElement).ToElements()

# Select all unused shared parameters in the model
OUT = (sharedParameters)
";
# ----------------------------------------
select_all_unused_shared = PythonStringNode(script=code_block_13)  # "Select all unused Shared Parameters"; IronPython2
watch_7 = Watch(select_all_unused_shared)
name_2 = Element.Name(element=select_all_unused_shared)
watch_8 = Watch(name_2)
# note: Get parameter values from Revit objects
original_python_script_select = Python()  # "Original Python Script - Select all unused Shared Parameters"; IronPython2; unwired: IN[0]
# ---------- original_python_script_select.python (16 lines) ----------
import clr
clr.AddReference("RevitServices")
import RevitServices
from RevitServices.Persistence import DocumentManager
from RevitServices.Transactions import TransactionManager
clr.AddReference("RevitAPI")
import Autodesk.Revit.DB as DB

# Get the current Revit document
doc = DocumentManager.Instance.CurrentDBDocument

# Get all shared parameters in the model
sharedParameters = DB.FilteredElementCollector(doc).OfClass(DB.SharedParameterElement).ToElements()

# Select all unused shared parameters in the model
OUT = (sharedParameters)
# ----------------------------------------

setUnion = List.SetUnion(list1=watch_5, list2=watch_7)
watch_9 = Watch(setUnion)
watch_10 = Watch(watch_9)

# group: FUNCTION - All Elements of Categories
code_block_14 = CodeBlock()
# ---------- code_block_14.designscript (41 lines) ----------
"#Copyright (c) mostafa el ayoubi
#Data-Shapes www.data-shapes.net 2019 mostafa.elayoubi@data-shapes.io

import clr
clr.AddReference('RevitAPI')
from Autodesk.Revit.DB import*

clr.AddReference('ProtoGeometry')
from Autodesk.DesignScript.Geometry import *

clr.AddReference('RevitServices')
from RevitServices.Persistence import DocumentManager

import System
from System.Collections.Generic import*

doc = DocumentManager.Instance.CurrentDBDocument

def tolist(input):
	if isinstance(input,list):
		return input
	else:
		return [input]

#input
view = UnwrapElement(IN[0])

categories = tolist(IN[1])

#main
catfilters = []

for i in categories:
	catfilters.append(ElementCategoryFilter(System.Enum.ToObject(BuiltInCategory, int(str(i.Id)))))
catfilterlist = List[ElementFilter](catfilters)
filter = LogicalOrFilter(catfilterlist)

elems = FilteredElementCollector(doc,view.Id).WherePasses(filter).ToElements()

OUT = elems
";
# ----------------------------------------
code_block_15 = CodeBlock(Views_=firstItem) { Views_: var[]..[]; }
# note: Data manipulation on Dynamo objects
code_block_16 = CodeBlock(Categories_=revit_Categories) { Categories_: var[]..[]; }
python_script_from_string_2 = PythonStringNode(script=code_block_14, IN[0]=code_block_15, IN[1]=code_block_16)  # IronPython2
code_block_17 = CodeBlock(elements=python_script_from_string_2) { elements; }

name_3 = Element.Name(element=watch_10)

# group: GET - Parameter Value From Revit Object (Instance Parameters) > Check is it empty > Get Parameter Unused
# note: Get parameter values from Revit objects
getParameterValueByName = Element.GetParameterValueByName(element=code_block_17@L1, parameterName=name_3)
string_from_object = FromObject(object=getParameterValueByName)
length = String.Length(string=string_from_object@@L1)
code_block_18 = CodeBlock { 0; }
gt = length > code_block_18
transpose = List.Transpose(lists=gt)
watch_11 = Watch(transpose)
allFalse = List.AllFalse(list=watch_11@L2)
filterByBoolMask = List.FilterByBoolMask(list=watch_10, mask=allFalse@@L2)
flatten_3 = List.Flatten(list=filterByBoolMask.in)
para_unused = Watch(flatten_3)

# group: GET - Parameter Value From Revit Object (Type Parameters) > Check is it empty > Get Parameter used
# note: Get parameter values from Revit objects
elementType_3 = Element.ElementType(element=code_block_17)
getParameterValueByName_2 = Element.GetParameterValueByName(element=elementType_3, parameterName=name_3, lacing=CrossProduct)
code_block_19 = CodeBlock { ""; }
replaceNulls = Lists.Manage.ReplaceNulls(Data=getParameterValueByName_2, ReplaceWith=code_block_19)
string_from_object_2 = FromObject(object=replaceNulls)
length_2 = String.Length(string=string_from_object_2@@L1)
code_block_20 = CodeBlock { 0; }
gt_2 = length_2 > code_block_20
transpose_2 = List.Transpose(lists=gt_2)
watch_12 = Watch(transpose_2)
allFalse_2 = List.AllFalse(list=watch_12@L2)
filterByBoolMask_2 = List.FilterByBoolMask(list=watch_10, mask=allFalse_2@@L2)
flatten_4 = List.Flatten(list=filterByBoolMask_2.in)

setIntersection = List.SetIntersection(list1=para_unused, list2=flatten_4)
flatten_5 = List.Flatten(list=setIntersection)
uniqueItems = List.UniqueItems(list=flatten_5)

# group: WIP - Filter how many time that Shared parameter has been used
watch_13 = Watch(filterByBoolMask.out)
flatten_6 = List.Flatten(list=watch_13)
# note: Notes not considered part of the final package
transpose_3 = List.Transpose(lists=getParameterValueByName)
filterByBoolMask_3 = List.FilterByBoolMask(list=transpose_3, mask=allFalse)
watch_14 = Watch(filterByBoolMask_3.out)
string_from_object_3 = FromObject(object=watch_14)
length_3 = String.Length(string=string_from_object_3@@L1)
code_block_21 = CodeBlock { 0; }
gt_3 = length_3 > code_block_21
countTrue = List.CountTrue(list=gt_3@L2)

# group: WIP - Filter how many time that Shared parameter has been used
watch_15 = Watch(filterByBoolMask_2.out)
flatten_7 = List.Flatten(list=watch_15)
# note: Notes not considered part of the final package
transpose_4 = List.Transpose(lists=getParameterValueByName_2)
filterByBoolMask_4 = List.FilterByBoolMask(list=transpose_4, mask=allFalse_2)
watch_16 = Watch(filterByBoolMask_4.out)
string_from_object_4 = FromObject(object=watch_16)
length_4 = String.Length(string=string_from_object_4@@L1)
code_block_22 = CodeBlock { 0; }
gt_4 = length_4 > code_block_22
countTrue_2 = List.CountTrue(list=gt_4@L2)

join = List.Join(list0=flatten_6, list1=flatten_7)
name_4 = Element.Name(element=join)
join_2 = List.Join(list0=countTrue, list1=countTrue_2)
code_block_23 = CodeBlock(x=name_4, y=join_2) { x+" ("+y+") "; }
watch_17 = Watch(code_block_23)

# group: OUTPUT - Dialog report the used and unused parameters
setDifference = List.SetDifference(list1=uniqueItems, list2=join)
code_block_24 = CodeBlock { "\n"; }
code_block_25 = CodeBlock { "Used Shared Parameter: "; }
code_block_26 = CodeBlock { "\n"; }
code_block_27 = CodeBlock { "\n"; }
join_3 = String.Join(separator=code_block_27, string0=watch_17)
concat = String.Concat(string0=code_block_25, string1=code_block_26, string2=join_3)
code_block_28 = CodeBlock { "Unused Shared Parameter: "; }
name_5 = Element.Name(element=setDifference)
join_4 = String.Join(separator=code_block_26, string0=name_5)
concat_2 = String.Concat(string0=code_block_28, string1=code_block_26, string2=join_4)
concat_3 = String.Concat(string0=concat, string1=code_block_24, string2=concat_2)

join_5 = String.Join(separator=code_block_24, string0=concat_3)
watch_18 = Watch(join_5)
flatten_8 = List.Flatten(list=watch_18)

# group: OUTPUT
code_block_29 = CodeBlock { "Shared Parameters"; }
textnote_data = Custom[TextNote Data](Title=code_block_29, TextNote=flatten_8)  # package Data-Shapes; Create Data for TextNote input in UI.MultipleInputForm ++ . Check out www.data-shapes.net for more informations
code_block_30 = CodeBlock { "Next process"; true; "Active to Delete Parameters "; }
boolean_input = Custom[Boolean input](InputName=code_block_30.out0, DefaultValue=code_block_30.out1, SideText=code_block_30.out2)  # package Data-Shapes; Creates a boolean input for UI.MultipleInputForm ++ . Check out www.data-shapes.net for more infos!
list_create = List.Create(item0=textnote_data, item1=boolean_input)
boolean_2 = BoolSelector(true)
multipleinputform_2 = Custom[MultipleInputForm ++](Description_optional=code_block_29, Logo_optional=file_path_2, Inputs=list_create, Toggle=boolean_2, MaxHeight_optional=code_block_8, Width_optional=code_block_8)
code_block_31 = CodeBlock(x=multipleinputform_2.User_Inputs) { x[0]; x[1]; }
option_set_to_delete_unused = Watch(code_block_31.out1)  # "Option set to delete Unused Parameter"
message = Watch(code_block_31.out0)

# group: OUTPUT
string_4 = StringInput("Select the unsuse parameters for removing")
string_5 = StringInput("Remove")
string_6 = StringInput("PARAMETERS LIST")
flatten_9 = List.Flatten(list=setDifference)
watch_19 = Watch(flatten_9)
name_6 = Element.Name(element=watch_19)
listview_data_2 = Custom[Listview Data](InputName=string_6, Keys=name_6, Values=watch_19)
multipleinputform_3 = Custom[MultipleInputForm ++](Description_optional=string_4, Logo_optional=file_path_2, ButtonText_optional=string_5, Inputs=listview_data_2, Toggle=option_set_to_delete_unused, Width_optional=code_block_8)
watch_20 = Watch(multipleinputform_3.User_Inputs)

flatten_10 = List.Flatten(list=watch_20)

# group: OUTPUT - Delete
# note: Object creation in Revit, Final output
delete = BoolSelector(true)  # graph input
code_block_32 = CodeBlock { []; }
if_ = RefactoredIf(test=delete, true=flatten_10, false=code_block_32)
delete_2 = Element.Delete(element=if_)

name_7 = Element.Name(element=setUnion)

# group: GET - Collecting all Shared Parameter in current doc
# note: Get parameter values from Revit objects
# note: OPTION 1: Only Collecting Shared Parameters
code_block_33 = CodeBlock()  # same code as code_block_13
select_all_unused_shared_2 = PythonStringNode(script=code_block_33)  # "Select all unused Shared Parameters"; IronPython2; unwired: IN[0]
watch_21 = Watch(select_all_unused_shared_2)
