# Dynamo graph 2024.08.12-PARAMETER-CLEAN UP UNUSED PARAMETERS-MULTI-CATEGORY SCHEDULE.DYN "PUB-001-Parameter-Shared Parameters Unused - Multi-Category Schedule" (Dynamo 2.12.1.8246)
# packages: bimorphNodes 5.1.3, Data-Shapes 2022.2.103

# group: WIP
# note: Notes not considered part of the final package

# group: DEBUG
# note: Nodes used to debug the graph logic

# group: SET
# note: Set parameter values of Revit objects

# group: OUTPUT
# note: Object creation in Revit, Final output

# group: GET
# note: Get parameter values from Revit objects

# group: INPUT
# note: Data input and preparation

# group: FUNCTION
# note: Data manipulation on Dynamo objects

# group: INPUT
# note: Data input and preparation
views = Views("Multi-Category Schedule")  # graph input

# group: FUNCTION - Get Parameters of Schedule Fields
# note: Data manipulation on Dynamo objects
code_block = CodeBlock()
# ---------- code_block.designscript (49 lines) ----------
"
import clr
clr.AddReference('RevitAPI')
clr.AddReference('RevitServices')
from RevitServices.Persistence import DocumentManager
from Autodesk.Revit.DB import *

# Get the current document
doc = DocumentManager.Instance.CurrentDBDocument

# Input: ScheduleView and a list of field indices
schedule_view = UnwrapElement(IN[0])  # Schedule View input from Dynamo
#field_indices = IN[1]  # List of field indices in the schedule view

# Initialize lists to store the results
parameter_ids = []
parameter_types = []

# Number of fields:
field_indices = schedule_view.Definition.GetFieldCount()

# Iterate over each field index
for field_index in range (field_indices):
    # Get the ScheduleField from the ScheduleView
    schedule_field = schedule_view.Definition.GetField(field_index)

    # Retrieve the ParameterId from the ScheduleField
    parameter_id = schedule_field.ParameterId

    # Determine the type of ParameterId
    if parameter_id.IntegerValue < -1:
        # BuiltInParameter
        parameter_type = 'BuiltInParameter'
    elif parameter_id.IntegerValue == -1:
        # Miscellaneous (calculated value, percentage, etc.)
        parameter_type = 'Miscellaneous'
    elif parameter_id.IntegerValue > 0:
        # SharedParameter
        parameter_type = 'SharedParameter'
    else:
        parameter_type = 'Unknown'

    # Store the results
    parameter_ids.append(parameter_id)
    parameter_types.append(parameter_type)

# Output the list of ParameterIds and their types
OUT = parameter_ids, parameter_types
";
# ----------------------------------------
select_all_project_parameters = PythonStringNode(script=code_block, IN[0]=views)  # CPython3
code_block_2 = CodeBlock(out=select_all_project_parameters) { out[0]; out[1]; }
parameter_type = Watch(code_block_2.out1)
parameter_id = Watch(code_block_2.out0)

# group: SETTING
file_path = Filename(".\BD logo.png")
code_block_3 = CodeBlock { 1000; }

# note: Bimorph
getData = Revit.Schedule.GetData(scheduleView=views)

# group: GET - Filter all parameters have value
# note: Get parameter values from Revit objects
watch = Watch(getData)
code_block_4 = CodeBlock { 1; }
dropItems = List.DropItems(list=watch, amount=code_block_4)
watch_2 = Watch(dropItems)
transpose = List.Transpose(lists=watch_2)
watch_3 = Watch(transpose)
string_from_object = FromObject(object=watch_3)
length = String.Length(string=string_from_object)
code_block_5 = CodeBlock { 0; }
gt = length > code_block_5
allFalse = List.AllFalse(list=gt@L2)

filterByBoolMask = List.FilterByBoolMask(list=parameter_id, mask=allFalse)
used = Watch(filterByBoolMask.out)

# group: DEBUG - Filter to remove all build-in Parameters
# note: Nodes used to debug the graph logic
string_from_object_2 = FromObject(object=used)
toNumber = String.ToNumber(string=string_from_object_2)
code_block_6 = CodeBlock { 0; }
lt = toNumber < code_block_6
filterByBoolMask_2 = List.FilterByBoolMask(list=used, mask=lt)
element_by_id = ElementById(Id=filterByBoolMask_2.out)

name = Element.Name(element=element_by_id)
filterByBoolMask_3 = List.FilterByBoolMask(list=watch_3, mask=allFalse)

# group: WIP - Filter how many time that the parameter has been used
# note: Notes not considered part of the final package
filterByBoolMask_4 = List.FilterByBoolMask(list=filterByBoolMask_3.out, mask=lt)
watch_4 = Watch(filterByBoolMask_4.out)
string_from_object_3 = FromObject(object=watch_4)
length_2 = String.Length(string=string_from_object_3@@L1)
code_block_7 = CodeBlock { 0; }
gt_2 = length_2 > code_block_7
countTrue = List.CountTrue(list=gt_2@L2)

number_appear = Watch(countTrue)
code_block_8 = CodeBlock(x=name, y=number_appear) { x+" ("+y+") "; }
watch_5 = Watch(code_block_8)
unused = Watch(filterByBoolMask.in)

# group: DEBUG - Filter to remove all build-in Parameters
# note: Nodes used to debug the graph logic
string_from_object_4 = FromObject(object=unused)
toNumber_2 = String.ToNumber(string=string_from_object_4)
code_block_9 = CodeBlock { 0; }
lt_2 = toNumber_2 < code_block_9
filterByBoolMask_5 = List.FilterByBoolMask(list=unused, mask=lt_2)
element_by_id_2 = ElementById(Id=filterByBoolMask_5.out)

unused_parameters_can_be_deleted = Watch(element_by_id_2)

# group: OUTPUT - Dialog report the used and unused parameters
code_block_10 = CodeBlock { "\n"; }
code_block_11 = CodeBlock { "Used Shared Parameter: "; }
code_block_12 = CodeBlock { "\n"; }
code_block_13 = CodeBlock { "\n"; }
join = String.Join(separator=code_block_13, string0=watch_5)
concat = String.Concat(string0=code_block_11, string1=code_block_12, string2=join)
code_block_14 = CodeBlock { "Unused Shared Parameter: "; }
unused_2 = Watch(unused_parameters_can_be_deleted)
name_2 = Element.Name(element=unused_2)
join_2 = String.Join(separator=code_block_12, string0=name_2)
concat_2 = String.Concat(string0=code_block_14, string1=code_block_12, string2=join_2)
concat_3 = String.Concat(string0=concat, string1=code_block_10, string2=concat_2)

join_3 = String.Join(separator=code_block_10, string0=concat_3)
watch_6 = Watch(join_3)
flatten = List.Flatten(list=watch_6)

# group: OUTPUT
code_block_15 = CodeBlock { "Shared Parameters"; }
textnote_data = Custom[TextNote Data](Title=code_block_15, TextNote=flatten)  # package Data-Shapes; Create Data for TextNote input in UI.MultipleInputForm ++ . Check out www.data-shapes.net for more informations
code_block_16 = CodeBlock { "Next process"; true; "Active to Delete Parameters "; }
boolean_input = Custom[Boolean input](InputName=code_block_16.out0, DefaultValue=code_block_16.out1, SideText=code_block_16.out2)  # package Data-Shapes; Creates a boolean input for UI.MultipleInputForm ++ . Check out www.data-shapes.net for more infos!
list_create = List.Create(item0=textnote_data, item1=boolean_input)
boolean = BoolSelector(true)
multipleinputform = Custom[MultipleInputForm ++](Description_optional=code_block_15, Logo_optional=file_path, Inputs=list_create, Toggle=boolean, MaxHeight_optional=code_block_3, Width_optional=code_block_3)  # package Data-Shapes; Create a form with multiple inputs. see www.data-shapes.net for tutorials and infos!
code_block_17 = CodeBlock(x=multipleinputform.User_Inputs) { x[0]; x[1]; }
message = Watch(code_block_17.out0)
option_set_to_delete_unused = Watch(code_block_17.out1)  # "Option set to delete Unused Parameter"

# group: OUTPUT
string = StringInput("Select the unsuse parameters for removing")
string_2 = StringInput("Remove")
string_3 = StringInput("PARAMETERS LIST")
flatten_2 = List.Flatten(list=unused_parameters_can_be_deleted)
watch_7 = Watch(flatten_2)
name_3 = Element.Name(element=watch_7)
listview_data = Custom[Listview Data](InputName=string_3, Keys=name_3, Values=watch_7)  # package Data-Shapes; Create data for ListView input in UI.MultiInputForm ++ . Check out www.data-shapes.net for more infos.
multipleinputform_2 = Custom[MultipleInputForm ++](Description_optional=string, Logo_optional=file_path, ButtonText_optional=string_2, Inputs=listview_data, Toggle=option_set_to_delete_unused, Width_optional=code_block_3)
watch_8 = Watch(multipleinputform_2.User_Inputs)

flatten_3 = List.Flatten(list=watch_8)

# group: OUTPUT - Delete
# note: Object creation in Revit, Final output
delete = BoolSelector(true)  # graph input
code_block_18 = CodeBlock { []; }
if_ = RefactoredIf(test=delete, true=flatten_3, false=code_block_18)
delete_2 = Element.Delete(element=if_)
