# Dynamo graph 2024.08.13-NIA_QC-BEAM-REGENERATING THE BEAMS WITH SAME ALL PROPERTIES.DYN "NIA_QC - Beam - Recreate Beam" (Dynamo 2.12.1.8246)

# group: WIP
# note: Notes not considered part of the final package

# group: DEBUG
# note: Nodes used to debug the graph logic

# group: SET
# note: Set parameter values of Revit objects

# group: OUTPUT
# note: Object creation in Revit, Final output

# group: FUNCTION
# note: Data manipulation on Dynamo objects

# group: INPUT
# note: Data input and preparation

# group: GET
# note: Get parameter values from Revit objects

# group: INPUT
# note: Data input and preparation

select_model_elements_by = DSModelElementsByCategorySelection("dc7c5753-c46b-47b2-9500-a3adf22d04a7-0120c015,dc7c5753-c46b-47b2-9500-a3adf22d04a7-0120c017,dc7c5753-c46b-47b2-9500-a3adf22d04a7-0120c019,dc7c5753-c46b-47b2-9500-a3adf22d04a7-0120c01b,dc7c5753-c46b-47b2-9500-a3adf22d04a7-0120c01d,dc7c5753-c46b-47b2-9500-a3adf22d04a7-0120c01f,dc7c5753-c46b-47b2-9500-a3adf22d04a7-0120c021,dc7c5753-c46b-47b2-9500-a3adf22d04a7-0120c023,dc7c5753-c46b-47b2-9500-a3adf22d04a7-0120c025,dc7c5753-c46b-47b2-9500-a3adf22d04a7-0120c027,dc7c5753-c46b-47b2-9500-a3adf22d04a7-0120c029")  # "Select Model Elements By Category"; 11 picked in the model; graph input

# group: WIP
watch = Watch(select_model_elements_by)
location = StructuralFraming.Location(structuralFraming=watch)
# note: Create the Beam and Column from old elements
levels = Levels("L2 - Second Floor (SSL)")  # graph input
elementType = Element.ElementType(element=watch)
beamByCurve = StructuralFraming.BeamByCurve(curve=location, level=levels, structuralFramingType=elementType)
watch_2 = Watch(beamByCurve)
code_block = CodeBlock { "Reference Level"; }
setParameterByName = Element.SetParameterByName(element=watch_2, parameterName=code_block, value=levels)
boolean = BoolSelector(true)
setPinnedStatus = Element.SetPinnedStatus(element=setParameterByName, pinned=boolean)
columnByCurve = StructuralFraming.ColumnByCurve()  # unwired: curve, level, structuralColumnType

# group: GET
# note: Get parameter name from selected elements
firstItem = List.FirstItem(list=select_model_elements_by)
parameters = Element.Parameters(element=firstItem)
name = Parameter.Name(parameter=parameters)
storageType = Parameter.StorageType(parameter=parameters)
code_block_2 = CodeBlock { "String"; }
contains = String.Contains(string=storageType, searchFor=code_block_2)
filterByBoolMask = List.FilterByBoolMask(list=name, mask=contains)
list_parameter_names = Watch(filterByBoolMask.in)

# group: FUNCTION
# note: Taking the parameter values of old elements and put it into the new elements
code_block_3 = CodeBlock(elems1=watch, elems2=watch_2, paramName=list_parameter_names) { elems1; elems2; paramName; }
watch_3 = Watch(code_block_3.paramName)
count = List.Count(list=watch_3)
cycle = List.Cycle(list=code_block_3.elems2@L1, amount=count)
count_2 = List.Count(list=code_block_3.elems1)
cycle_2 = List.Cycle(list=watch_3@L1, amount=count_2)
transpose = List.Transpose(lists=cycle_2)
getParameterValueByName = Element.GetParameterValueByName(element=code_block_3.elems1, parameterName=watch_3, lacing=CrossProduct)
setParameterByName_2 = Element.SetParameterByName(element=cycle, parameterName=transpose, value=getParameterValueByName, lacing=Longest)
old_elements = Watch(code_block_3.elems1)
new_elements = Watch(setParameterByName_2)

# group: FUNCTION
# note: Delete old elements
isEmpty = List.IsEmpty(list=setParameterByName_2)
empty = List.Empty()
uniqueItems = List.UniqueItems(list=old_elements@L2)
if_ = RefactoredIf(test=isEmpty, true=empty, false=uniqueItems)
delete = Element.Delete(element=if_)  # frozen

code_block_4 = CodeBlock()  # frozen
# ---------- code_block_4.designscript (20 lines) ----------
["NIA_Level association","NIA_Discipline code",
"NIA-Phase",
"NIA-Design stage",
"Structural Element Tile",
"BEAM TYPE",
"CAMBER",
"STUD DIA",
"Comments",
"Mark",
"ST-Element number",
"Level association",
"Exterior/Interior",
"NIA_TYPE",
"NIA-ZONE ID",
"NIA_GN_Phase",
"NIA_GN_Stage",
"NIA_GN_Tile Number",
"NIA_GN_WBS Code",
"NIA_GN_Level",
"BEAM AS PER TILE"];
# ----------------------------------------

# group: NOTES
# note: GUIDELINES
# Read the instructions.
# Add Notes and Comments to the graph.
# Use Node Groups and the Standard Color Coding.
# Rename Nodes: <OriginalName> | <Description>.
# Write Input and Output Notes for Python Scripts.
# Prefer repeatable simple node structures.
useful_links_ctrl_click_the_link = CodeBlock()  # "Useful Links | CTRL + Click the link below"
# ---------- useful_links_ctrl_click_the_link.designscript (2 lines) ----------
"http://primer.dynamobim.org/Appendix/A-3_packages.html";
"http://primer.dynamobim.org/13_Best-Practice/13-1_Introduction.html";
# ----------------------------------------
# note: KNOWN ISSUES AND LIMITATIONS
# <ISSUES>
# <LIMITATIONS>
# note: GRAPH INFO
# Copyright 2019 Autodesk, Inc. All rights reserved.
# Company: Surbana Jurong
# Office: <office>
# Version: 1.0.0
# Author: <author>
# Keywords: [KEYWORDS]
# Tested on:
# Dynamo : 2.0.3
# Revit : 2019
# note: INSTRUCTIONS
# <DESCRIPTIONS>
# <INSTRUCTIONS>
python_script_reference_lib = Python()  # IronPython2; unwired: IN[0]
# ---------- python_script_reference_lib.python (37 lines) ----------
import clr

clr.AddReference('ProtoGeometry')
from Autodesk.DesignScript.Geometry import *

clr.AddReference('RevitAPI')
from Autodesk.Revit.DB import *
from Autodesk.Revit.DB.Structure import *

clr.AddReference('RevitAPIUI')
from Autodesk.Revit.UI import *

clr.AddReference('System')
from System.Collections.Generic import List

clr.AddReference('RevitNodes')
import Revit
clr.ImportExtensions(Revit.GeometryConversion)
clr.ImportExtensions(Revit.Elements)

clr.AddReference('RevitServices')
import RevitServices
from RevitServices.Persistence import DocumentManager
from RevitServices.Transactions import TransactionManager

doc = DocumentManager.Instance.CurrentDBDocument
uidoc=DocumentManager.Instance.CurrentUIApplication.ActiveUIDocument

# Preparing input from Dynamo to Revit
element = UnwrapElement(IN[0])

# Do some action in a Transaction
TransactionManager.Instance.EnsureInTransaction(doc)

TransactionManager.Instance.TransactionTaskDone()

OUT = element
# ----------------------------------------
