# Dynamo graph 2024.08.19-FILENAME-CHANGE FILE NAME IN DIRECTORY.dyn (Dynamo 2.16.2.5624)

directory_path = Directory("C:\Users\BD5509047\OneDrive-BinhDUONG\OneDrive - Surbana Jurong Private Limited\SMEC Projects\2024.09.05-T5\02.WIP\2024.09.27-T5AB substructure\Package A\02_Overall Plans_1_3000\New Editing Drawings")
code_block = CodeBlock(directoryPath=directory_path) { _directoryPath; }
directory_from_path = DirectoryObject(path=directory_path)
getDirectoryContents = FileSystem.GetDirectoryContents(directory=directory_from_path)
string_from_object = FromObject(object=getDirectoryContents.files)
string_from_object_2 = FromObject(object=directory_path)
string = StringInput("\")
concat = String.Concat(string0=string_from_object_2, string1=string)
code_block_2 = CodeBlock { ""; }
replace = String.Replace(string=string_from_object, searchFor=concat, replaceWith=code_block_2)
code_block_3 = CodeBlock(identifiers=replace) { _identifiers; }
directory_path_2 = Directory("C:\Users\BD5509047\OneDrive-BinhDUONG\OneDrive - Surbana Jurong Private Limited\SMEC Projects\2024.09.05-T5\02.WIP\2024.09.27-T5AB substructure\Package A\02_Overall Plans_1_3000")
directory_from_path_2 = DirectoryObject(path=directory_path_2)
getDirectoryContents_2 = FileSystem.GetDirectoryContents(directory=directory_from_path_2)
string_from_object_3 = FromObject(object=getDirectoryContents_2.files)
string_from_object_4 = FromObject(object=directory_path_2)
string_2 = StringInput("\")
concat_2 = String.Concat(string0=string_from_object_4, string1=string_2)
code_block_4 = CodeBlock { ""; }
replace_2 = String.Replace(string=string_from_object_3, searchFor=concat_2, replaceWith=code_block_4)
code_block_5 = CodeBlock(newNames=replace_2) { _newNames; }
boolean = BoolSelector(true)
code_block_6 = CodeBlock(runIt=boolean) { _runIt; }
# note: # Copyright(c) 2016, Konrad Sobon
# # @arch_laboratory, http://archi-lab.net
rename_files = Python(IN[0]=code_block, IN[1]=code_block_3, IN[2]=code_block_5, IN[3]=code_block_6)  # IronPython2
# ---------- rename_files.python (40 lines) ----------
# Copyright(c) 2016, Konrad Sobon
# @arch_laboratory, http://archi-lab.net

import sys
pyt_path = r'C:\Program Files (x86)\IronPython 2.7\Lib'
sys.path.append(pyt_path)

import os

filePath = IN[0]
identifiers = IN[1]
newNames = IN[2]
RunIt = IN[3]

files = os.listdir(filePath)

if RunIt:
	try:
		errorReport = None
		for file in files:
			currentFileName = filePath + "\\" + file
		
			for i, j in zip(identifiers, newNames):
				newFileName = filePath + "\\" + j
	
				if i in file and currentFileName != newFileName:
					os.rename(currentFileName, newFileName)
	except:
		# if error accurs anywhere in the process catch it
		import traceback
		errorReport = traceback.format_exc()
else:
	errorReport = "Set RunMe to True."

#Assign your output to the OUT variable
if errorReport == None:
	OUT = "Completed"
else:
	OUT = errorReport
	
# ----------------------------------------
code_block_7 = CodeBlock(out=rename_files) { _out; }
code_block_8 = CodeBlock { ".pdf"; }
file_path = Filename("..\..\..\..\SMEC Projects\2024.09.05-T5\02.WIP\2024.09.27-T5AB substructure\Package A\02_Overall Plans_1_3000\New Editing Drawings\Book1.csv")  # frozen
importCSV = Data.ImportCSV(filePath=file_path)
code_block_9 = CodeBlock(x=importCSV) { x[0]; x[1]; }
code_block_10 = CodeBlock(identifiers=code_block_9.out0) { _identifiers; }
code_block_11 = CodeBlock(newNames=code_block_9.out1) { _newNames; }
