# Dynamo graph 2024.08.19-NIA_QC-COLUMN-REGENERATING THE COLUMNS WITH SAME ALL PROPERTIES.DYN "NIA_QC - Column - Recreate Column" (Dynamo 2.12.1.8246)
# packages: DuongBinh 2024.8.20, Bakery 2019.5.8

# group: WIP
# note: Notes not considered part of the final package

# group: DEBUG
# note: Nodes used to debug the graph logic

# group: SET
# note: Set parameter values of Revit objects

# group: OUTPUT
# note: Object creation in Revit, Final output

# group: FUNCTION
# note: Data manipulation on Dynamo objects

# group: INPUT
# note: Data input and preparation

# group: GET
# note: Get parameter values from Revit objects

# group: INPUT
# note: Data input and preparation

select_model_elements_by = DSModelElementsByCategorySelection("f74d7b12-6482-42e9-be2d-9f9abf50a11c-00e23876,f74d7b12-6482-42e9-be2d-9f9abf50a11c-00e23878")  # "Select Model Elements By Category"; 2 picked in the model; graph input

# group: FUNCTION
getLocation = Element.GetLocation(element=select_model_elements_by)
X = Point.X(point=getLocation)
Y = Point.Y(point=getLocation)
# note: Data manipulation on Dynamo objects
geometry = Element.Geometry(element=select_model_elements_by)
byGeometry = BoundingBox.ByGeometry(geom=geometry)
maxPoint = BoundingBox.MaxPoint(boundingBox=byGeometry)
Z = Point.Z(point=maxPoint)
byCoordinates = Point.ByCoordinates(x=X, y=Y, z=Z)
minPoint = BoundingBox.MinPoint(boundingBox=byGeometry)
Z_2 = Point.Z(point=minPoint)
byCoordinates_2 = Point.ByCoordinates(x=X, y=Y, z=Z_2)
byStartPointEndPoint = Line.ByStartPointEndPoint(startPoint=byCoordinates_2, endPoint=byCoordinates)

# group: WIP
# note: Create the Beam and Column from old elements
old_elements = Watch(select_model_elements_by)
elementType = Element.ElementType(element=select_model_elements_by)
levels = Levels("L2 - Second Floor (SSL)")  # graph input
byPointAndLevel = FamilyInstance.ByPointAndLevel(familyType=elementType, point=byCoordinates, level=levels)
new_elements = Watch(byPointAndLevel)

# group: GET
# note: Get parameter name from selected elements
firstItem = List.FirstItem(list=select_model_elements_by)
parameters = Element.Parameters(element=firstItem)
name = Parameter.Name(parameter=parameters)
storageType = Parameter.StorageType(parameter=parameters)
code_block = CodeBlock { "String"; }
contains = String.Contains(string=storageType, searchFor=code_block)
filterByBoolMask = List.FilterByBoolMask(list=name, mask=contains)
list_parameter_names = Watch(filterByBoolMask.in)

# group: FUNCTION
# note: Taking the parameter values of old elements and put it into the new elements
code_block_2 = CodeBlock(elems1=old_elements, elems2=new_elements, paramName=list_parameter_names) { elems1; elems2; paramName; }
watch = Watch(code_block_2.paramName)
count = List.Count(list=watch)
cycle = List.Cycle(list=code_block_2.elems2@L1, amount=count)
count_2 = List.Count(list=code_block_2.elems1)
cycle_2 = List.Cycle(list=watch@L1, amount=count_2)
transpose = List.Transpose(lists=cycle_2)
getParameterValueByName = Element.GetParameterValueByName(element=code_block_2.elems1, parameterName=watch, lacing=CrossProduct)
setParameterByName = Element.SetParameterByName(element=cycle, parameterName=transpose, value=getParameterValueByName, lacing=Longest)
old_elements_2 = Watch(code_block_2.elems1)
new_elements_2 = Watch(setParameterByName)

# group: FUNCTION
# note: Delete old elements
isEmpty = List.IsEmpty(list=setParameterByName)
empty = List.Empty()
uniqueItems = List.UniqueItems(list=old_elements_2@L2)
if_ = RefactoredIf(test=isEmpty, true=empty, false=uniqueItems)
delete = Element.Delete(element=if_)  # frozen

code_block_3 = CodeBlock()  # frozen
# ---------- code_block_3.designscript (20 lines) ----------
["NIA_Level association","NIA_Discipline code",
"NIA-Phase",
"NIA-Design stage",
"Structural Element Tile",
"BEAM TYPE",
"CAMBER",
"STUD DIA",
"Comments",
"Mark",
"ST-Element number",
"Level association",
"Exterior/Interior",
"NIA_TYPE",
"NIA-ZONE ID",
"NIA_GN_Phase",
"NIA_GN_Stage",
"NIA_GN_Tile Number",
"NIA_GN_WBS Code",
"NIA_GN_Level",
"BEAM AS PER TILE"];
# ----------------------------------------

# group: NOTES
# note: GUIDELINES
# Read the instructions.
# Add Notes and Comments to the graph.
# Use Node Groups and the Standard Color Coding.
# Rename Nodes: <OriginalName> | <Description>.
# Write Input and Output Notes for Python Scripts.
# Prefer repeatable simple node structures.
# note: KNOWN ISSUES AND LIMITATIONS
# <ISSUES>
# <LIMITATIONS>
# note: GRAPH INFO
# Copyright 2019 Autodesk, Inc. All rights reserved.
# Company: Surbana Jurong
# Office: <office>
# Version: 1.0.0
# Author: <author>
# Keywords: [KEYWORDS]
# Tested on:
# Dynamo : 2.0.3
# Revit : 2019
# note: INSTRUCTIONS
# <DESCRIPTIONS>
# <INSTRUCTIONS>
useful_links_ctrl_click_the_link = CodeBlock()  # "Useful Links | CTRL + Click the link below"
# ---------- useful_links_ctrl_click_the_link.designscript (2 lines) ----------
"http://primer.dynamobim.org/Appendix/A-3_packages.html";
"http://primer.dynamobim.org/13_Best-Practice/13-1_Introduction.html";
# ----------------------------------------
python_script_reference_lib = Python()  # IronPython2; unwired: IN[0]
# ---------- python_script_reference_lib.python (37 lines) ----------
import clr

clr.AddReference('ProtoGeometry')
from Autodesk.DesignScript.Geometry import *

clr.AddReference('RevitAPI')
from Autodesk.Revit.DB import *
from Autodesk.Revit.DB.Structure import *

clr.AddReference('RevitAPIUI')
from Autodesk.Revit.UI import *

clr.AddReference('System')
from System.Collections.Generic import List

clr.AddReference('RevitNodes')
import Revit
clr.ImportExtensions(Revit.GeometryConversion)
clr.ImportExtensions(Revit.Elements)

clr.AddReference('RevitServices')
import RevitServices
from RevitServices.Persistence import DocumentManager
from RevitServices.Transactions import TransactionManager

doc = DocumentManager.Instance.CurrentDBDocument
uidoc=DocumentManager.Instance.CurrentUIApplication.ActiveUIDocument

# Preparing input from Dynamo to Revit
element = UnwrapElement(IN[0])

# Do some action in a Transaction
TransactionManager.Instance.EnsureInTransaction(doc)

TransactionManager.Instance.TransactionTaskDone()

OUT = element
# ----------------------------------------

select_model_elements_by_2 = DSModelElementsByCategorySelection("f74d7b12-6482-42e9-be2d-9f9abf50a11c-00e23878")  # "Select Model Elements By Category"; 1 picked in the model; graph input; frozen
structureColumnsToCurves = Custom[StructureColumnsToCurves](structureColumn=select_model_elements_by_2)  # package DuongBinh
levels_2 = Levels("L2 - Second Floor (SSL)")  # graph input
structural_column_by_curve_in = Custom[Structural Column By Curve In Transaction](curves=structureColumnsToCurves.curves, columnType=structureColumnsToCurves.columnstyle, level=levels_2)  # package Bakery
code_block_4 = CodeBlock { "Base Level"; }
getParameterValueByName_2 = Element.GetParameterValueByName(element=select_model_elements_by_2, parameterName=code_block_4)
turnIntoList = Custom[TurnIntoList](unknownItem=structureColumnsToCurves.curves)  # package DuongBinh
line_to_curve_dynamo = Python(IN[0]=turnIntoList)  # IronPython2
# ---------- line_to_curve_dynamo.python (16 lines) ----------
import clr
clr.AddReference('ProtoGeometry')
import Autodesk.DesignScript.Geometry

a = IN[0]

if isinstance(a, list):
	a = a
else: a = [a]

e = []

for i in a:
	e.append(Autodesk.DesignScript.Geometry.Curve.Offset(i,0))
	
OUT = e
# ----------------------------------------
dynamo_curves_to_revit_curves = Python(IN[0]=line_to_curve_dynamo)  # IronPython2
# ---------- dynamo_curves_to_revit_curves.python (23 lines) ----------
import clr
clr.AddReference('RevitAPI')
from Autodesk.Revit.DB import *

clr.AddReference("RevitNodes")
import Revit
clr.ImportExtensions(Revit.GeometryConversion)

clr.AddReference("RevitServices")
import RevitServices
from RevitServices.Persistence import DocumentManager
from RevitServices.Transactions import TransactionManager

doc = DocumentManager.Instance.CurrentDBDocument
curves = UnwrapElement(IN[0])
revitcurves = []
for c in curves:
	try:
		revitcurves.append(c.ToRevitType())
	except:
		pass

OUT = revitcurves
# ----------------------------------------
python_script = Python(IN[0]=dynamo_curves_to_revit_curves, IN[1]=structureColumnsToCurves.columnstyle, IN[2]=levels_2)  # IronPython2; frozen
# ---------- python_script.python (51 lines) ----------
import clr
from System.Collections.Generic import *
clr.AddReference('RevitAPI')
from Autodesk.Revit.DB import *
import Autodesk

clr.AddReference("RevitNodes")
import Revit
clr.ImportExtensions(Revit.Elements)

clr.AddReference("RevitServices")
import RevitServices
from RevitServices.Persistence import DocumentManager
from RevitServices.Transactions import TransactionManager

#from System.Linq import *
from Autodesk.Revit.Creation import *
from Autodesk.Revit.DB import *
#from DynamoServices import *
from Revit.GeometryConversion import *
from RevitServices.Persistence import *
from RevitServices.Transactions import *

doc = DocumentManager.Instance.CurrentDBDocument
locations = UnwrapElement(IN[0])
famtypeIn = UnwrapElement(IN[1])
levelIn = UnwrapElement(IN[2])

elementlist = []

failures = []
#itemlist = List[FamilyInstanceCreationData](templist)
def GetCreationData(curve, level, structuralType, symbol):
	return FamilyInstanceCreationData(curve, symbol, level, structuralType)
	

		
TransactionManager.Instance.EnsureInTransaction(doc)
for l in locations:
	creationData = GetCreationData(l,levelIn,Autodesk.Revit.DB.Structure.StructuralType.Column,famtypeIn)
	creationdatas = List[FamilyInstanceCreationData]()
	creationdatas.Add(creationData)
#	listed = List[FamilyInstanceCreationData].append((creationData))
#	creationData = templist
	newobj = doc.Create.NewFamilyInstances2(creationdatas)
	elementlist.append(newobj)
#	except:
#		failures.append(l)
TransactionManager.Instance.TransactionTaskDone()

OUT = elementlist#, failures
# ----------------------------------------
elementType_2 = Element.ElementType(element=select_model_elements_by_2)
python_script_2 = Python(IN[0]=dynamo_curves_to_revit_curves, IN[1]=elementType_2, IN[2]=levels_2)  # IronPython2; frozen
# ---------- python_script_2.python (25 lines) ----------
import clr
from System.Collections.Generic import List
clr.AddReference('RevitAPI')
from Autodesk.Revit.DB import *
import Autodesk

clr.AddReference("RevitServices")
from RevitServices.Persistence import DocumentManager
from RevitServices.Transactions import TransactionManager

doc = DocumentManager.Instance.CurrentDBDocument
locations = UnwrapElement(IN[0])
famtypeIn = UnwrapElement(IN[1])
levelIn = UnwrapElement(IN[2])

elementlist = []

TransactionManager.Instance.EnsureInTransaction(doc)
for l in locations:
    if isinstance(l, Curve):  # Kiểm tra nếu l là một Curve
        new_column = doc.Create.NewFamilyInstance(l, famtypeIn, levelIn, Autodesk.Revit.DB.Structure.StructuralType.Column)
        elementlist.append(new_column)
TransactionManager.Instance.TransactionTaskDone()

OUT = elementlist
# ----------------------------------------
flatten = List.Flatten(list=python_script_2)
bv_ids_to_elements = Custom[bv IDs to Elements](IDs=flatten)  # package Bakery; forked from CAAD_RWTH
code_block_5 = CodeBlock(columns=bv_ids_to_elements) { columns; }
dynamo_curves_to_revit_curves_2 = Custom[Dynamo Curves to Revit Curves](curves=structureColumnsToCurves.curves)  # package Bakery
turnIntoList_2 = Custom[TurnIntoList](unknownItem=dynamo_curves_to_revit_curves_2)
python_script_3 = Python(IN[0]=dynamo_curves_to_revit_curves, IN[1]=elementType_2, IN[2]=levels_2)  # IronPython2
# ---------- python_script_3.python (37 lines) ----------
import clr
from System.Collections.Generic import List
clr.AddReference('RevitAPI')

from Autodesk.Revit.DB import Line, XYZ
from Autodesk.Revit.Creation import FamilyInstanceCreationData
import Autodesk

clr.AddReference("RevitServices")
from RevitServices.Persistence import DocumentManager
from RevitServices.Transactions import TransactionManager

doc = DocumentManager.Instance.CurrentDBDocument
locations = UnwrapElement(IN[0])  # List of Line objects
famtypeIn = UnwrapElement(IN[1])   # FamilySymbol
levelIn = UnwrapElement(IN[2])     # Level

elementlist = []

# Hàm tạo dữ liệu cho FamilyInstanceCreationData
def GetCreationData(curve, level, structuralType, symbol):
    return FamilyInstanceCreationData(curve, symbol, level, structuralType)

TransactionManager.Instance.EnsureInTransaction(doc)
for l in locations:
    if isinstance(l, Line):  # Kiểm tra nếu l là một Line (một loại Curve)
        #creationData = GetCreationData(l, Autodesk.Revit.DB.Structure.StructuralType.Column, levelIn, famtypeIn)
        #creationdatas = List[FamilyInstanceCreationData]()
        #creationdatas.Add(creationData)
        #newobj = doc.Create.NewFamilyInstances2(creationdatas)
        #elementlist.append(newobj)
        elementlist.append("Line")
    else:
    	elementlist.append("ERROR")
TransactionManager.Instance.TransactionTaskDone()

OUT = [elementlist, locations.GetType(), famtypeIn.GetType(), levelIn.GetType()]
# ----------------------------------------
type = Object.Type(object=line_to_curve_dynamo)
type_2 = Object.Type(object=elementType_2)
structural_column_types = StructuralColumnTypes("1000Lx1000B")
type_3 = Object.Type(object=structural_column_types)
code_block_6 = CodeBlock()
# ---------- code_block_6.designscript (2 lines) ----------
["Base Level","Base Offset", "Top Level", "Top Offset"
];
# ----------------------------------------

# group: FUNCTION
# note: Taking the parameter values of old elements and put it into the new elements
code_block_7 = CodeBlock(eleold=old_elements, elenew=new_elements, paramName=code_block_6) { eleold; elenew; paramName; }
old_elements_3 = Watch(code_block_7.eleold)
watch_2 = Watch(code_block_7.paramName)
count_3 = List.Count(list=watch_2)
cycle_3 = List.Cycle(list=code_block_7.elenew@L1, amount=count_3)
count_4 = List.Count(list=code_block_7.eleold)
cycle_4 = List.Cycle(list=watch_2@L1, amount=count_4)
transpose_2 = List.Transpose(lists=cycle_4)
getParameterValueByName_3 = Element.GetParameterValueByName(element=code_block_7.eleold, parameterName=watch_2, lacing=CrossProduct)
setParameterByName_2 = Element.SetParameterByName(element=cycle_3, parameterName=transpose_2, value=getParameterValueByName_3, lacing=Longest)
new_elements_3 = Watch(setParameterByName_2)

uniqueItems_2 = List.UniqueItems(list=new_elements_3@L2)
flatten_2 = List.Flatten(list=uniqueItems_2)
structureColumnsToCurves_2 = Custom[StructureColumnsToCurves](structureColumn=select_model_elements_by)
watch_3 = Watch(structureColumnsToCurves_2.rotations)
setRotation = FamilyInstance.SetRotation(familyInstance=flatten_2, degree=watch_3)
boolean = BoolSelector(true)
setPinnedStatus = Element.SetPinnedStatus(element=setRotation, pinned=boolean)  # frozen
