# Dynamo graph 2024.08.22-STAIR-Clearance Height above Stairs.dyn (Dynamo 1.3.0.875)

# group: Input
# note: Select the stair object
select_model_element = DSModelElementSelection()  # 1 picked in the model
# note: Use this offset value to set the calculation point outside the tread solid geometry.
safety_offset_number = DoubleInput(50)
# note: Set the minimal clearance height above the stair treads.
min_clearance_height_number = DoubleSlider(2000, range=2000..3000 step 100)  # "Min clearance height / Number Slider"

# group: Detection of the topsurface of each tread and landing
faces = Element.Faces(select_model_element)
code_block = CodeBlock { 0.5; }
# note: Get the Z-value of the normal vector of each surface of the stair solid.
normalAtParameter = Surface.NormalAtParameter(surface=faces, u=code_block, v=code_block)
Z = Vector.Z(normalAtParameter)
code_block_2 = CodeBlock { 1; }
eq = Z == code_block_2
# note: Filter surfaces on basis of the Z-valu of the normal vector. Surfaces where the Z-component = 1 (vector pointing upwards) represent the landings, treads and top of supports.
filterByBoolMask = List.FilterByBoolMask(list=faces, mask=eq)
code_block_3 = CodeBlock(a=filterByBoolMask.in) { a; }
area = Surface.Area(filterByBoolMask.in)
code_block_4 = CodeBlock { "Actual Tread Depth"; "Width"; }
# note: Get the dimensions of the treads and calculate the surface of one tread
getParameterValueByName = Element.GetParameterValueByName(element=select_model_element, parameterName=code_block_4.out0)
getParameterValueByName_2 = Element.GetParameterValueByName(element=select_model_element, parameterName=code_block_4.out1)
code_block_5 = CodeBlock(d=getParameterValueByName, w=getParameterValueByName_2)
# ---------- code_block_5.designscript (2 lines) ----------
//Surface of one tread
A=d*w;
# ----------------------------------------
ge = area >= code_block_5
# note: Filter the surfaces that are smaller than the surface of one tread (these are mainly the surfaces of risers and supports).
filterByBoolMask_2 = List.FilterByBoolMask(list=filterByBoolMask.in, mask=ge)
code_block_6 = CodeBlock(TopSurfaces=filterByBoolMask_2.in)
# ---------- code_block_6.designscript (3 lines) ----------
//Results in top surfaces of
//treads and landings
TopSurfaces;
# ----------------------------------------

# group: Ray Casting in Dynamo
code_block_7 = CodeBlock { 0.5; }
# note: Get the centerpoint of each tread top surface
pointAtParameter = Surface.PointAtParameter(surface=code_block_6, u=code_block_7, v=code_block_7)
ZAxis = Vector.ZAxis()
code_block_8 = CodeBlock(SafetyOffset=safety_offset_number) { SafetyOffset; }
# note: Create a calculation point by vertically translating the centerpoint with a safety distance to avoid the point being inside the tread geometry.
translate = Geometry.Translate(geometry=pointAtParameter, direction=ZAxis, distance=code_block_8)
ZAxis_2 = Vector.ZAxis()
code_block_9 = CodeBlock { 1; }
views = Views("Clearance")
# note: Use ray bounce to detect elements hitted in upward direction and return the hitpoint and the Revit element.
byOriginDirection = Revit.References.RayBounce.ByOriginDirection(translate, ZAxis_2, code_block_9, views, lacing=Longest)
code_block_10 = CodeBlock(a=byOriginDirection.out0) { a; }

count = List.Count(byOriginDirection.out0@L2)
code_block_11 = CodeBlock { 2; }
eq_2 = count == code_block_11

# group (continued): Ray Casting in Dynamo
# note: Filter out the results of rays that are not bouncing, and thus result only one point (which is the originator)
filterByBoolMask_3 = List.FilterByBoolMask(list=byOriginDirection.out0, mask=eq_2)
# note: Create the ray bounce lines from the resulting points.
byPoints = PolyCurve.ByPoints(points=filterByBoolMask_3.in)

# group: Clearance Height Requirement
length = Curve.Length(byPoints)
# note: Add the security offset to have the correct distance again.
add = length + safety_offset_number
code_block_12 = CodeBlock(MinClearanceHeight=min_clearance_height_number) { MinClearanceHeight; }
lt = add < code_block_12

# group: Visualization of hitted elements
# note: Bring the geometry that is hitted by the RayBounce and apply a transparency on it. Use the slider with Automatic Run, to instantly play with the visibility.
geometry = Element.Geometry(byOriginDirection.out1)
transparency_of_the_surrounding = DoubleSlider(80, range=0..100 step 1)  # "Transparency of the surrounding geometry / Number Slider"
code_block_13 = CodeBlock(transparency=transparency_of_the_surrounding)
# ---------- code_block_13.designscript (5 lines) ----------
//Trans blue
a=(1-transparency/100)*255;
r=0;
g=0;
b=100;
# ----------------------------------------
byARGB = Color.ByARGB(a=code_block_13.a, b=code_block_13.b)
byGeometryColor = Display.Display.ByGeometryColor(geometry, byARGB)

# group: Creation of rays in Revit
explode = Geometry.Explode(byPoints)
# note: Explode the polycurve the a single line, in order to create a model line in Revit.
flatten = Flatten(explode)
byCurve = ModelCurve.ByCurve(flatten)
code_block_14 = CodeBlock { "Line Style"; }
code_block_15 = CodeBlock { "FreeHeight"; }
# note: From the Archi-lab / Grimshaw package
get_line_style_by_name = Custom[Get Line Style by Name](Name=code_block_15)  # This node will return a line style object by its name. Line styles can be either Drafting or Model Line Property.
# note: [Optional]
# Change the linestyle of the model line in Revit.
setParameterByName = Element.SetParameterByName(element=byCurve, parameterName=code_block_14, value=get_line_style_by_name)

# group: Visualization of the rays in Revit and Dynamo
# note: Filter the ray bounce lines in Dynamo, based on the clearance height criteria, and change their appearance in the Dynamo canvas.
filterByBoolMask_4 = List.FilterByBoolMask(list=byPoints, mask=lt)
code_block_16 = CodeBlock()
# ---------- code_block_16.designscript (5 lines) ----------
//Red
a=255;
r=255;
g=0;
b=0;
# ----------------------------------------
byARGB_2 = Color.ByARGB(a=code_block_16.a, r=code_block_16.r, g=code_block_16.g, b=code_block_16.b)
byGeometryColor_2 = Display.Display.ByGeometryColor(filterByBoolMask_4.in, byARGB_2)
code_block_17 = CodeBlock()
# ---------- code_block_17.designscript (5 lines) ----------
//Green
a=255;
r=0;
g=255;
b=0;
# ----------------------------------------
byARGB_3 = Color.ByARGB(a=code_block_17.a, r=code_block_17.r, g=code_block_17.g, b=code_block_17.b)
# note: Lines that do NOT meet the requirements.
# note: Lines that meet the requirements.
byGeometryColor_3 = Display.Display.ByGeometryColor(filterByBoolMask_4.out, byARGB_3)
# note: Filter the model lines in Revit, based on the clearance height criteria, and change their appearance in the current Revit view.
filterByBoolMask_5 = List.FilterByBoolMask(list=setParameterByName, mask=lt)
overrideColorInView = Element.OverrideColorInView(element=filterByBoolMask_5.in, color=byARGB_2)
overrideColorInView_2 = Element.OverrideColorInView(element=filterByBoolMask_5.out, color=byARGB_3)
