# Dynamo graph 2024.10.24-TAG-SELECT ALL RECONCILED TAG.dyn (Dynamo 2.12.1.8246)
# packages: Genius Loci 2023.1.23

python_script_selecting_all_tag = Python()  # "Python Script-Selecting all Tag in Doc"; IronPython2
# ---------- python_script_selecting_all_tag.python (41 lines) ----------
# Copyright(c) 2019, Konrad K Sobon
# @arch_laboratory, http://archi-lab.net

import clr
clr.AddReference('ProtoGeometry')
import Autodesk.DesignScript.Geometry

clr.AddReference("RevitNodes")
import Revit
clr.ImportExtensions(Revit.Elements)

clr.AddReference("RevitServices")
import RevitServices
from RevitServices.Persistence import DocumentManager
from RevitServices.Transactions import TransactionManager
doc = DocumentManager.Instance.CurrentDBDocument

clr.AddReference("RevitAPI")
from Autodesk.Revit.DB import *

import System
from System import Array
from System.Collections.Generic import *

import sys
pyt_path = r'C:\Program Files (x86)\IronPython 2.7\Lib'
sys.path.append(pyt_path)

try:
    errorReport = None
    ids = FilteredElementCollector(doc).OfClass(IndependentTag).WhereElementIsNotElementType().ToElementIds()
    output = [x.IntegerValue for x in ids]

except:
    import traceback
    errorReport = traceback.format_exc()

if None == errorReport:
    OUT = output
else:
    OUT = 0
# ----------------------------------------
tag_isorphaned = Custom[Tag IsOrphaned](tag=python_script_selecting_all_tag)  # package Genius Loci; Identify the orphaned tags. Orphaned tags are tags that are associated with a linked document but no longer have a host element.
element_types = ElementTypes("RoomTag")
all_elements_of_type = ElementsOfType(element_type=element_types)
python_script_tag_isorphaned = Python(IN[0]=all_elements_of_type)  # "Python Script-Tag IsOrphaned (Original)"; IronPython2
# ---------- python_script_tag_isorphaned.python (38 lines) ----------
#Alban de Chasteigner 2020
#twitter : @geniusloci_bim
#geniusloci.bim@gmail.com
#https://github.com/albandechasteigner/GeniusLociForDynamo

import clr
clr.AddReference("RevitAPI")
import Autodesk
from Autodesk.Revit.DB import *

clr.AddReference('RevitNodes')
import Revit
clr.ImportExtensions(Revit.Elements)

clr.AddReference("RevitServices")
import RevitServices
from RevitServices.Persistence import DocumentManager
doc = DocumentManager.Instance.CurrentDBDocument

tag = UnwrapElement(IN[0]) if isinstance(IN[0],list) else [UnwrapElement(IN[0])]

orphaned = []
taghost = []

ueWrapper = None
wrappers = clr.GetClrType(Revit.Elements.ElementWrapper).GetMethods()
for w in wrappers:
	if w.ToString().startswith("Revit.Elements.UnknownElement"):
		ueWrapper = w
		break

for t in tag:
	if t.IsOrphaned:
		orphaned.append(ueWrapper.Invoke(None, (t, True)))
	elif not t.IsOrphaned:
		taghost.append(ueWrapper.Invoke(None, (t, True)))

OUT = orphaned, taghost
# ----------------------------------------
code_block = CodeBlock(x=python_script_tag_isorphaned) { x[0]; x[1]; }
code_block_2 = CodeBlock(TagwithHost=code_block.out1) { TagwithHost; }
type = Object.Type(object=python_script_selecting_all_tag)
element_by_id = ElementById(Id=python_script_selecting_all_tag)
code_block_3 = CodeBlock(Orphaned=code_block.out0) { Orphaned; }
watch = Watch(code_block_3)
selection_set_name = StringInput("Reconciled Tag")
python_script_selectionset = Python(IN[0]=watch, IN[1]=selection_set_name)  # IronPython2
# ---------- python_script_selectionset.python (53 lines) ----------
import clr
clr.AddReference('RevitAPI')
from Autodesk.Revit.DB import *
from System.Collections.Generic import *

clr.AddReference("RevitNodes")
import Revit
clr.ImportExtensions(Revit.Elements)

clr.AddReference("RevitServices")
import RevitServices
from RevitServices.Persistence import DocumentManager
from RevitServices.Transactions import TransactionManager

import sys
pyt_path = r'C:\Program Files (x86)\IronPython 2.7\Lib'
sys.path.append(pyt_path)

import traceback

doc = DocumentManager.Instance.CurrentDBDocument
name = IN[1]

# create itemset
items = UnwrapElement(IN[0])
ids = list()
for item in items:
	ids.append(item.Id)
itemset = List[ElementId](ids)

try:
	# collect all existing filters from the model 
	names = list()
	collector = FilteredElementCollector(doc)
	filters = collector.OfClass(FilterElement).ToElements();
	
	selset = False
	TransactionManager.Instance.EnsureInTransaction(doc)
	# if a filter of that name already exists, delete its content
	for filter in filters:
		if filter.Name == name:
			filter.Clear()
			selset = filter
	# create a new selection set if it doesn't already exist
	if selset == False:
		selset = SelectionFilterElement.Create(doc,name)

	selset.AddSet(itemset)
	OUT = selset.ToDSType(False)
	
	TransactionManager.Instance.TransactionTaskDone()
except Exception, ex:	
	OUT = traceback.format_exc()
# ----------------------------------------
family_types = FamilyTypes("NIA-AR-ANO-TAG-ROOM_PIM:Room Tag with Room No., Area")
all_elements_of_family_type = ElementsOfFamilyType(Family_Type=family_types)
