# Dynamo graph @2022.04.22-TEMPLATE-DYNAMO_GROUPCOLOR_TEMPLATE.DYF "SJ_Template" (Dynamo 2.0.3.8810)

# group: DEBUG
# note: Nodes used to debug the graph logic

# group: SET
# note: Set parameter values of Revit objects

# group: GET
# note: Get parameter values from Revit objects

# group: INPUT
# note: Data input and preparation

# group: FUNCTION
# note: Data manipulation on Dynamo objects

# group: WIP
# note: Notes not considered part of the final package

# group: OUTPUT
# note: Object creation in Revit, Final output

# group: NOTES
# note: GUIDELINES
# Read the instructions.
# Add Notes and Comments to the graph.
# Use Node Groups and the Standard Color Coding.
# Rename Nodes: <OriginalName> | <Description>.
# Write Input and Output Notes for Python Scripts.
# Prefer repeatable simple node structures.
# note: INSTRUCTIONS
# <DESCRIPTIONS>
# <INSTRUCTIONS>
# note: KNOWN ISSUES AND LIMITATIONS
# <ISSUES>
# <LIMITATIONS>
useful_links_ctrl_click_the_link = CodeBlock()  # "Useful Links | CTRL + Click the link below"
# ---------- useful_links_ctrl_click_the_link.designscript (2 lines) ----------
"http://primer.dynamobim.org/Appendix/A-3_packages.html";
"http://primer.dynamobim.org/13_Best-Practice/13-1_Introduction.html";
# ----------------------------------------
# note: GRAPH INFO
# Copyright 2019 Autodesk, Inc. All rights reserved.
# Company: Surbana Jurong
# Office: <office>
# Version: 1.0.0
# Author: <author>
# Keywords: [KEYWORDS]
# Tested on:
# Dynamo : 2.0.3
# Revit : 2019
python_script_reference_lib = Python()  # unwired: IN[0]
# ---------- python_script_reference_lib.python (37 lines) ----------
import clr

clr.AddReference('ProtoGeometry')
from Autodesk.DesignScript.Geometry import *

clr.AddReference('RevitAPI')
from Autodesk.Revit.DB import *
from Autodesk.Revit.DB.Structure import *

clr.AddReference('RevitAPIUI')
from Autodesk.Revit.UI import *

clr.AddReference('System')
from System.Collections.Generic import List

clr.AddReference('RevitNodes')
import Revit
clr.ImportExtensions(Revit.GeometryConversion)
clr.ImportExtensions(Revit.Elements)

clr.AddReference('RevitServices')
import RevitServices
from RevitServices.Persistence import DocumentManager
from RevitServices.Transactions import TransactionManager

doc = DocumentManager.Instance.CurrentDBDocument
uidoc=DocumentManager.Instance.CurrentUIApplication.ActiveUIDocument

# Preparing input from Dynamo to Revit
element = UnwrapElement(IN[0])

# Do some action in a Transaction
TransactionManager.Instance.EnsureInTransaction(doc)

TransactionManager.Instance.TransactionTaskDone()

OUT = element
# ----------------------------------------
