# Dynamo graph NIA_Level - ChangeLevelBySelection-V2.dyn "Binh DUONG - ChangeLevelBySelection-V2" (Dynamo 2.12.1.8246)
# packages: Data-Shapes 2022.2.103

# group: Input
select_model_elements = DSModelElementsSelection()  # 198 picked in the model; graph input
watch = Watch(select_model_elements)
move_elements_to_level = Levels("B3 - Basement Floor (SSL)")  # graph input

# group: UI from DATA-Shapes
code_block = CodeBlock { "Input"; 600; }
code_block_2 = CodeBlock { "Base/Top Level"; "Height Base/Top Offset"; }
firstItem = List.FirstItem(list=watch)
parameters = Element.Parameters(element=firstItem)
name = Parameter.Name(parameter=parameters)
dropdown_data = Custom[DropDown Data](InputName=code_block_2.out0, Keys=name, Values=name)  # package Data-Shapes; Create data for DropDown input in UI.MultiInputForm ++ . Check out www.data-shapes.net for more infos.
dropdown_data_2 = Custom[DropDown Data](InputName=code_block_2.out1, Keys=name, Values=name)
list_create = List.Create(item0=dropdown_data, item1=dropdown_data_2)
boolean = BoolSelector(true)
multipleinputform = Custom[MultipleInputForm ++](Description_optional=code_block.out0, Inputs=list_create, Toggle=boolean, MaxHeight_optional=code_block.out1, Width_optional=code_block.out1)  # package Data-Shapes; Create a form with multiple inputs. see www.data-shapes.net for tutorials and infos!
code_block_3 = CodeBlock(x=multipleinputform.User_Inputs) { x[0]; x[1]; }

parameter_of_base_offset = Watch(code_block_3.out1)
parameter_level = Watch(code_block_3.out0)

# group: Formula: newoffset=oldLevel-newLevel+oldoffset;
elevation = Level.Elevation(level=move_elements_to_level)
getParameterValueByName = Element.GetParameterValueByName(element=watch, parameterName=parameter_level)
elevation_2 = Level.Elevation(level=getParameterValueByName)
getParameterValueByName_2 = Element.GetParameterValueByName(element=watch, parameterName=parameter_of_base_offset)
code_block_4 = CodeBlock(Levelnew=elevation, Levelold=elevation_2, oldoffset=getParameterValueByName_2) { -Levelnew+Levelold+oldoffset; }

setParameterByName = Element.SetParameterByName(element=watch, parameterName=parameter_of_base_offset, value=code_block_4)
setParameterByName_2 = Element.SetParameterByName(element=setParameterByName, parameterName=parameter_level, value=move_elements_to_level)
